# Grasshopper definition 101_brick_to_robot_sharon.gh (Grasshopper 1.0.8)
# plug-ins: Robots, Pufferfish

number_slider = Slider(100, range=0..100)  # disabled
number_slider_2 = Slider(95, range=0..100)  # disabled
crv = Curve([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])  # disabled
py3 = Python3Script(curves=crv, x=number_slider, y=number_slider_2)  # -> out, points, way_frame, polar_bricks, moved_bricks; inputs curves: list of Curve, x: Double, y: Double; disabled
# ---------- py3: Python ----------
# r: compas
# venv: mas-2526
from compas_rhino.devtools import DevTools
DevTools.ensure_path()

import math
from compas.geometry import Box, Point, Frame, Vector, cross_vectors, Rotation, Translation
from compas_rhino.conversions import curve_to_compas
from brick_wall_2 import Brick

crvs = []
points = []
frames = []
bricks = []

for c in curves:
    cc = curve_to_compas(c)
    crvs.append(cc)


def param_list(curve, num_div):
    params = curve.divide_by_count(num_div)
    return params


def get_h_brick(curve, param):  # horizontal bricks
    pt = curve.point_at(param)
    points.append(pt)
    tan = crv.tangent_at(param)
    nor = tan.cross(Vector(0, 0, 1))
    frame = Frame(pt, tan, nor)
    frames.append(frame)
    b = Brick(frame)
    return b


def get_v_brick(curve, param):  # vertical bricks
    pt = curve.point_at(param)
    points.append(pt)
    tan = crv.tangent_at(param)
    nor = tan.cross(Vector(0, 0, 1))
    frame = Frame(pt, nor, tan)
    frames.append(frame)
    b = Brick(frame)
    return b


# === Polar Array 基本參數設定 ===
center = Point(0, 0, 0)
axis = Vector(0, 0, 1)
angle = math.radians(360 / 3)  # 每次旋轉角度 = 120°

polar_bricks = []

# === 逐層排磚（每一層先 polar array）===
for i_c, crv in enumerate(crvs):

    layer_bricks = []  # 暫存該層原始磚

    params = param_list(crv, 6)
    if i_c % 2 == 0:  # even row
        for i_p, param in enumerate(params):
            if i_p % 7 == 1 or i_p % 7 == 5:  # horizontal bricks
                b = get_h_brick(crv, param)
                layer_bricks.append(b)
            if i_p % 7 == 3:  # vertical bricks
                b = get_v_brick(crv, param)
                layer_bricks.append(b)

    if i_c % 2 == 1:  # odd row
        for i_p, param in enumerate(params):
            if i_p % 7 == 2 or i_p % 7 == 6:  # horizontal bricks
                b = get_h_brick(crv, param)
                layer_bricks.append(b)
            if i_p % 7 == 4:  # vertical bricks
                b = get_v_brick(crv, param)
                layer_bricks.append(b)

    # === 該層 polar array ===
    for i in range(3):  # 共 3 組 (0°,120°,240°)
        R = Rotation.from_axis_and_angle(axis, angle * i, point=center)
        for b in layer_bricks:
            fr = b.frame
            r_fr = fr.transformed(R)
            bb = Brick(r_fr)
            polar_bricks.append(bb.draw())

# === 新增：移動整體結構 ===
# 設定移動向量
move_vec = Vector(x, y, 0)
T = Translation.from_vector(move_vec)

moved_bricks = []
for b in polar_bricks:
    fr = b.frame
    m_fr = fr.transformed(T)
    moved_bricks.append(Brick(m_fr).draw())

# === Flip frame 方向 ===
way_frame = []
for b in moved_bricks:
    fr = b.frame
    if fr.zaxis.z > 0:
        fr.flip()
    way_frame.append(fr)

print("Total bricks after layered polar array:", len(polar_bricks))
# ---------- end py3 ----------
draw = COMPASDraw(cg=py3.points)  # -> rg; disabled
#   port cg: The COMPAS geometry or datastructure to be drawn.
#   port rg: The Rhino geometry object.
# ---------- draw: Python ----------
# r: compas>=2.14.1
"""
Draws COMPAS geometry in Grasshopper.
"""

from typing import Any

import Grasshopper

from compas.scene import SceneObject


class CompasToRhinoGeometry(Grasshopper.Kernel.GH_ScriptInstance):
    def RunScript(self, cg):
        if not cg:
            return None

        return SceneObject(item=cg).draw()
# ---------- end draw ----------
draw_2 = COMPASDraw(cg=py3.way_frame)  # -> rg; disabled; same code as draw
draw_3 = COMPASDraw(cg=py3.polar_bricks)  # -> rg; disabled; same code as draw
draw_4 = COMPASDraw(cg=py3.moved_bricks)  # -> rg; disabled; same code as draw
number_slider_3 = Slider(0, range=0..100)  # disabled
item = ListItem(List=draw_2, Index=0, Wrap=True)  # -> Item, Item1, Item2; disabled
swatch = ColourSwatch(SwatchColor=RGB(186, 98, 39))  # disabled
swatch_2 = ColourSwatch(SwatchColor=RGB(186, 98, 39))  # disabled
pl = ConstructPlane(Origin=item.Item, XAxis=item.Item1, YAxis=item.Item2)  # disabled
item_2 = ListItem(List=flatten(pl), Index=number_slider_3, Wrap=True)  # disabled
preview = CustomPreview(Geometry=draw_3, Material=swatch)  # disabled
preview_2 = CustomPreview(Geometry=draw_4, Material=swatch_2)  # disabled

# ---- group: This is needed only ONCE in the GH definition
enable_auto_reload = Python3Script()  # -> ok
# ---------- enable_auto_reload: Python ----------
"""
------------------------------
Using VS Code as Python editor
------------------------------

The simplest way to start using VS Code as our editor, is
to place our Python code in files located IN THE SAME FOLDER as our Grasshopper file.

After we have done that, we need 2 steps: 

1. Enable the COMPAS reloader on one component. This tells Grasshopper to watch for changes in the Pythoh files and reload if changed.
2. Every other component that uses Python code from external files needs to start with a method to ensure Grasshopper knows where to load the files from.

"""
# r: compas
# venv: mas-2526

from compas_rhino.devtools import DevTools
DevTools.enable_reloader()
# ---------- end enable_auto_reload ----------

# ----
# Brick wal_5
#  (U-curve + rotate at a stable number)
crv_u_2 = Curve(<curve referenced from the Rhino model>)  # disabled
number_slider_4 = Slider(10, range=0..30)  # disabled
number_slider_5 = Slider(1.5, range=0..10)  # disabled
number_slider_6 = Slider(10, range=0..30)  # disabled
number_slider_7 = Slider(36, range=0..180)  # disabled
py3_2 = Python3Script(crv=crv_u_2, num_layers=number_slider_4, gap=number_slider_5, cols=number_slider_6, rotation=number_slider_7)  # -> out, geometries, way_planes; inputs crv: Curve, num_layers: Int32, gap: Double, cols: Int32, rotation: Double; disabled
# ---------- py3_2: Python ----------
# r: compas
# venv: mas-2526

from compas_rhino.devtools import DevTools
DevTools.ensure_path()

import math
from compas.geometry import Box, Point, Frame, cross_vectors, Vector
from compas_rhino.conversions import curve_to_compas
from brick_wall_2 import Brick

bricks = []

curve = curve_to_compas(crv)
print(curve.length())

num_divs = int(curve.length())/(Brick.LENGTH+gap) * 2
params, div_pts = curve.divide_by_count(num_divs, True)

for row in range(num_layers):
    for col, param in enumerate(params):
        pt = curve.point_at(param)
        pt = pt.translated([0,0, Brick.HEIGHT * row])
        tangent = curve.tangent_at(param)
        normal = cross_vectors(tangent, [0,0,1])

        # dispatch A,B row
        if row % 2 == 0:
            if col % 2 == 0:
                b = Brick(Frame(pt, tangent, normal)) 
                bricks.append(b)               
        else:
            if row % 2 == 1 and col == 1:
                b_left = Brick(Frame(pt, tangent, normal))
                b_left.rotate(90)
                b_left.frame.translate(-tangent.unitized()*(Brick.LENGTH + Brick.WIDTH + gap)* 4/7)
                bricks.append(b_left)

            if col % 2 == 1:                
                b = Brick(Frame(pt, tangent, normal))
                bricks.append(b)
                
            if row % 2 == 1 and col == len(params)-2:
                b_right = Brick(Frame(pt, tangent, normal))
                b_right.rotate(90)
                b_right.frame.translate(tangent.unitized()* 1/2 *(Brick.LENGTH + Brick.WIDTH + gap*4))
                bricks.append(b_right)


        # rotation
        if row % 3 == 0 and col % 3 == 0:
            b.rotate(rotation)

# visualize and store brick data
geometries = []
way_planes = []

for brick in bricks:
    geometries.append(brick.draw())
    way_planes.append(brick.get_pick_frame())
# ---------- end py3_2 ----------
draw_5 = COMPASDraw(cg=py3_2.way_planes)  # -> rg; disabled; same code as draw
draw_6 = COMPASDraw(cg=py3_2.geometries)  # -> rg; disabled; same code as draw
number_slider_8 = Slider(10, range=0..10)  # disabled
number_slider_9 = Slider(45, range=0..100)  # disabled
item_3 = ListItem(List=draw_5, Index=0, Wrap=True)  # -> Item, Item1, Item2; disabled
preview_3 = CustomPreview(
    Geometry=draw_6,
    Material={diffuse=RGB(221, 160, 221), emission=RGB(66, 48, 66), shine=0.5, specular=RGB(255, 255, 255), transparency=0})  # disabled
pl_2 = ConstructPlane(Origin=item_3.Item, XAxis=item_3.Item1, YAxis=item_3.Item2)  # disabled
item_4 = ListItem(List=draw_6, Index=number_slider_9, Wrap=True)  # disabled
pln = Plane(pl_2)  # disabled

# ---- group: Brick wal_5 (rotate stable)
# Brick wal_5
#  (U-curve + rotate at a stable number)
crv_u_2_2 = Curve(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)  # disabled
crv_u_3 = Curve(<curve referenced from the Rhino model>)  # disabled
number_slider_10 = Slider(9, range=0..30)  # disabled
number_slider_11 = Slider(3, range=0..10)  # disabled
number_slider_12 = Slider(9, range=0..180)  # disabled
number_slider_13 = Slider(10, range=0..30)  # disabled
py3_3 = Python3Script(crv=crv_u_3, num_layers=number_slider_10, gap=number_slider_11, cols=number_slider_13, rotation=number_slider_12)  # -> out, geometries, way_planes; inputs crv: Curve, num_layers: Int32, gap: Double, cols: Int32, rotation: Double; disabled
# ---------- py3_3: Python ----------
# r: compas
# venv: mas-2526

from compas_rhino.devtools import DevTools
DevTools.ensure_path()

import math
from compas.geometry import Box, Point, Frame, cross_vectors
from compas_rhino.conversions import curve_to_compas
from brick_wall_2 import Brick

bricks = []

curve = curve_to_compas(crv)
print(curve.length())

num_divs = int(curve.length())/(Brick.LENGTH+gap) * 2
params, div_pts = curve.divide_by_count(num_divs, True)

for row in range(num_layers):
    for col, param in enumerate(params):
        pt = curve.point_at(param)
        pt = pt.translated([0,0, Brick.HEIGHT * row])
        tangent = curve.tangent_at(param)
        normal = cross_vectors(tangent, [0,0,1])

        # dispatch A,B row
        if row % 2 == 0:
            if col % 2 == 0:
                bricks.append(Brick(frame = Frame(pt, tangent, normal)))
        else:
            if col % 2 == 1:
                bricks.append(Brick(frame = Frame(pt, tangent, normal)))

for b in bricks:
    b.rotate(rotation)

# visualize and store brick data
geometries = []
way_planes = []

for brick in bricks:
    geometries.append(brick.draw())
    way_planes.append(brick.get_pick_frame())
# ---------- end py3_3 ----------
draw_7 = COMPASDraw(cg=py3_3.way_planes)  # -> rg; disabled; same code as draw
draw_8 = COMPASDraw(cg=py3_3.geometries)  # -> rg; disabled; same code as draw
item_5 = ListItem(List=draw_7, Index=0, Wrap=True)  # -> Item, Item1, Item2; disabled
preview_4 = CustomPreview(
    Geometry=draw_8,
    Material={diffuse=RGB(221, 160, 221), emission=RGB(66, 48, 66), shine=0.5, specular=RGB(255, 255, 255), transparency=0})  # disabled
pl_3 = ConstructPlane(Origin=item_5.Item, XAxis=item_5.Item1, YAxis=item_5.Item2)  # disabled
pln_2 = Plane(pl_3)  # disabled

# ----
# Brick wal_5
#  (U-curve + rotate at a stable number)
crv_u_2_3 = Curve(<curve referenced from the Rhino model>)
py3_4 = Python3Script(
    crv=crv_u_2_3,
    num_layers=Slider(10, range=0..30),
    gap=Slider(3, range=0..10),
    cols=Slider(10, range=0..30),
    rotation=Slider(48, range=0..180))  # -> out, geometries, way_planes; inputs crv: Curve, num_layers: Int32, gap: Double, cols: Int32, rotation: Double
# ---------- py3_4: Python ----------
# r: compas
# venv: mas-2526

from compas_rhino.devtools import DevTools
DevTools.ensure_path()

import math
from compas.geometry import Box, Point, Frame, cross_vectors, Vector
from compas_rhino.conversions import curve_to_compas
from brick_wall_2 import Brick

bricks = []

curve = curve_to_compas(crv)
print(curve.length())

num_divs = int(curve.length())/(Brick.LENGTH+gap) * 2
params, div_pts = curve.divide_by_count(num_divs, True)

for row in range(num_layers):
    for col, param in enumerate(params):
        pt = curve.point_at(param)
        pt = pt.translated([0,0, Brick.HEIGHT * row])
        tangent = curve.tangent_at(param)
        normal = cross_vectors(tangent, [0,0,1])

        # dispatch A,B row
        if row % 2 == 0:
            if col % 2 == 0:
                b = Brick(Frame(pt, tangent, normal)) 
                bricks.append(b)
            if row % 2 == 0 and col == len(params)-2:
                b_right = Brick(Frame(pt, tangent, normal))
                b_right.rotate(90)
                b_right.frame.translate(tangent.unitized()* 1/2 *(Brick.LENGTH + Brick.WIDTH + gap*3))
                bricks.append(b_right)               
        else:
            if row % 2 == 1 and col == 1:
                b_left = Brick(Frame(pt, tangent, normal))
                b_left.rotate(90)
                b_left.frame.translate(-tangent.unitized()*(Brick.LENGTH + Brick.WIDTH + gap)* 4/7)
                bricks.append(b_left)

            if col % 2 == 1:                
                b = Brick(Frame(pt, tangent, normal))
                bricks.append(b)
                
            # if row % 2 == 1 and col == len(params)-2:
            #     b_right = Brick(Frame(pt, tangent, normal))
            #     b_right.rotate(90)
            #     b_right.frame.translate(tangent.unitized()* 1/2 *(Brick.LENGTH + Brick.WIDTH + gap*4))
            #     bricks.append(b_right)


        # rotation
        if row % 3 == 0 and col % 4 == 0:
            b.rotate(90)
        if row % 2 != 0 and col % 3 == 0:
            b.rotate(rotation)

# visualize and store brick data
geometries = []
way_planes = []

for brick in bricks:
    geometries.append(brick.draw())
    way_planes.append(brick.get_pick_frame())
# ---------- end py3_4 ----------
draw_9 = COMPASDraw(cg=py3_4.way_planes)  # -> rg; same code as draw
draw_10 = COMPASDraw(cg=py3_4.geometries)  # -> rg; same code as draw
number_slider_14 = Slider(10, range=0..10)
item_6 = ListItem(List=draw_9, Index=0, Wrap=True)  # -> Item, Item1, Item2
preview_5 = CustomPreview(
    Geometry=draw_10,
    Material={diffuse=RGB(221, 160, 221), emission=RGB(66, 48, 66), shine=0.5, specular=RGB(255, 255, 255), transparency=0})
pl_4 = ConstructPlane(Origin=item_6.Item, XAxis=item_6.Item1, YAxis=item_6.Item2)
item_7 = ListItem(List=draw_10, Index=Slider(0, range=0..100), Wrap=True)
pln_3 = Plane(pl_4)

# ----
# Brick wal_5
#  (U-curve + rotate at a stable number)
crv_u_2_4 = Curve(<curve referenced from the Rhino model>)
py3_5 = Python3Script(
    crv=crv_u_2_4,
    num_layers=Slider(10, range=0..30),
    gap=Slider(3, range=0..10),
    cols=Slider(10, range=0..30),
    rotation=Slider(48, range=0..180))  # -> out, geometries, way_planes; inputs crv: Curve, num_layers: Int32, gap: Double, cols: Int32, rotation: Double
# ---------- py3_5: Python ----------
# r: compas
# venv: mas-2526

from compas_rhino.devtools import DevTools
DevTools.ensure_path()

import math
from compas.geometry import Box, Point, Frame, cross_vectors, Vector
from compas_rhino.conversions import curve_to_compas
from brick_wall_2 import Brick

bricks = []

curve = curve_to_compas(crv)
print(curve.length())

num_divs = int(curve.length())/(Brick.LENGTH+gap) * 2
params, div_pts = curve.divide_by_count(num_divs, True)

for row in range(num_layers):
    for col, param in enumerate(params):
        pt = curve.point_at(param)
        pt = pt.translated([0,0, Brick.HEIGHT * row])
        tangent = curve.tangent_at(param)
        normal = cross_vectors(tangent, [0,0,1])

        # dispatch A,B row
        if row % 2 == 0: # even row
            if col % 2 == 0:
                b = Brick(Frame(pt, tangent, normal)) 
                bricks.append(b)
            if col == len(params)-2: # vertical brick in the end
                b_right = Brick(Frame(pt, tangent, normal))
                b_right.rotate(90)
                b_right.frame.translate(tangent.unitized() * (Brick.LENGTH + Brick.WIDTH + gap) * 1/2)
                bricks.append(b_right)               
        else: # odd row
            if col == 1: # vertical brick in the first
                b_left = Brick(Frame(pt, tangent, normal))
                b_left.rotate(90)
                b_left.frame.translate(-tangent.unitized()*(Brick.LENGTH + Brick.WIDTH + gap)* 1/2)
                bricks.append(b_left)

            if col % 2 == 1:                
                b = Brick(Frame(pt, tangent, normal))
                bricks.append(b)

        # rotation
        if row % 2 != 0:
            b.rotate(col*4.5)
        if row % 2 == 0 and col % 4 == 0:
            b.rotate(col*1.5)
        # if row % 3 == 0 and col % 4 == 0:
        #     b.rotate(90)
        # if row % 2 != 0 and col % 3 == 0:
        #     b.rotate(rotation)
        # if row % 2 == 0:
        #     b.rotate(col*6)

# visualize and store brick data
geometries = []
way_planes = []

for brick in bricks:
    geometries.append(brick.draw())
    way_planes.append(brick.get_pick_frame())
# ---------- end py3_5 ----------
draw_11 = COMPASDraw(cg=py3_5.way_planes)  # -> rg; same code as draw
draw_12 = COMPASDraw(cg=py3_5.geometries)  # -> rg; same code as draw
number_slider_15 = Slider(10, range=0..10)
item_8 = ListItem(List=draw_11, Index=0, Wrap=True)  # -> Item, Item1, Item2
preview_6 = CustomPreview(
    Geometry=draw_12,
    Material={diffuse=RGB(221, 160, 221), emission=RGB(66, 48, 66), shine=0.5, specular=RGB(255, 255, 255), transparency=0})
pl_5 = ConstructPlane(Origin=item_8.Item, XAxis=item_8.Item1, YAxis=item_8.Item2)
item_9 = ListItem(List=draw_12, Index=Slider(0, range=0..100), Wrap=True)
pln_4 = Plane(pl_5)

# ---- group: triangle tower_hor, ver_holes
number_slider_16 = Slider(4, range=0..30)
number_slider_17 = Slider(30, range=0..100)
gap = Slider(4.5, range=0..10)
py3_6 = Python3Script(num_layers=number_slider_17, gap=gap, num_bricks=number_slider_16, rot=Slider(15, range=0..100))  # -> out, poly, polylines, center, frames, bricks; inputs num_layers: Int32, gap: Double, num_bricks: Int32, rot: Double
# ---------- py3_6: Python ----------
# r: compas
# venv: mas-2526

from compas_rhino.devtools import DevTools
DevTools.enable_reloader()

import math
from compas.geometry import Box, Point, Frame
from compas.geometry import Polygon, Polyline, Vector, Line
from brick_wall_2 import Brick

# Make curve as a triangle that is equal to the brick size
unit_div = ((Brick.LENGTH + Brick.WIDTH)/2) + gap
x = unit_div * num_bricks
y = x * math.sin(math.radians(60))

u = 18 # 45
v = 60 #72
pt_1 = Point(0+u,0+v,0)
pt_2 = Point(x+u, 0+v, 0)
pt_3 = Point(x/2+u, y+v, 0)
center = Point(x/2+u, y/3+v, 0)

pt_list = [pt_1, pt_2, pt_3, pt_1]
poly = Polyline(pt_list)

# make skeleton curves & primitive bricks
vectors = []
bricks = []
polylines = []
p_l = []

def horizontal_brick(point, move=0, rotation=0):
    tan = polyline.tangent_at_point(point)
    tan.unitize()
    cross = tan.cross(Vector(0,0,1))
    cross.unitize()
    new_pt = pt.translated(tan*move)
    cross.scale(Brick.WIDTH/2)
    c_new_pt = new_pt.translated(cross)
    b = Brick(Frame(c_new_pt, tan, cross))
    b.rotate(rotation)
    bricks.append(b.draw())
    return bricks

def vertical_brick(point, move=0, rotation=0):
    tan = polyline.tangent_at_point(point)
    cross = tan.cross(Vector(0,0,1))
    cross.unitize()
    new_pt = pt.translated(cross*move)
    cross.scale(Brick.WIDTH/2)
    c_new_pt = new_pt.translated(cross)
    b = Brick(Frame(c_new_pt, cross, tan))
    b.rotate(rotation)
    bricks.append(b.draw())
    return bricks

height = Brick.HEIGHT
for row in range(num_layers):
    polyline = poly.translated([0,0,height*row])
    polyline.rotate(math.radians(3*row), axis=Vector(0,0,1), point=center)
    polylines.append(polyline)
    points_list = polyline.divide_by_length(unit_div/2)
    print(len(points_list))

    for i, pt in enumerate(points_list):
        if row % 2 == 0: # even row
            if i % 8 == 0: # vertical
                vertical_brick(pt, move=3)
            if i % 8 == 4: # vertical
                vertical_brick(pt)
            if i % 4 == 2: # horizontal
                horizontal_brick(pt)
        else: # odd row
            if i % 8 == 1: # horizontal
                horizontal_brick(pt, move=3)
            if i % 8 == 5: # horizontal
                horizontal_brick(pt)
            if i % 8 == 7: # vertical
                vertical_brick(pt, rotation=rot)               
frames = []
for b in bricks:
    frame = b.frame
    if frame.zaxis.z > 0:
        frame.flip()
    frames.append(frame)
# ---------- end py3_6 ----------
multiplication = Multiplication(A=number_slider_17, B=number_slider_16)
panel = Panel(multiplication)
draw_13 = COMPASDraw(cg=py3_6.bricks)  # -> rg; same code as draw
draw_14 = COMPASDraw(cg=py3_6.poly)  # -> rg; same code as draw
draw_15 = COMPASDraw(cg=py3_6.polylines)  # -> rg; same code as draw
draw_16 = COMPASDraw(cg=py3_6.center)  # -> rg; same code as draw
draw_17 = COMPASDraw(cg=py3_6.frames)  # -> rg; same code as draw
item_10 = ListItem(List=draw_17, Index=0, Wrap=True)  # -> Item, Item1, Item2
pl_6 = ConstructPlane(Origin=item_10.Item, XAxis=item_10.Item1, YAxis=item_10.Item2)
preview_7 = CustomPreview(Geometry=draw_13, Material=ColourSwatch(SwatchColor=RGB(196, 175, 106)))

# ---- group: Generate Geometry
crv_2 = Curve(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)  # disabled
number_slider_18 = Slider(9, range=0..30)  # disabled
gap_2 = Slider(2.5, range=0..10)  # disabled
brick_wall = Python3Script(crv=crv_2, num_layers=number_slider_18, gap=gap_2)  # -> bricks, geometries, way_planes; inputs crv: Curve, num_layers: Int32, gap: Double; disabled
# ---------- brick_wall: Python ----------
# r: compas
# venv: mas-2526
from compas_rhino.devtools import DevTools
DevTools.ensure_path()

# 0. Import everything we will need
import math
from compas.geometry import Box
from compas.geometry import Point
from compas.geometry import Frame
from compas.geometry import cross_vectors
from compas_rhino.conversions import curve_to_compas

# ..also import our module "brick_wall.py", that needs to be in the same folder as our GH file
from brick_wall import Brick

# 1. Start with an empty list of bricks to be created
#    make sure to match the name of this list to the output of this component!
bricks = []

# 2. Create points on each curve
curve = curve_to_compas(crv)
print(curve.length())

# divide curve twice as fine
num_divs = int(curve.length() / (Brick.LENGTH+gap)) * 2
params, div_pts = curve.divide_by_count(num_divs, True)

for row in range(num_layers):
    for col, param in enumerate(params,):
        pt = curve.point_at(param)
        pt = pt.translated([0,0,Brick.HEIGHT * row])
        tangent = curve.tangent_at(param)
        normal = cross_vectors(tangent, [0,0,1])
        # only place bricks on alternating divisions depending on the row
        if row % 2 == 0:  
            # even rows 
            if col % 2 == 0:
                b = Brick(frame = Frame(pt, tangent, normal))
                bricks.append(b)
        else:  
            # odd rows 
            if col % 2 == 1:
                b = Brick(frame = Frame(pt, tangent, normal))
                bricks.append(b)

# Visualize and store brick data
geometries = []
way_planes = []

for brick in bricks:
    geometries.append(brick.draw())
    way_planes.append(brick.get_pick_frame())
# ---------- end brick_wall ----------
compas_draw = COMPASDraw(cg=brick_wall.geometries)  # -> rg; disabled; same code as draw
compas_draw_2 = COMPASDraw(cg=brick_wall.way_planes)  # -> rg; disabled; same code as draw
py3_7 = Python3Script(x=brick_wall.way_planes)  # -> out, a; inputs x: list; disabled
# ---------- py3_7: Python ----------
from compas_rhino.conversions import frame_to_rhino_plane

a = [frame_to_rhino_plane(f) for f in x]
# ---------- end py3_7 ----------

# ----
pln_5 = Plane([PlaneXY(22.995, 0, 0), PlaneXY(50.985, 0, 0), PlaneXY(78.975, 0, 0), Plane(origin=(-11.4975, 19.91425416, 0), x=(-0.5, 0.8660254038, 0), y=(-0.8660254038, -0.5, 0)), Plane(origin=(-25.4925, 44.15430521, 0), x=(-0.5, 0.8660254038, 0), y=(-0.8660254038, -0.5, 0)), Plane(origin=(-39.4875, 68.39435626, 0), x=(-0.5, 0.8660254038, 0), y=(-0.8660254038, -0.5, 0))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])
flippln = FlipPlane(Plane=pln_5, FlipX=False, FlipY=False, FlipZ=True)  # -> Flipped, R

py3_8 = Python3Script(planes=flippln.Flipped)  # -> out, way_planes; inputs planes: Plane
# ---------- py3_8: Python ----------
# r: compas
# venv: mas-2526

from compas_rhino.devtools import DevTools
DevTools.enable_reloader()

from compas.geometry import Box, Point, Frame
from compas_rhino.conversions import plane_to_compas

frames = []
way_planes = []

for pl in planes:
    print(type(pl))
    fr = Frame(pl, pl.x, pl.y)
#     way_planes.append(plane_to_compas(pl))

# way_planes.append(plane_to_compas(planes))
# ---------- end py3_8 ----------

crv_2_2 = Curve(flatten([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]))
crv_1 = Curve([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])
py3_9 = Python3Script(curves=crv_2_2, x=Slider(100, range=0..100), y=Slider(95, range=0..100))  # -> out, points, primitive_bricks, way_frame, polar_bricks, moved_bricks; inputs curves: list of Curve, x: Double, y: Double
# ---------- py3_9: Python ----------
# r: compas
# venv: mas-2526
from compas_rhino.devtools import DevTools
DevTools.ensure_path()

import math
from compas.geometry import Box, Point, Frame, Vector, cross_vectors, Rotation, Translation
from compas_rhino.conversions import curve_to_compas
from brick_wall_2 import Brick

crvs = []
points = []
bricks = []

# convert curves to compas
for c in curves:
    crvs.append(curve_to_compas(c))

# build param list for curves
def param_list(curve, num_div):
    params = curve.divide_by_count(num_div)
    return params

def get_h_brick(curve, param):  # horizontal bricks
    pt = curve.point_at(param)
    points.append(pt)
    tan = crv.tangent_at(param)
    nor = tan.cross(Vector(0, 0, 1))
    frame = Frame(pt, tan, nor)
    b = Brick(frame)
    return b


def get_v_brick(curve, param):  # vertical bricks
    pt = curve.point_at(param)
    points.append(pt)
    tan = crv.tangent_at(param)
    nor = tan.cross(Vector(0, 0, 1))
    frame = Frame(pt, nor, tan)
    b = Brick(frame)
    return b


# === Polar Array_basic parameter setting ===
center = Point(0, 0, 0)
axis = Vector(0, 0, 1)
angle = math.radians(360 / 3)  # rotatie 120° every time
polar_bricks = []

# === lay bricks layer by layer（polar array first）===
for i_c, crv in enumerate(crvs):
    layer_bricks = []  # temporary save the primitive bricks

    params = param_list(crv, 6)
    if i_c % 2 == 0:  # even row
        for i_p, param in enumerate(params):
            if i_p % 7 == 1 or i_p % 7 == 5:  # horizontal bricks
                b = get_h_brick(crv, param)
                layer_bricks.append(b)
            if i_p % 7 == 3:  # vertical bricks
                b = get_v_brick(crv, param)
                layer_bricks.append(b)

    if i_c % 2 == 1:  # odd row
        for i_p, param in enumerate(params):
            if i_p % 7 == 2 or i_p % 7 == 6:  # horizontal bricks
                b = get_h_brick(crv, param-4)
                layer_bricks.append(b)
            if i_p % 7 == 4:  # vertical bricks
                b = get_v_brick(crv, param-5)
                layer_bricks.append(b)

    # === polar array ===
    for i in range(3):  # 3 groups (0°,120°,240°)
        R = Rotation.from_axis_and_angle(axis, angle * i, point=center)
        for b in layer_bricks:
            fr = b.frame
            r_fr = fr.transformed(R)
            bb = Brick(r_fr)
            polar_bricks.append(bb.draw())
        
# === move the whole structure ===
# moving vector setting
move_vec = Vector(x, y, 0)
T = Translation.from_vector(move_vec)

moved_bricks = []
for b in polar_bricks:
    fr = b.frame
    m_fr = fr.transformed(T)
    moved_bricks.append(Brick(m_fr).draw())

# === Flip frames  ===
way_frame = []
for b in moved_bricks:
    fr = b.frame
    if fr.zaxis.z > 0:
        fr.flip()
    way_frame.append(fr)

print("Total bricks after layered polar array:", len(moved_bricks))
# ---------- end py3_9 ----------
draw_18 = COMPASDraw(cg=py3_9.points)  # -> rg; same code as draw
draw_19 = COMPASDraw(cg=py3_9.way_frame)  # -> rg; same code as draw
draw_20 = COMPASDraw(cg=py3_9.polar_bricks)  # -> rg; same code as draw
draw_21 = COMPASDraw(cg=py3_9.moved_bricks)  # -> rg; same code as draw
item_11 = ListItem(List=draw_19, Index=0, Wrap=True)  # -> Item, Item1, Item2
pl_7 = ConstructPlane(Origin=item_11.Item, XAxis=item_11.Item1, YAxis=item_11.Item2)
item_12 = ListItem(List=flatten(pl_7), Index=Slider(0, range=0..100), Wrap=True)
preview_8 = CustomPreview(Geometry=draw_20, Material=ColourSwatch(SwatchColor=RGB(186, 98, 39)))
preview_9 = CustomPreview(Geometry=draw_21, Material=ColourSwatch(SwatchColor=RGB(186, 98, 39)))

draw_22 = COMPASDraw(cg=py3_8.way_planes)  # -> rg; same code as draw
panel_2 = Panel(py3_8.way_planes)
item_13 = ListItem(List=draw_22, Index=0, Wrap=True)  # -> Item, Item1, Item2
panel_3 = Panel("327.75")
panel_4 = Panel("-47.33")
panel_5 = Panel("-5.55")
panel_6 = Panel("584.15")
panel_10 = Panel("433.50")
item_14 = ListItem(List=draw_13, Index=Slider(12, range=0..20), Wrap=True)
pl_8 = ConstructPlane(Origin=item_13.Item, XAxis=item_13.Item1, YAxis=item_13.Item2)
number_slider_19 = Slider(3.5, range=0..100)
number_slider_20 = Slider(15, range=0..100)
draw_23 = COMPASDraw(cg=py3_9.primitive_bricks)  # -> rg; same code as draw

crv_2_3 = Curve(flatten([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]))
crv_1_2 = Curve([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])
py3_10 = Python3Script(curves=crv_2_3, x=Slider(100, range=0..100), y=Slider(95, range=0..100))  # -> out, points, primitive_bricks, way_frame, polar_bricks, moved_bricks; inputs curves: list of Curve, x: Double, y: Double
# ---------- py3_10: Python ----------
# r: compas
# venv: mas-2526
from compas_rhino.devtools import DevTools
DevTools.ensure_path()

import math
from compas.geometry import Box, Point, Frame, Vector, cross_vectors, Rotation, Translation
from compas_rhino.conversions import curve_to_compas
from brick_wall_2 import Brick

crvs = []
points = []
bricks = []

# convert curves to compas
for c in curves:
    crvs.append(curve_to_compas(c))

# build param list for curves
def param_list(curve, num_div):
    params = curve.divide_by_count(num_div)
    return params

def get_h_brick(curve, param):  # horizontal bricks
    pt = curve.point_at(param)
    points.append(pt)
    tan = crv.tangent_at(param)
    nor = tan.cross(Vector(0, 0, 1))
    frame = Frame(pt, tan, nor)
    b = Brick(frame)
    return b


def get_v_brick(curve, param):  # vertical bricks
    pt = curve.point_at(param)
    points.append(pt)
    tan = crv.tangent_at(param)
    nor = tan.cross(Vector(0, 0, 1))
    frame = Frame(pt, nor, tan)
    b = Brick(frame)
    return b


# === Polar Array_basic parameter setting ===
center = Point(0, 0, 0)
axis = Vector(0, 0, 1)
angle = math.radians(360 / 3)  # rotatie 120° every time
polar_bricks = []

# === lay bricks layer by layer（polar array first）===
for i_c, crv in enumerate(crvs):
    layer_bricks = []  # temporary save the primitive bricks

    params = param_list(crv, 6)
    if i_c % 2 == 0:  # even row
        for i_p, param in enumerate(params):
            if i_p % 7 == 1 or i_p % 7 == 5:  # horizontal bricks
                b = get_h_brick(crv, param)
                layer_bricks.append(b)
            if i_p % 7 == 3:  # vertical bricks
                b = get_v_brick(crv, param)
                layer_bricks.append(b)

    if i_c % 2 == 1:  # odd row
        for i_p, param in enumerate(params):
            if i_p % 7 == 1 or i_p % 7 == 5:  # horizontal bricks
                b = get_v_brick(crv, param-4)
                layer_bricks.append(b)
            if i_p % 7 == 3:  # vertical bricks
                b = get_h_brick(crv, param-5)
                layer_bricks.append(b)

    # === polar array ===
    for i in range(3):  # 3 groups (0°,120°,240°)
        R = Rotation.from_axis_and_angle(axis, angle * i, point=center)
        for b in layer_bricks:
            fr = b.frame
            r_fr = fr.transformed(R)
            bb = Brick(r_fr)
            polar_bricks.append(bb.draw())
        
# === move the whole structure ===
# moving vector setting
move_vec = Vector(x, y, 0)
T = Translation.from_vector(move_vec)

moved_bricks = []
for b in polar_bricks:
    fr = b.frame
    m_fr = fr.transformed(T)
    moved_bricks.append(Brick(m_fr).draw())

# === Flip frames  ===
way_frame = []
for b in moved_bricks:
    fr = b.frame
    if fr.zaxis.z > 0:
        fr.flip()
    way_frame.append(fr)

print("Total bricks after layered polar array:", len(moved_bricks))
# ---------- end py3_10 ----------
draw_24 = COMPASDraw(cg=py3_10.points)  # -> rg; same code as draw
draw_25 = COMPASDraw(cg=py3_10.way_frame)  # -> rg; same code as draw
draw_26 = COMPASDraw(cg=py3_10.polar_bricks)  # -> rg; same code as draw
draw_27 = COMPASDraw(cg=py3_10.moved_bricks)  # -> rg; same code as draw
item_15 = ListItem(List=draw_25, Index=0, Wrap=True)  # -> Item, Item1, Item2
pl_9 = ConstructPlane(Origin=item_15.Item, XAxis=item_15.Item1, YAxis=item_15.Item2)
item_16 = ListItem(List=flatten(pl_9), Index=Slider(0, range=0..100), Wrap=True)
preview_10 = CustomPreview(Geometry=draw_26, Material=ColourSwatch(SwatchColor=RGB(186, 98, 39)))
preview_11 = CustomPreview(Geometry=draw_27, Material=ColourSwatch(SwatchColor=RGB(186, 98, 39)))

draw_28 = COMPASDraw(cg=py3_10.primitive_bricks)  # -> rg; same code as draw

# ---- group: Convert Planes to URScript / TCP
pt = ConstructPoint(XCoordinate="-2.22", YCoordinate="1.36", ZCoordinate="83.85")

# ---- group: Sim
create_tool = CreateTool(Name="Brick_Gripper", TCP=pt, Weight=Slider(0.5, range=0..10))  # -> Tool, TCP

# ----
crv_4 = Curve(flatten([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]))
crv_2_4 = Curve(flatten([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]))
crv_3 = Curve(flatten([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]))
crv_4_2 = Curve(flatten([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]))
crv_1_3 = Curve([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])
py3_11 = Python3Script(curves=crv_4_2, x=Slider(100, range=0..100), y=Slider(95, range=0..100))  # -> out, points, primitive_bricks, way_frame, polar_bricks, moved_bricks; inputs curves: list of Curve, x: Double, y: Double
# ---------- py3_11: Python ----------
# r: compas
# venv: mas-2526
from compas_rhino.devtools import DevTools
DevTools.ensure_path()

import math
from compas.geometry import Box, Point, Frame, Vector, cross_vectors, Rotation, Translation
from compas_rhino.conversions import curve_to_compas
from brick_wall_2 import Brick

crvs = []
points = []
bricks = []

# convert curves to compas
for c in curves:
    crvs.append(curve_to_compas(c))

# build param list for curves
def param_list(curve, num_div):
    params = curve.divide_by_count(num_div)
    return params

def get_h_brick(curve, param):  # horizontal bricks
    pt = curve.point_at(param)
    points.append(pt)
    tan = crv.tangent_at(param)
    nor = tan.cross(Vector(0, 0, 1))
    frame = Frame(pt, tan, nor)
    b = Brick(frame)
    return b


def get_v_brick(curve, param):  # vertical bricks
    pt = curve.point_at(param)
    points.append(pt)
    tan = crv.tangent_at(param)
    nor = tan.cross(Vector(0, 0, 1))
    frame = Frame(pt, nor, tan)
    b = Brick(frame)
    return b


# === Polar Array_basic parameter setting ===
center = Point(0, 0, 0)
axis = Vector(0, 0, 1)
angle = math.radians(360 / 3)  # rotatie 120° every time
polar_bricks = []

# === lay bricks layer by layer（polar array first）===
for i_c, crv in enumerate(crvs):
    layer_bricks = []  # temporary save the primitive bricks

    params = param_list(crv, 6)
    if i_c % 2 == 0:  # even row
        for i_p, param in enumerate(params):
            if i_p % 7 == 1 or i_p % 7 == 5:  # horizontal bricks
                b = get_h_brick(crv, param)
                layer_bricks.append(b)
            if i_p % 7 == 3:  # vertical bricks
                b = get_v_brick(crv, param)
                layer_bricks.append(b)

    if i_c % 2 == 1:  # odd row
        for i_p, param in enumerate(params):
            if i_p % 7 == 2 or i_p % 7 == 6:  # horizontal bricks
                b = get_h_brick(crv, param-6)
                layer_bricks.append(b)
            if i_p % 7 == 4:  # vertical bricks
                b = get_v_brick(crv, param-7)
                layer_bricks.append(b)

    # === polar array ===
    for i in range(3):  # 3 groups (0°,120°,240°)
        R = Rotation.from_axis_and_angle(axis, angle * i, point=center)
        for b in layer_bricks:
            fr = b.frame
            r_fr = fr.transformed(R)
            bb = Brick(r_fr)
            polar_bricks.append(bb.draw())
        
# === move the whole structure ===
# moving vector setting
move_vec = Vector(x, y, 0)
T = Translation.from_vector(move_vec)

moved_bricks = []
for b in polar_bricks:
    fr = b.frame
    m_fr = fr.transformed(T)
    moved_bricks.append(Brick(m_fr).draw())

# === Flip frames  ===
way_frame = []
for b in moved_bricks:
    fr = b.frame
    if fr.zaxis.z > 0:
        fr.flip()
    way_frame.append(fr)

print("Total bricks after layered polar array:", len(moved_bricks))
# ---------- end py3_11 ----------
draw_29 = COMPASDraw(cg=py3_11.primitive_bricks)  # -> rg; same code as draw
draw_30 = COMPASDraw(cg=py3_11.points)  # -> rg; same code as draw
draw_31 = COMPASDraw(cg=py3_11.polar_bricks)  # -> rg; same code as draw
draw_32 = COMPASDraw(cg=py3_11.way_frame)  # -> rg; same code as draw
draw_33 = COMPASDraw(cg=py3_11.moved_bricks)  # -> rg; same code as draw
item_17 = ListItem(List=draw_32, Index=0, Wrap=True)  # -> Item, Item1, Item2
pl_10 = ConstructPlane(Origin=item_17.Item, XAxis=item_17.Item1, YAxis=item_17.Item2)
item_18 = ListItem(List=flatten(pl_10), Index=Slider(0, range=0..100), Wrap=True)
preview_12 = CustomPreview(Geometry=draw_31, Material=ColourSwatch(SwatchColor=RGB(186, 98, 39)))
preview_13 = CustomPreview(Geometry=draw_33, Material=ColourSwatch(SwatchColor=RGB(186, 98, 39)))

number_slider_21 = Slider(2, range=0..10)  # disabled
pline = PolyLine(Closed=False)
number_slider_22 = Slider(0, range=0..100)

crv_5 = Curve(flatten([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]))
crv_2_5 = Curve(flatten([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]))
crv_3_2 = Curve(flatten([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]))
crv_4_3 = Curve(flatten([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]))
crv_1_4 = Curve([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])
py3_12 = Python3Script(curves=crv_5, x=Slider(100, range=0..100), y=Slider(95, range=0..100))  # -> out, points, primitive_bricks, way_frame, polar_bricks, moved_bricks; inputs curves: list of Curve, x: Double, y: Double
# ---------- py3_12: Python ----------
# r: compas
# venv: mas-2526
from compas_rhino.devtools import DevTools
DevTools.ensure_path()

import math
from compas.geometry import Box, Point, Frame, Vector, cross_vectors, Rotation, Translation
from compas_rhino.conversions import curve_to_compas
from brick_wall_2 import Brick

crvs = []
points = []
bricks = []

# convert curves to compas
for c in curves:
    crvs.append(curve_to_compas(c))

# build param list for curves
def param_list(curve, num_div):
    params = curve.divide_by_count(num_div)
    return params

def get_h_brick(curve, param):  # horizontal bricks
    pt = curve.point_at(param)
    points.append(pt)
    tan = crv.tangent_at(param)
    nor = tan.cross(Vector(0, 0, 1))
    frame = Frame(pt, tan, nor)
    b = Brick(frame)
    return b


def get_v_brick(curve, param):  # vertical bricks
    pt = curve.point_at(param)
    points.append(pt)
    tan = crv.tangent_at(param)
    nor = tan.cross(Vector(0, 0, 1))
    frame = Frame(pt, nor, tan)
    b = Brick(frame)
    return b


# === Polar Array_basic parameter setting ===
center = Point(0, 0, 0)
axis = Vector(0, 0, 1)
angle = math.radians(360 / 3)  # rotatie 120° every time
polar_bricks = []

# === lay bricks layer by layer（polar array first）===
for i_c, crv in enumerate(crvs):
    layer_bricks = []  # temporary save the primitive bricks

    params = param_list(crv, 6)
    if i_c % 2 == 0:  # even row
        for i_p, param in enumerate(params):
            if i_p % 7 == 1 or i_p % 7 == 5:  # horizontal bricks
                b = get_h_brick(crv, param)
                layer_bricks.append(b)
            if i_p % 7 == 3:  # vertical bricks
                b = get_v_brick(crv, param)
                layer_bricks.append(b)

    if i_c % 2 == 1:  # odd row
        for i_p, param in enumerate(params):
            if i_p % 7 == 2 or i_p % 7 == 6:  # horizontal bricks
                b = get_v_brick(crv, param-14)
                layer_bricks.append(b)
            if i_p % 7 == 4:  # vertical bricks
                b = get_h_brick(crv, param-14)
                layer_bricks.append(b)

    # === polar array ===
    for i in range(3):  # 3 groups (0°,120°,240°)
        R = Rotation.from_axis_and_angle(axis, angle * i, point=center)
        for b in layer_bricks:
            fr = b.frame
            r_fr = fr.transformed(R)
            bb = Brick(r_fr)
            polar_bricks.append(bb.draw())
        
# === move the whole structure ===
# moving vector setting
move_vec = Vector(x, y, 0)
T = Translation.from_vector(move_vec)

moved_bricks = []
for b in polar_bricks:
    fr = b.frame
    m_fr = fr.transformed(T)
    moved_bricks.append(Brick(m_fr).draw())

# === Flip frames  ===
way_frame = []
for b in moved_bricks:
    fr = b.frame
    if fr.zaxis.z > 0:
        fr.flip()
    way_frame.append(fr)

print("Total bricks after layered polar array:", len(moved_bricks))
# ---------- end py3_12 ----------
draw_34 = COMPASDraw(cg=py3_12.primitive_bricks)  # -> rg; same code as draw
draw_35 = COMPASDraw(cg=py3_12.points)  # -> rg; same code as draw
draw_36 = COMPASDraw(cg=py3_12.polar_bricks)  # -> rg; same code as draw
draw_37 = COMPASDraw(cg=py3_12.way_frame)  # -> rg; same code as draw
draw_38 = COMPASDraw(cg=py3_12.moved_bricks)  # -> rg; same code as draw
item_19 = ListItem(List=draw_37, Index=0, Wrap=True)  # -> Item, Item1, Item2
pl_11 = ConstructPlane(Origin=item_19.Item, XAxis=item_19.Item1, YAxis=item_19.Item2)
item_20 = ListItem(List=flatten(pl_11), Index=Slider(0, range=0..100), Wrap=True)
preview_14 = CustomPreview(Geometry=draw_36, Material=ColourSwatch(SwatchColor=RGB(186, 98, 39)))
preview_15 = CustomPreview(Geometry=draw_38, Material=ColourSwatch(SwatchColor=RGB(186, 98, 39)))

# ---- group: Transform from Rhino to Robot Space
pt_2 = ConstructPoint(XCoordinate="472.50", YCoordinate="484.95", ZCoordinate="-23.40")
pt_3 = ConstructPoint(XCoordinate="290.50", YCoordinate="214.95", ZCoordinate="-23.40")
pt_4 = ConstructPoint(XCoordinate="290.50", YCoordinate="441.75", ZCoordinate="-23.40")
rec_3pt = Rectangle3Pt(PointA=pt_4, PointB=pt_3, PointC=pt_2)  # -> Rectangle, Length
compas = Python3Script(
    way_planes=py3_12.way_frame,
    wobj_origin=pt_4,
    wobj_xaxis=pt_3,
    wobj_xypoint=pt_2,
    z_safe_margin=Slider(10.5, range=0..100))  # -> out, transformed_planes; inputs way_planes: list, wobj_origin: Point3d, wobj_xaxis: Point3d, wobj_xypoint: Point3d, z_safe_margin: Double
# ---------- compas: Python ----------
import compas.geometry as cg

#in this step we transform our way planes to robot space
#the rhino co-ordinate system is rather abstract in the physical world
#the robot base plane assumed the base frame of robot is the origin
#but rhino does not know that
#thus we transform things from our design space(Rhino World XY) to Robot Base Plane that we measure

def set_robot_base(origin, xaxis, xypoint):
    """
    set a base plane representing the robot working object plane
    """
    robot_base = cg.Frame(origin, xaxis - origin, xypoint - origin)
    print (robot_base)
    return (robot_base)

def rhino_to_robot_space(rhino_plane,robot_base_plane):
    """
    Transform the objects from Rhino world XY plane to robot work object plane
    """
    T_matrix = cg.Transformation.from_frame_to_frame(cg.Frame.worldXY(), robot_base_plane)
    robot_plane = rhino_plane.transformed(T_matrix)
    return robot_plane

def set_z_safe_margin(planes_to_adjust, safety_margin):
    adjusted = []
    T = cg.Translation.from_vector(cg.Vector(0, 0, safety_margin))
    for f in planes_to_adjust:
        adjusted.append(f.transformed(T))
    return adjusted

# ===== Robot base is set =====
robot_base =  set_robot_base(wobj_origin, wobj_xaxis, wobj_xypoint)
print(robot_base)

# ===== Set safety margin for Z height ======
safe_planes = set_z_safe_margin(way_planes, z_safe_margin)

# ===== Transforming the rhino planes into robot planes =====
transformed_planes = []
for plane in safe_planes: 
    transformed_planes.append(rhino_to_robot_space(plane, robot_base))
# ---------- end compas ----------
compas_draw_3 = COMPASDraw(cg=compas.transformed_planes)  # -> rg; same code as draw
item_21 = ListItem(List=compas_draw_3, Index=0, Wrap=True)  # -> flatten(Item)
item_22 = ListItem(List=item_21, Index=Slider(25, range=0..100), Wrap=True)
points = PointList(Points=item_21, Size=Slider(4, range=0..10))

# ---- group: Convert Planes to URScript
pt_5 = ConstructPoint(XCoordinate="11.40", YCoordinate="444.62", ZCoordinate="3.12")
pt_6 = ConstructPoint(XCoordinate="-18.04", YCoordinate="442.29", ZCoordinate="36.95")
pt_7 = ConstructPoint(XCoordinate="10.31", YCoordinate="452.95", ZCoordinate="5.85")
number_slider_23 = Slider(2, range=0..3)
number_slider_24 = Slider(2, range=0..3)
number_slider_25 = Slider(0.5, range=0..3)
number_slider_26 = Slider(0.5, range=0..3)
py3_13 = Python3Script(origin=pt_5, xaxis_pt=pt_6, xy_pt=pt_7)  # -> out, pick_frame; inputs origin: Point3d, xaxis_pt: Point3d, xy_pt: Point3d
# ---------- py3_13: Python ----------
from compas.geometry import Frame, Point
from compas.geometry import Rotation

from compas_rhino.conversions import point_to_compas
import math

origin = point_to_compas(origin)
xaxis_pt = point_to_compas(xaxis_pt)
xy_pt = point_to_compas(xy_pt)

#define pick frame
angle = math.radians(90)
pick_frame = Frame(origin, xaxis_pt - origin, xy_pt - origin)
pick_frame.rotate(angle, axis=pick_frame.normal, point=pick_frame.point)
# ---------- end py3_13 ----------
py3_14 = Python3Script(
    origin=pt_5,
    xaxis_pt=pt_6,
    xy_pt=pt_7,
    x=Slider(0.2, range=0..1),
    y=Slider(0.2, range=0..1),
    z=Slider(0.2, range=0..1),
    Flip=Toggle(False))  # -> out, pick_frame; inputs origin: Point3d, xaxis_pt: Point3d, xy_pt: Point3d, x: Double, y: Double, z: Double, Flip: Boolean
# ---------- py3_14: Python ----------
from compas.geometry import Frame, Point, Transformation, Vector, Translation
from compas.geometry import Rotation
import math as m

from compas_rhino.conversions import point_to_compas

origin = point_to_compas(origin)
xaxis_pt = point_to_compas(xaxis_pt)
xy_pt = point_to_compas(xy_pt)

#define pick frame
pick_frame = Frame(origin, xaxis_pt - origin, xy_pt - origin)

Vector_1 = pick_frame.xaxis
Vector_2 = pick_frame.yaxis
Vector_3 = pick_frame.normal

#pick_frame adjustments
T_1 = Translation.from_vector(Vector_1 * x)
T_2 = Translation.from_vector(Vector_2 * y)
T_3 = Translation.from_vector(Vector_3 * z)

R = Rotation.from_axis_and_angle(pick_frame.normal, m.radians(90), pick_frame.point)
R_Flip = Rotation.from_axis_and_angle(Vector_1, m.radians(180), pick_frame.point)

if Flip == True:
    pick_frame.transform(R_Flip)

pick_frame.transform(T_3 * T_2 * T_1 * R)

from compas_rhino import conversions
pick_frame_plane = conversions.frame_to_rhino(pick_frame)
# ---------- end py3_14 ----------
compas_draw_4 = COMPASDraw(cg=py3_14.pick_frame)  # -> rg; same code as draw
item_23 = ListItem(List=compas_draw_4, Index=0, Wrap=True)  # -> Item, Item1, Item2
compas_2 = Python3Script(
    way_frames=compas.transformed_planes,
    tcp_measured=pt,
    acceleration=number_slider_23,
    velocity=number_slider_24,
    pick_frame=py3_14.pick_frame)  # -> out, vis_frames, vis_planes, script; inputs way_frames: list, tcp_measured: Point3d, acceleration: Double, velocity: Double
# ---------- compas_2: Python ----------
from imp import reload
import sys
import os

#get current file path
path = ghenv.Component.OnPingDocument().FilePath
#get parent directory of the parent directory
parentdir = os.path.dirname(path)
#get src folder which contains classes
dire = os.path.join(parentdir,'src')

sys.path.append(dire)

import simple_ur_script as ur
reload(ur)

import utils 
reload(utils)

import simple_comm as com
reload(com)

import compas.geometry as cg
import math as m

# ===== Set global constants =======

IO = 4 #Global constant
PICK_SAFE_DIST = 50
SAFE_DIST = 125 # 75
# SAFE_DIST = 50

# =================================

script = "" #create empty string

def pickup_brick(script,pick_up_frame):
    frames = []
    
    safe_pick_up_frame = pick_up_frame.translated(-pick_up_frame.normal*PICK_SAFE_DIST)
    
    ## add to the path: go to the safe plane
    script += ur.move_l(safe_pick_up_frame, acceleration, velocity)
    frames.append(safe_pick_up_frame)
    
    ## add to the path: go to the pick up plane
    script += ur.move_l(pick_up_frame, acceleration, velocity)
    frames.append(pick_up_frame)
    
    ## add to the path: turn on the vacuum and wait 1 sec.
    script += ur.set_digital_out(IO,True)
    script += ur.sleep(1)

    # add to the path: go back to the safe_plane
    script += ur.move_l(safe_pick_up_frame, acceleration, velocity)
    frames.append(safe_pick_up_frame)
    
    return script, frames


def place_brick(script, place_frame):
    
    frames = []
    
    safe_place_frame = place_frame.translated(cg.Vector(0,0,1)*SAFE_DIST)
    
    # add to the path: go to the safe plane
    script += ur.move_l(safe_place_frame, acceleration, velocity)
    frames.append(safe_place_frame)
    
    # add to the path: go to the place plane
    script += ur.move_l(place_frame, acceleration, velocity)
    frames.append(place_frame)
    
    ## add to the path: turn off the vacuum and wait 1 second (hold the brick)
    script += ur.set_digital_out(IO,False)
    script += ur.sleep(1)
    
    # add to the path: go back to the safe plane
    script += ur.move_l(safe_place_frame, acceleration, velocity)
    frames.append(safe_place_frame)
    
    return script,frames


#if value given for tcp measured, then add line to script, otherwise it will take current tcp from robot
if tcp_measured is not None:
    script += ur.set_tcp_by_angles(tcp_measured.X, tcp_measured.Y, tcp_measured.Z, m.radians(0.0),m.radians(0.0),m.radians(0))


vis_frames = []
#add move_l commands in sequence to script for each way plane
for brick_frame in way_frames:
    script, p = pickup_brick(script,pick_frame)
    vis_frames.extend(p) #only to visualize the planes
    script, p = place_brick(script,brick_frame)
    vis_frames.extend(p)


#format the script to make it sendable
script = com.concatenate_script(script)

from compas_rhino import conversions
import Rhino.Geometry as rg

vis_planes = [conversions.frame_to_rhino(frame) for frame in vis_frames]
# ---------- end compas_2 ----------
pl_12 = ConstructPlane(Origin=item_23.Item, XAxis=item_23.Item1, YAxis=item_23.Item2)
compas_draw_5 = COMPASDraw(cg=compas_2.vis_frames)  # -> rg; same code as draw
pline_2 = PolyLine(Vertices=compas_2.vis_planes, Closed=False)
points_2 = PointList(Points=compas_2.vis_planes, Size=Slider(4, range=0..10))

# ---- group: Sim / Approach
create_target = CreateTarget(Plane=compas_2.vis_planes, Tool=create_tool.Tool, IsCartesian=True)

# ---- group: Sim
robots_library = RobotsLibrary({"UR3e", "UR5e", "UR10e", "UR16e", "UR3", "UR5", "UR10", "UR20", "UR30"}, selected="UR10", Type=0)
load_robot_system = LoadRobotSystem(Name=robots_library, Base=PlaneXY(0, 0, 0))
number_slider_27 = Slider(0.343, range=0..1)
create_program = CreateProgram(Name="DefaultProgram", RobotSystem=load_robot_system, Targets=create_target, StepSize=1)  # -> Program, Code, Duration, Warnings, Errors
program_simulation = ProgramSimulation(Program=create_program.Program, Time=Slider(0.144, range=0..1), Normalized=True)  # -> SystemMeshes, JointRotations, Plane, Index, Time, Program, Errors
panel_12 = Panel(create_program.Warnings)
panel_13 = Panel(program_simulation.Errors)

# ----
geo = Geometry(program_simulation.Plane)
compas_3 = Python3Script(
    way_frames=compas.transformed_planes,
    tcp_measured=pt,
    acceleration=number_slider_23,
    velocity=number_slider_24,
    pick_frame=py3_14.pick_frame)  # -> out, vis_frames, vis_planes, script; inputs way_frames: list, tcp_measured: Point3d, acceleration: Double, velocity: Double; disabled
# ---------- compas_3: Python ----------
from imp import reload
import sys
import os

#get current file path
path = ghenv.Component.OnPingDocument().FilePath
#get parent directory of the parent directory
parentdir = os.path.dirname(path)
#get src folder which contains classes
dire = os.path.join(parentdir,'src')

sys.path.append(dire)

import simple_ur_script as ur
reload(ur)

import utils 
reload(utils)

import simple_comm as com
reload(com)

import compas.geometry as cg
import math as m
from compas.geometry import Frame

# ===== Set global constants =======

IO = 4 #Global constant
SAFE_DIST = 50
LIFT_DIST = 50

# =================================

script = "" #create empty string

def pickup_brick(script, pick_up_frame):
    frames = []
    
    # define safe pick plane
    safe_pick_up_frame = pick_up_frame.translated(-pick_up_frame.normal * SAFE_DIST)
    
    # define safe lift plane（lift after picking bricks）
    safe_lift_frame = Frame(
        [
        safe_pick_up_frame.point.x, 
        safe_pick_up_frame.point.y, 
        safe_pick_up_frame.point.z + LIFT_DIST],
        safe_pick_up_frame.xaxis,
        safe_pick_up_frame.yaxis
    )


    # === execution steps ===

    # 1️. go to safe pick up plane
    script += ur.move_l(safe_pick_up_frame, acceleration, velocity)
    frames.append(safe_pick_up_frame)

    # 2️. go down to pick up plane
    script += ur.move_l(pick_up_frame, acceleration, velocity)
    frames.append(pick_up_frame)

    # 3️. open suction cup
    script += ur.set_digital_out(IO, True)
    script += ur.sleep(1)

    # 4️. lift up to safe pick up plane
    script += ur.move_l(safe_pick_up_frame, acceleration, velocity)
    frames.append(safe_pick_up_frame)

    # 5️. lift up to safe lift plane
    script += ur.move_l(safe_lift_frame, acceleration, velocity)
    frames.append(safe_lift_frame)

    return script, frames

def place_brick(script, place_frame):
    
    frames = []
    
    safe_place_frame = place_frame.translated(cg.Vector(0,0,1)*SAFE_DIST)
    
    # add to the path: go to the safe plane
    script += ur.move_l(safe_place_frame, acceleration, velocity)
    frames.append(safe_place_frame)
    
    # add to the path: go to the place plane
    script += ur.move_l(place_frame, acceleration, velocity)
    frames.append(place_frame)
    
    ## add to the path: turn off the vacuum and wait 1 second (hold the brick)
    script += ur.set_digital_out(IO,False)
    script += ur.sleep(1)
    
    # add to the path: go back to the safe plane
    script += ur.move_l(safe_place_frame, acceleration, velocity)
    frames.append(safe_place_frame)
    
    return script,frames


#if value given for tcp measured, then add line to script, otherwise it will take current tcp from robot
if tcp_measured is not None:
    script += ur.set_tcp_by_angles(tcp_measured.X, tcp_measured.Y, tcp_measured.Z, m.radians(0.0),m.radians(0.0),m.radians(0))

vis_frames = []
# add move_l commands in sequence to script for each way plane
for brick_frame in way_frames:
    script, p = pickup_brick(script, pick_frame)
    vis_frames.extend(p)  # only to visualize the planes
    script, p = place_brick(script, brick_frame)
    vis_frames.extend(p)


#format the script to make it sendable
script = com.concatenate_script(script)

from compas_rhino import conversions
import Rhino.Geometry as rg

vis_planes = [conversions.frame_to_rhino(frame) for frame in vis_frames]
# ---------- end compas_3 ----------
compas_draw_6 = COMPASDraw(cg=compas_3.vis_frames)  # -> rg; disabled; same code as draw
item_24 = ListItem(List=compas_draw_6, Index=0, Wrap=True)  # -> flatten(Item); disabled
item_25 = ListItem(List=compas_draw_5, Index=0, Wrap=True)  # -> Item, Item1, Item2

# ---- group: Send to Robot!
panel_14 = Panel(compas_2.script)

# ----
pl_13 = ConstructPlane(Origin=item_25.Item, XAxis=item_25.Item1, YAxis=item_25.Item2)
points_3 = PointList(Points=item_24, Size=number_slider_21)  # disabled

# ---- group: Send to Robot! / Send UR script to Robot!
py3_15 = Python3Script(script=compas_2.script, ip_address="192.168.10.10", send=Button())  # -> out, a; inputs script: String, ip_address: String, send: Boolean
# ---------- py3_15: Python ----------
import simple_comm as com

if send:
    com.send_script(script,ip_address)
# ---------- end py3_15 ----------

# ----
pln_6 = Plane(flatten(pl_13))
item_26 = ListItem(List=pln_6, Index=Slider(13, range=0..20), Wrap=True)
