# Grasshopper definition 301_somebricks_are_bigger_than_others_m.ghx (Grasshopper 1.0.8)

construct_point = ConstructPoint(XCoordinate=Slider(0, range=-1000..1000), YCoordinate=Slider(0, range=-1000..1000), ZCoordinate=0)
circle = Circle(Plane=construct_point, Radius=Slider(250, range=0..1000))

# ---- group: Example file
number_slider = Slider(1000, range=200..1000)  # disabled
unit_x = UnitX(Factor=number_slider)  # disabled
number_slider_2 = Slider(12, range=0..30)  # disabled
number_slider_3 = Slider(100, range=0..100)  # disabled
move = Move(Geometry=circle, Motion=unit_x)  # -> Geometry, Transform; disabled
curve = Curve(move.Geometry)  # disabled
brick_wall = Python3Script(crv=curve, num_layers=number_slider_2, gap=number_slider_3)  # -> bricks, geometries, way_planes; inputs crv: Curve, num_layers: Int32, gap: Double; disabled
# ---------- brick_wall: Python ----------
# r: compas
# venv: mas-2526
from compas_rhino.devtools import DevTools
DevTools.ensure_path()

# 0. Import everything we will need
import math
from compas.geometry import Box
from compas.geometry import Point
from compas.geometry import Frame
from compas.geometry import cross_vectors
from compas.geometry import Vector
from compas_rhino.conversions import curve_to_compas

# ..also import our module "brick_wall.py", that needs to be in the same folder as our GH file
from brick_wall import BigBrick

# 1. Start with an empty list of bricks to be created
#    make sure to match the name of this list to the output of this component!
bricks = []

# 2. Create points on each curve
curve = curve_to_compas(crv)
print(curve.length())

# divide curve twice as fine
num_divs = int(curve.length() / (BigBrick.LENGTH+gap)) * 2
params, div_pts = curve.divide_by_count(num_divs, True)

for row in range(num_layers):
    for col, param in enumerate(params,):
        pt = curve.point_at(param)
        pt = pt.translated([0,0,BigBrick.HEIGHT * row])
        tangent = curve.tangent_at(param)
        normal = cross_vectors(tangent, [0,0,1])
        # only place bricks on alternating divisions depending on the row
        if row % 2 == 0:  
            # even rows 
            if col % 2 == 0:
                b = BigBrick(frame = Frame(pt, tangent, normal))
                bricks.append(b)
        else:  
            # odd rows 
            if col % 2 == 1:
                b = BigBrick(frame = Frame(pt, tangent, normal))
                bricks.append(b)

# Move all above Z = 0
for brick in bricks:
    brick.frame = brick.frame.translated(Vector(0,0,BigBrick.HEIGHT/2))

# Visualize and store brick data
geometries = []
way_planes = []

for brick in bricks:
    geometries.append(brick.draw())
    way_planes.append(brick.get_pick_frame())
# ---------- end brick_wall ----------
compas_draw = COMPASDraw(cg=brick_wall.way_planes)  # -> rg; disabled
#   port cg: The COMPAS geometry or datastructure to be drawn.
#   port rg: The Rhino geometry object.
# ---------- compas_draw: Python ----------
# r: compas>=2.14.1
"""
Draws COMPAS geometry in Grasshopper.
"""

from typing import Any

import Grasshopper

from compas.scene import SceneObject


class CompasToRhinoGeometry(Grasshopper.Kernel.GH_ScriptInstance):
    def RunScript(self, cg):
        if not cg:
            return None

        return SceneObject(item=cg).draw()
# ---------- end compas_draw ----------
drawframe = Python3Script(x=brick_wall.way_planes)  # -> a; inputs x: list; disabled
# ---------- drawframe: Python ----------
from compas_rhino.conversions import frame_to_rhino_plane

a = [frame_to_rhino_plane(f) for f in x]
# ---------- end drawframe ----------
compas_draw_2 = COMPASDraw(cg=brick_wall.geometries)  # -> rg; disabled; same code as compas_draw

# ---- group: Example file / This is needed only ONCE in the GH definition
enable_auto_reload = Python3Script()  # -> ok; disabled
# ---------- enable_auto_reload: Python ----------
"""
------------------------------
Using VS Code as Python editor
------------------------------

The simplest way to start using VS Code as our editor, is
to place our Python code in files located IN THE SAME FOLDER as our Grasshopper file.

After we have done that, we need 2 steps: 

1. Enable the COMPAS reloader on one component. This tells Grasshopper to watch for changes in the Pythoh files and reload if changed.
2. Every other component that uses Python code from external files needs to start with a method to ensure Grasshopper knows where to load the files from.

"""
# r: compas
# venv: mas-2526

from compas_rhino.devtools import DevTools
DevTools.enable_reloader()
# ---------- end enable_auto_reload ----------

# ---- group: Convex
# #### TO DO
# 
# 1) Make the curvature exponential
# 2) Resove brick intersection
# 3) Prepare small-scale prototype
script = Script(
    curve=circle,
    rotation=Slider(120, range=0..180),
    divisions=Slider(8, range=0..20),
    row_count=Slider(24, range=0..100),
    degree=Slider(9, range=0..100),
    gap=Slider(46, range=0..100))  # -> bricks, geometries, way_planes, row_crv_pts, row_curves; inputs curve: Curve, divisions: Int32, row_count: Int32, degree: Double, gap: Double
# ---------- script: Python ----------
# r:compas
# venv: mas-2526
from compas_rhino.devtools import DevTools
DevTools.ensure_path()

import math as m
from compas.geometry import Box, Point, Bezier, NurbsCurve, Line, Frame
from compas.geometry import Transformation, Vector, cross_vectors, Translation, Rotation
from compas_rhino.conversions import curve_to_compas, point_to_rhino, curve_to_rhino
from Rhino.Geometry import BoundingBox

from brick_wall import BigBrick

bricks = []

# #import curve
wall_crv = curve_to_compas(curve)

#rotate curve
R_crv = Rotation.from_axis_and_angle([0,0,1], m.radians(rotation))
wall_crv.transform(R_crv)

row_curves = []

for r in range (row_count):
    #create new row
    crv = wall_crv.translated([0,0,BigBrick.HEIGHT * r])
    #row division
    params = crv.divide_by_count(divisions)

    row_crv_pts = []
    #manipulate each row
    if r < int(row_count * 1/5) + 1:
        for i, param in enumerate(params):
            pt = crv.point_at(param)
            tangent = crv.tangent_at(param)
            normal = tangent.cross([0,0,1])
            T = Translation.from_vector(normal * (int(row_count * 1/5) - r) * degree)
            T_2 = Translation.from_vector(-normal * (int(row_count * 1/5) - r) * degree)

            if i == len(params) -1:
                pt_c = pt.copy()
                pt_c.transform(T_2)
                row_crv_pts.insert(0,pt_c)
                pt.transform(T_2)
                row_crv_pts.append(pt)
            
            elif i == 0 or i % 2 == 0:
                row_crv_pts.append(pt)

            elif (i + 3) % 4 == 0:
                pt.transform(T)
                row_crv_pts.append(pt)
            
            elif i % 2 != 0:
                pt.transform(T_2)
                row_crv_pts.append(pt)
    
    else:
        for i, param in enumerate(params):
            pt = crv.point_at(param)
            tangent = crv.tangent_at(param)
            normal = tangent.cross([0,0,1])
            T = Translation.from_vector(normal * (r - int(row_count * 1/5))  * degree)
            T_2 = Translation.from_vector(-normal * (r - int(row_count * 1/5)) * degree)

            if i == len(params) -1:
                pt_c = pt.copy()
                pt_c.transform(T)
                row_crv_pts.insert(0,pt_c)
                pt.transform(T)
                row_crv_pts.append(pt)
            
            elif i == 0 or i % 2 == 0:
                row_crv_pts.append(pt)

            elif (i + 3) % 4 == 0:
                pt.transform(T_2)
                row_crv_pts.append(pt)
            
            elif i % 2 != 0:
                pt.transform(T)
                row_crv_pts.append(pt)

    from Rhino.Geometry import Curve
    
    #conversion between rhino_crv to create period crv
    row_crv = curve_to_rhino(NurbsCurve.from_interpolation(row_crv_pts))
    row_crv = curve_to_compas (Curve.CreatePeriodicCurve(row_crv))
    row_curves.append(row_crv)

    num_divs = int(row_crv.length() / (BigBrick.LENGTH+gap)) * 2
    params = row_crv.divide_by_count(num_divs)

    for col, param in enumerate(params):
        pt = row_crv.point_at(param)
        tangent = row_crv.tangent_at(param)
        normal = cross_vectors(tangent, [0,0,1])
        # only place bricks on alternating divisions depending on the row
        if r % 2 == 0:
            # even rows 
            if col % 2 == 0:
                b = BigBrick(frame = Frame(pt, tangent, normal))
                bricks.append(b)
        else:  
            # odd rows 
            if col % 2 == 1:
                b = BigBrick(frame = Frame(pt, tangent, normal))
                bricks.append(b)

geometries = []
way_planes = []

for brick in bricks:
    geometries.append(brick.draw())
    way_planes.append(brick.get_pick_frame())
# ---------- end script ----------

# ----
compas_draw_3 = COMPASDraw(cg=script.geometries)  # -> rg; same code as compas_draw
compas_draw_4 = COMPASDraw(cg=script.row_curves)  # -> rg; same code as compas_draw

# ---- group: Pallet
unit_z = UnitZ(Factor=Slider(-125, range=-200..0))
construct_point_2 = ConstructPoint(
    XCoordinate=Slider(-600, range=-1000..1000),
    YCoordinate=Slider(-400, range=-1000..1000),
    ZCoordinate=Slider(-32.5, range=-200..0))
rectangle = Rectangle(Plane=construct_point_2, XSize=Slider(1200, range=0..10000), YSize=Slider(800, range=0..1000), Radius=0)  # -> Rectangle, Length
bounding_box = BoundingBox(Content=[rectangle.Rectangle, unit_z], Plane=PlaneXY(0, 0, 0), UnionBox=True)  # -> Box, Box_2
custom_preview = CustomPreview(Geometry=bounding_box.Box, Material=ColourSwatch(SwatchColor=RGB(191, 191, 191)))

# ---- group: Dimensions
bounding_box_2 = BoundingBox(Content=compas_draw_3, Plane=PlaneXY(0, 0, 0), UnionBox=True)  # -> Box, Box_2
deconstruct_brep = DeconstructBrep(Brep=bounding_box_2.Box)  # -> Faces, Edges, Vertices
list_item = ListItem(List=deconstruct_brep.Edges, Index=Slider(8, range=0..10), Wrap=True)  # -> Item4, Item3, Item2, Item1, Item
line_dimension = LineDimension(Line=[list_item.Item, list_item.Item4, list_item.Item1], Text="{0:0.00}", Size=Slider(30, range=0..100))

# ---- group: check for collision and brick count
shift_list = ShiftList(List=compas_draw_3, Shift=1, Wrap=True)
brep_brep = BrepBrep(BrepA=compas_draw_3, BrepB=shift_list)  # -> Curves, Points
python_3_script = Python3Script(intersections=flatten(brep_brep.Curves), y=compas_draw_3)  # -> Red, instance, too_many_bricks; inputs intersections: list of Curve, y: list
# ---------- python_3_script: Python ----------
import math
import Rhino.Geometry as rg

instances = []
for i in intersections:
    pt_e = i.PointAtEnd
    pt_m = i.PointAtMid
    pt_s = i.PointAtStart
    x = rg.BoundingBox([pt_e, pt_m, pt_s])
    x_box = rg.Box(x)
    v = x_box.Z

    if int(v.Length) > 0.0:
        instances.append("yes")
    else:
        pass

Red = 255
instance = 100
too_many_bricks = []

if len(instances) > 0:
    instance = 50

for i in range(len(y)):
    if i > 150:
        too_many_bricks.append(255)
    else:
        too_many_bricks.append(0)
# ---------- end python_3_script ----------
colour_rgb = ColourRGB(
    Alpha=Slider(175, range=0..1000),
    Red=python_3_script.Red,
    Green=python_3_script.instance,
    Blue=python_3_script.too_many_bricks)
custom_preview_2 = CustomPreview(Geometry=compas_draw_3, Material=colour_rgb)

# ---- group: Brick 'number'
volume = Volume(Geometry=compas_draw_3)  # -> Volume, Centroid
points = PointList(Points=volume.Centroid, Size=Slider(30, range=0..100))

# ---- group: Export .JSON
button = Button()
panel = Panel("w_pallet0")

python_3_script_2 = Python3Script(frames=script.way_planes, pallet_number=panel, save=button)  # inputs frames: list, pallet_number: String
# ---------- python_3_script_2: Python ----------
from compas.data import json_dump
import sys
import os

data = {}

data["wobj"] = pallet_number
data["frames"] = frames

#get current file path
path = ghenv.Component.OnPingDocument().FilePath
#get parent directory of the parent directory
parentdir = os.path.dirname(path)
#get src folder which contains classes
dire = os.path.join(parentdir,'data')


filepath = os.path.join(dire, "out_brickframes.json")

if save:
    json_dump(data, filepath)
# ---------- end python_3_script_2 ----------

# ----
panel_2 = Panel(script.way_planes)
