# Grasshopper definition 101_primitives_and_subdivisions_ex.ghx (Grasshopper 1.0.8)

py3 = Python3Script(radius=Slider(3.7, range=0..100), num_sides=Slider(10, range=0..10))  # -> out, new_mesh_rhino, points; inputs radius: Double, num_sides: Int32
# ---------- py3: Python ----------
import math
import Rhino.Geometry as rg
import mola
from mola import module_rhino

points = []

tetha = (2*math.pi)/num_sides

new_mesh = mola.Mesh()

for i in range(num_sides):
    angle = i * tetha
    x = radius * math.cos(angle)
    y = radius * math.sin(angle)
    z = 0
    pt = rg.Point3d(x,y,z)
    points.append(pt)
    new_mesh.add_vertex(x,y,z)


new_mesh.add_face([*new_mesh.vertices])
new_mesh.add_vertex(0,0,10)

for i in range(num_sides):
    v1 = new_mesh.vertices[i]
    v2 = new_mesh.vertices[(i+1)%num_sides] 

    cen = new_mesh.vertices[-1]
    new_mesh.add_face([v1,v2,cen])

new_mesh_rhino = module_rhino.display_mesh(new_mesh)
# ---------- end py3 ----------
geo = Geometry(py3.new_mesh_rhino)

curve = Curve(<curve referenced from the Rhino model>)
script = Script(polyline_curve=curve, num_sides=Slider(10, range=0..10), radius=Slider(32.7, range=0..100))  # -> pts_pol, pts, list_points; inputs polyline_curve: Polyline, num_sides: Int32
# ---------- script: Python ----------
import mola
from mola import module_rhino
import Rhino.Geometry as rg
import math as m

def points_on_curve (curve):
    list_of_points = []
    for p in curve:
        pt = rg.Point3d(p)
        list_of_points.append(pt)

    return list_of_points

def points_on_polygon (num_sides, radius):
    list_of_points = []
    theta = m.pi * 2 / num_sides
    for i in range (num_sides):
        angle = i * theta
        x = radius * m.cos(angle)
        y = radius * m.sin(angle)
        z = 0
        pt = rg.Point3d(x,y,z)
        list_of_points.append(pt)
    return list_of_points

pts_pol = points_on_polygon(num_sides, radius)
print (pts_pol)

pts = points_on_curve(polyline_curve)
print (pts)

if polyline_curve is not None:
    list_points = points_on_curve(polyline_curve)

else:
    list_points = points_on_polygon(num_sides, radius)
# ---------- end script ----------
# mesh from scratch
py3_2 = Python3Script(mola_path="/Users/minghip/Documents/Github")  # -> out, a; inputs mola_path: String
# ---------- py3_2: Python ----------
import sys

if mola_path not in sys.path:
    sys.path.append(mola_path)

print(sys.path)

try:
    import mola
    from mola import module_rhino
except ImportError as e:
    print("Error importing mola: {e}")
# ---------- end py3_2 ----------

number_slider = Slider(6, range=0..10)
number_slider_2 = Slider(-10, range=-10..10)
# primitives
py3_3 = Python3Script(x=number_slider, y=number_slider, z=number_slider, x1=number_slider_2, y1=number_slider_2, z1=number_slider_2)  # -> out, my_mesh, my_mesh_rhino
# ---------- py3_3: Python ----------
import mola
from mola import module_rhino


my_mesh = mola.construct_box(x,y,z,x1,y1,z1)

my_mesh_rhino = module_rhino.display_mesh(my_mesh)
# ---------- end py3_3 ----------
# subdivision
py3_4 = Python3Script(mesh=py3_3.my_mesh, r=Slider(3, range=0..10))  # -> out, new_mesh, my_mesh_rhino; inputs r: Int32
# ---------- py3_4: Python ----------
import mola
from mola import module_rhino



for i in range(r):
    new_mesh = mola.Mesh()
    for f in mesh.faces:
        resulting_face = mola.subdivide_face_extrude_to_point_center(f, -3)
        new_mesh.faces.extend(resulting_face)
    mesh = new_mesh

new_mesh.update_topology()

my_mesh_rhino = module_rhino.display_mesh(new_mesh)
# ---------- end py3_4 ----------
py3_5 = Python3Script(mesh=py3_4.new_mesh)  # -> out, new_mesh, my_mesh_rhino
# ---------- py3_5: Python ----------
import mola
from mola import module_rhino



new_mesh = mesh

for i in range(1):
    new_mesh = mola.subdivide_mesh_catmull(new_mesh)

mola.color_faces_by_area(new_mesh.faces)

my_mesh_rhino = module_rhino.display_mesh(new_mesh)
# ---------- end py3_5 ----------

py3_6 = Python3Script(r=Slider(5, range=0..10))  # -> out, new_mesh, my_mesh_rhino; inputs r: Int32
# ---------- py3_6: Python ----------
import mola
from mola import module_rhino
import rhinoscriptsyntax as rs


guid = rs.GetObject()

new_mesh = module_rhino.mesh_from_rhino_mesh(guid)

print(new_mesh)
# ---------- end py3_6 ----------
py3_7 = Python3Script(r=Slider(5, range=0..10))  # -> out, new_mesh, my_mesh_rhino; inputs r: Int32
# ---------- py3_7: Python ----------
import mola
from mola import module_rhino

my_mesh = mola.construct_sphere(r,3,3)

for v in my_mesh.vertices:
    if v.z>0:
        v.z *= 1.5

my_mesh = mola.subdivide_mesh_catmull(my_mesh)

my_properties = my_mesh.face_properties(mola.face_center_z)


mola.color_faces_by_vertical_angle(my_mesh.faces)

heights = mola.math_map_list(my_properties, 0.0, 2.0)

new_mesh = mola.Mesh()
for i, f in enumerate(my_mesh.faces):
    if heights[i] > 0.5:
        doCap = False
    else: 
        doCap = True
    resulting_faces = mola.subdivide_face_extrude_tapered(f, heights[i], 0.6, doCap)
    new_mesh.faces.extend(resulting_faces)

new_mesh.update_topology()
new_mesh = mola.mesh_offset(new_mesh,0.2)

for i in range(1):
    new_mesh = mola.subdivide_mesh_catmull(new_mesh)

props = new_mesh.face_properties(mola.face_center_z)
color_scheme = [(0,0,1),(1,0,1), (0.5,0.5,0.5), (1,1,1)]
colors = mola.color_map(props , color_scheme)
mola.color_faces_by_map(new_mesh.faces,colors)


new_mesh.update_topology()
my_mesh_rhino = module_rhino.display_mesh(new_mesh)
# ---------- end py3_7 ----------
py3_8 = Python3Script(r=Slider(5, range=0..10))  # -> out, new_mesh, my_mesh_rhino; inputs r: Int32; same code as py3_6
geo_2 = Geometry(py3_6.my_mesh_rhino)
geo_3 = Geometry(py3_7.my_mesh_rhino)
geo_4 = Geometry(py3_8.my_mesh_rhino)
