# Grasshopper definition 102_two_sticks.gh (Grasshopper 1.0.8)

line_0 = Curve(<curve referenced from the Rhino model>)
line_1 = Curve(<curve referenced from the Rhino model>)
line_0_2 = Curve(<curve referenced from the Rhino model>)
line_1_2 = Curve(<curve referenced from the Rhino model>)
line_0_3 = Curve(<curve referenced from the Rhino model>)
line_1_3 = Curve(<curve referenced from the Rhino model>)
py3 = Python3Script(line_0=line_0, line_1=line_1)  # -> out, stick_box, sticks; inputs line_0: Line, line_1: Line
# ---------- py3: Python ----------
#locate stick class file in the same folder
from compas_rhino import unload_modules
import sys
import os

#get current file path
path = ghenv.Component.OnPingDocument().FilePath
#get parent directory of the parent directory
parentdir = os.path.dirname(path)
#get src folder which contains classes
dire = os.path.join(parentdir,'scripts')

sys.path.append(dire)


unload_modules('Sticks')

import Sticks
from Sticks import Stick, stick_bridge
from compas.geometry import Line, Point, Vector
from compas_rhino.conversions import line_to_compas

assembly = []
line0 = line_to_compas(line_0)

#initiates a class Stick named stick0
stick0 = Stick(line0)
stick0.rotate_stick(45)
assembly.append(stick0)

line1 = line_to_compas(line_1)
stick1 = Stick(line1)
#stick1.rotate_stick(45,Vector(0,1,0), stick1.axis.start)
assembly.append(stick1)

stick2 = stick_bridge(stick0, stick1)
assembly.append(stick2)
#generates the geometry of the stick0 class: Box
sticks = [s.geometry for s in assembly]
# ---------- end py3 ----------
py3_2 = Python3Script(line_0=line_0_2, line_1=line_1_2)  # -> out, stick_box, sticks; inputs line_0: Line, line_1: Line
# ---------- py3_2: Python ----------
#locate stick class file in the same folder
from compas_rhino import unload_modules
import sys
import os

#get current file path
path = ghenv.Component.OnPingDocument().FilePath
#get parent directory of the parent directory
parentdir = os.path.dirname(path)
#get src folder which contains classes
dire = os.path.join(parentdir,'scripts')

sys.path.append(dire)


unload_modules('Sticks')

import Sticks
from Sticks import Stick, stick_bridge
from compas.geometry import Line, Point, Vector
from compas_rhino.conversions import line_to_compas

assembly = []
line0 = line_to_compas(line_0)

#initiates a class Stick named stick0
stick0 = Stick(line0)
#tick0.rotate_stick(45)
assembly.append(stick0)

line1 = line_to_compas(line_1)
stick1 = Stick(line1)
#stick1.rotate_stick(45,Vector(0,1,0), stick1.axis.start)
assembly.append(stick1)

stick2 = stick_bridge(stick0, stick1)
stick_box = stick2.geometry
#assembly.append(stick2)
#generates the geometry of the stick0 class: Box
sticks = [s.geometry for s in assembly]
# ---------- end py3_2 ----------
py3_3 = Python3Script(line_0=line_0_3, line_1=line_1_3)  # -> out, stick_box, sticks; inputs line_0: Line, line_1: Line
# ---------- py3_3: Python ----------
#locate stick class file in the same folder
from compas_rhino import unload_modules
import sys
import os

#get current file path
path = ghenv.Component.OnPingDocument().FilePath
#get parent directory of the parent directory
parentdir = os.path.dirname(path)
#get src folder which contains classes
dire = os.path.join(parentdir,'scripts')

sys.path.append(dire)


unload_modules('Sticks')

import Sticks
from Sticks import Stick, stick_bridge
from compas.geometry import Line, Point, Vector
from compas_rhino.conversions import line_to_compas

assembly = []
line0 = line_to_compas(line_0)

#initiates a class Stick named stick0
stick0 = Stick(line0)
#stick0.rotate_stick(45)
assembly.append(stick0)

line1 = line_to_compas(line_1)
stick1 = Stick(line1)
#stick1.rotate_stick(45,Vector(0,1,0), stick1.axis.start)
assembly.append(stick1)

stick2= stick_bridge(stick0, stick1)
#p0 = Point(*p0)
#p1 = Point(*p1)
stick_box = stick2.geometry
#assembly.append(stick2)
#generates the geometry of the stick0 class: Box
sticks = [s.geometry for s in assembly]
# ---------- end py3_3 ----------
draw = COMPASDraw(cg=[py3_3.sticks, py3_3.stick_box])  # -> rg
#   port cg: The COMPAS geometry or datastructure to be drawn.
#   port rg: The Rhino geometry object.
# ---------- draw: Python ----------
# r: compas>=2.14.1
"""
Draws COMPAS geometry in Grasshopper.
"""

from typing import Any

import Grasshopper

from compas.scene import SceneObject


class CompasToRhinoGeometry(Grasshopper.Kernel.GH_ScriptInstance):
    def RunScript(self, cg):
        if not cg:
            return None

        return SceneObject(item=cg).draw()
# ---------- end draw ----------
draw_2 = COMPASDraw(cg=py3.sticks)  # -> rg; same code as draw
draw_3 = COMPASDraw(cg=[py3_2.sticks, py3_2.stick_box])  # -> rg; same code as draw
