# Grasshopper definition 103_branching_out_sticks.ghx (Grasshopper 1.0.8)

xy_plane = XYPlane(Origin=Point(0, 0, 0))
number_slider = Slider(290.1, range=0..1000)  # disabled
xy_plane_2 = XYPlane(Origin=Point(0, 0, 0))  # disabled
python_3_script = Python3Script(
    root=xy_plane,
    stick_length=Slider(53, range=0..400),
    num_cubes=Slider(5, range=0..10),
    stick_width=Slider(13, range=0..100),
    stick_depth=Slider(13, range=0..100),
    scale=Slider(3, range=0..10),
    random_seed=Slider(50, range=0..100))  # -> out, geometries; inputs num_cubes: Int32, stick_depth: Int32, scale: Int32, random_seed: Int32
# ---------- python_3_script: Python ----------
# r: compas>=2.14.1
# venv: sticks

import sys
import os
import math

# Get current file path
path = ghenv.Component.OnPingDocument().FilePath
print("File path:", path)
# Get parent directory
parentdir = os.path.dirname(path)
print("Parent dir:", parentdir)
# Get Scripts_Shrey folder
dire = os.path.join(parentdir, 'StudentProjects', 'group_one', 'Scripts_Shrey')
print("Scripts_Shrey path:", dire)
print("Does Scripts_Shrey exist?", os.path.exists(dire))

sys.path.append(dire)

from compas_rhino import unload_modules

unload_modules("Sticks")
unload_modules("Stick_module")

import Sticks
from Sticks import Stick, bridge_corresponding_sticks
from Stick_module import BranchingModule, SquareModule, CubeModule
from compas.geometry import Line, Point, Vector, Frame
import math

from compas_rhino.conversions import plane_to_compas_frame

# Convert input plane to compas frame
root = plane_to_compas_frame(root)

# Create main cube
module = CubeModule(root, stick_length, width=stick_width, depth=stick_depth)

# Create nested cubes 
nested = module.create_nested_cubes(num_cubes=num_cubes, scale_spacing=scale)

# Rotate all cubes with seed control
# If random_seed is not defined as a GH input, uncomment the line below to set a default
# random_seed = 42  # or set to None for random results

for i in range(num_cubes):
    x_angle, y_angle, z_angle, seed_used = module.rotate_cube_random(
        cube_index=i, 
        x_range=[-22.5, 22.5], 
        y_range=[-22.5, 22.5], 
        z_range=[-22.5, 22.5],
        seed=random_seed
    )
    print(f"Cube {i}: X={x_angle:.2f}°, Y={y_angle:.2f}°, Z={z_angle:.2f}°, Seed={seed_used}")

# Alternative: Use fixed rotation angles (currently commented out)
#for i in range(num_cubes):
#    module.rotate_cube(cube_index=i, x_angle=(360/(i+1)), y_angle=(360/(i+1)), z_angle=(360/(i+1)))

# Bridge all consecutive cube pairs
all_bridge_sticks = []
for i in range(len(nested) - 1):
    cube_a = nested[i]
    cube_b = nested[i + 1]
    
    print(f"\n=== Bridging cube {i} to cube {i+1} ===")
    for j in range(min(len(cube_a), len(cube_b))):
        stick_a = cube_a[j]
        stick_b = cube_b[j]
        print(f"Stick {j}: direction_a={stick_a.axis.direction}, direction_b={stick_b.axis.direction}")
    
    bridges = bridge_corresponding_sticks(
        cube_a, 
        cube_b, 
        connection_type="midpoint", 
        overlap=True, 
        min_distance_threshold=50
    )
    all_bridge_sticks.extend(bridges)

# Get geometries
cube_geometries = module.visualize_nested_only()
bridge_geometries = [stick.geometry for stick in all_bridge_sticks]

# Combine all
geometries = cube_geometries + bridge_geometries
# ---------- end python_3_script ----------
python_3_script_2 = Python3Script(root=xy_plane_2, stick_length=number_slider)  # -> out, geometries; inputs root: Plane; disabled
# ---------- python_3_script_2: Python ----------
# r: compas>=2.14.1
# venv: sticks

import sys
import os
import math

#get current file path
path = ghenv.Component.OnPingDocument().FilePath
print (path)
#get parent directory of the parent directory
parentdir = os.path.dirname(path)
print (parentdir)
#get src folder which contains classes
dire = os.path.join(parentdir,'scripts')
print (dire)

sys.path.append(dire)

from compas_rhino import unload_modules

unload_modules("Sticks")
unload_modules("stick_module")

import Sticks
from Sticks import Stick 
from stick_module import BranchingModule
from compas.geometry import Line, Point, Vector, Frame

stick_width = 13.0
stick_depth = 13.0

from compas_rhino.conversions import plane_to_compas_frame, frame_to_rhino_plane

# Convert input to compas
root = plane_to_compas_frame(root)
print(root)

# Initialize tree
tree = BranchingModule(root, stick_length=200, width = stick_width, depth = stick_depth)

# Grow tree
tree.grow_stick(face_index = 0, angle = 0.1)
tree.grow_stick(face_index = 1, angle = 0.5)
tree.grow_stick(face_index = 2, angle = 0.2)
tree.grow_stick(face_index = 3, angle = 0.5)
tree.grow_stick(from_stick_index = 0, face_index = 2, angle = -0.1)

# Visualize
geometries = tree.visualize()

frames = [stick.frame for stick in tree.sticks]
# ---------- end python_3_script_2 ----------
py3 = Python3Script(
    x_range=Slider(5, range=0..10),
    y_range=Slider(5, range=0..10),
    z_range=Slider(5, range=0..10),
    offset_x=Slider(2, range=0..100),
    offset_y=Slider(2, range=0..100))  # -> out, sticks, my_points, polylines; inputs x_range: Int32, y_range: Int32, z_range: Int32, offset_x: Double, offset_y: Double
# ---------- py3: Python ----------
#locate stick class file in the same folder
from compas_rhino import unload_modules
import sys
import os
import math

#get current file path
path = ghenv.Component.OnPingDocument().FilePath
#get parent directory of the parent directory
parentdir = os.path.dirname(path)
#get src folder which contains classes
dire = os.path.join(parentdir,'scripts')

sys.path.append(dire)


unload_modules('Sticks')
unload_modules('stick_module')
unload_modules('nadja_test')

import Sticks
import nadja_test
from stick_module import BranchingModule
from nadja_test import Planarize
from compas.geometry import Line, Point, Vector, Polyline
from compas_rhino.conversions import line_to_compas, point_to_compas
from ghpythonlib.treehelpers import list_to_tree, tree_to_list

stick_length = 2
stick_width = .13
stick_depth = .13

points = []
assembly = []

for z in range(z_range):
    row = []
    for x in range(x_range):
        grid_size_x = stick_length - 2*stick_depth + offset_x
        grid_size = stick_length - 2*stick_depth
        grid_size_z = stick_length - 2*stick_depth + offset_y
        pt = Point(x * grid_size_x, grid_size, z * grid_size_z)
        row.append(pt)
    points.append(row)




### make this like it is a class
### function of the class: to planarize all the points 
pol_pt = []

for i in range(z_range-1):
    i = i % z_range
    pol_points = []
    for j in range(x_range-1):
        j = j % x_range
        p0 = points[i][j]
        p1 = points[i][j+1]
        p3 = points[i+1][j]
        p2 = points[i+1][j+1]
        pol_points.append([p0, p1, p2, p3, p0])
    
    pol_pt.append(pol_points)


module = Planarize(pol_pt)
polylines = module.create_polygon()


my_points = list_to_tree(points)


# sticks = [s.geometry for s in assembly]
# ---------- end py3 ----------
draw = COMPASDraw(cg=python_3_script_2.geometries)  # -> rg; disabled
#   port cg: The COMPAS geometry or datastructure to be drawn.
#   port rg: The Rhino geometry object.
# ---------- draw: Python ----------
# r: compas>=2.14.1
"""
Draws COMPAS geometry in Grasshopper.
"""

from typing import Any

import Grasshopper

from compas.scene import SceneObject


class CompasToRhinoGeometry(Grasshopper.Kernel.GH_ScriptInstance):
    def RunScript(self, cg):
        if not cg:
            return None

        return SceneObject(item=cg).draw()
# ---------- end draw ----------
draw_2 = COMPASDraw(cg=python_3_script.geometries)  # -> rg; same code as draw
draw_3 = COMPASDraw(cg=py3.polylines)  # -> rg; same code as draw
draw_4 = COMPASDraw(cg=py3.my_points)  # -> rg; same code as draw
draw_5 = COMPASDraw(cg=py3.sticks)  # -> rg; same code as draw
points = PointList(Points=draw_4, Size="1")
swatch = ColourSwatch(SwatchColor=RGB(255, 255, 255))
material = CreateMaterial(Diffuse=ColourSwatch(SwatchColor=RGB(0, 0, 0)), Specular=swatch, Emission=swatch, Transparency=0, Shine=0)
preview = CustomPreview(Geometry=draw_5, Material=material)
