# Grasshopper definition 103_branching_out_sticks_FJ.ghx (Grasshopper 1.0.8)

stick_count = Slider(12, range=0..100)
rotation = Slider(3, range=0..100)
xy_plane = XYPlane(Origin=Point(0, 0, 0))
offset_axis = Slider(-94, range=-100..100)
xy_plane_2 = XYPlane(Origin=Point(0, 0, 0))
stick_index = Slider(3, range=0..30)
stick_length = Slider(360, range=0..1000)
module_count = Slider(37, range=0..100)
factor = Slider(0.71, range=0..1)
face_index = Slider(3, range=0..30)
rotation_2 = Slider(1847, range=0..2000)
xy_plane_3 = XYPlane(Origin=Point(0, 0, 0))
xy_plane_4 = XYPlane(Origin=Point(0, 0, 0))
x_range = Slider(8, range=0..10)
y_range = Slider(5, range=0..10)
z_range = Slider(4, range=0..10)

# ----
# 4 long branches test
python_3_script = Python3Script(root=xy_plane, stick_length=Slider(155.1, range=0..1000), angle=Slider(90, range=0..100))  # -> out, geometries, frame; inputs stick_length: Double, angle: Int32; disabled
# ---------- python_3_script: Python ----------
# r: compas>=2.14.1
# venv: sticks

import sys
import os
import math

#get current file path
path = ghenv.Component.OnPingDocument().FilePath
print (path)
#get parent directory of the parent directory
parentdir = os.path.dirname(path)
print (parentdir)
#get src folder which contains classes
dire = os.path.join(parentdir,'scripts')
print (dire)

sys.path.append(dire)

from compas_rhino import unload_modules

unload_modules("Sticks")
unload_modules("stick_module")

import Sticks
from Sticks import Stick 
from stick_module import BranchingModule
from compas.geometry import Line, Point, Vector, Frame

stick_width = 13.0
stick_depth = 13.0

from compas_rhino.conversions import plane_to_compas_frame, frame_to_rhino_plane

# Convert input to compas
root = plane_to_compas_frame(root)

# Initialize tree
tree = BranchingModule(root, stick_length, width = stick_width, depth = stick_depth)

# Grow tree "def grow_stick(self, from_stick_index = -1, face_index = 0, angle = 0.0)""
tree.grow_stick(face_index = 0, angle = angle)
tree.grow_stick(face_index = 1, angle = angle)
tree.grow_stick(face_index = 1, angle = angle)
tree.grow_stick(face_index = 1, angle = angle)
tree.grow_stick(face_index = 1, angle = angle)
tree.grow_stick(face_index = 1, angle = angle)
tree.grow_stick(face_index = 1, angle = angle)
tree.grow_stick(face_index = 1, angle = angle)
tree.grow_stick(face_index = 1, angle = angle)
tree.grow_stick(face_index = 1, angle = angle)
tree.grow_stick(face_index = 1, angle = angle)
tree.grow_stick(face_index = 1, angle = angle)
tree.grow_stick(face_index = 1, angle = angle)
tree.grow_stick(face_index = 1, angle = angle)
tree.grow_stick(face_index = 1, angle = angle)
tree.grow_stick(face_index = 1, angle = angle)

tree.grow_stick(from_stick_index = 0, face_index = 1, angle = 45)
tree.grow_stick(face_index = 2, angle = angle)
tree.grow_stick(face_index = 2, angle = angle)
tree.grow_stick(face_index = 2, angle = angle)
tree.grow_stick(face_index = 2, angle = angle)
tree.grow_stick(face_index = 2, angle = angle)
tree.grow_stick(face_index = 2, angle = angle)
tree.grow_stick(face_index = 2, angle = angle)
tree.grow_stick(face_index = 2, angle = angle)


tree.grow_stick(from_stick_index = 0, face_index = 2, angle = 45)
tree.grow_stick(face_index = 3, angle = angle)
tree.grow_stick(face_index = 3, angle = angle)
tree.grow_stick(face_index = 3, angle = angle)
tree.grow_stick(face_index = 3, angle = angle)
tree.grow_stick(face_index = 3, angle = angle)
tree.grow_stick(face_index = 3, angle = angle)
tree.grow_stick(face_index = 3, angle = angle)
tree.grow_stick(face_index = 3, angle = angle)
tree.grow_stick(face_index = 3, angle = angle)
tree.grow_stick(face_index = 3, angle = angle)
tree.grow_stick(face_index = 3, angle = angle)
tree.grow_stick(face_index = 3, angle = angle)
tree.grow_stick(face_index = 3, angle = angle)
tree.grow_stick(face_index = 3, angle = angle)
tree.grow_stick(face_index = 3, angle = angle)
tree.grow_stick(face_index = 3, angle = angle)

tree.grow_stick(from_stick_index = 0, face_index = 3, angle = 45)
tree.grow_stick(face_index = 4, angle = angle)
tree.grow_stick(face_index = 4, angle = angle)
tree.grow_stick(face_index = 4, angle = angle)
tree.grow_stick(face_index = 4, angle = angle)
tree.grow_stick(face_index = 4, angle = angle)
tree.grow_stick(face_index = 4, angle = angle)
tree.grow_stick(face_index = 4, angle = angle)
tree.grow_stick(face_index = 4, angle = angle)
tree.grow_stick(face_index = 4, angle = angle)
tree.grow_stick(face_index = 4, angle = angle)
tree.grow_stick(face_index = 4, angle = angle)
tree.grow_stick(face_index = 4, angle = angle)
tree.grow_stick(face_index = 4, angle = angle)
tree.grow_stick(face_index = 4, angle = angle)
tree.grow_stick(face_index = 4, angle = angle)
tree.grow_stick(face_index = 4, angle = angle)
tree.grow_stick(face_index = 4, angle = angle)
tree.grow_stick(face_index = 4, angle = angle)
tree.grow_stick(face_index = 4, angle = angle)
tree.grow_stick(face_index = 4, angle = angle)
tree.grow_stick(face_index = 4, angle = angle)
tree.grow_stick(face_index = 4, angle = angle)
tree.grow_stick(face_index = 4, angle = angle)
tree.grow_stick(face_index = 4, angle = angle)
tree.grow_stick(face_index = 4, angle = angle)
tree.grow_stick(face_index = 4, angle = angle)
tree.grow_stick(face_index = 4, angle = angle)
tree.grow_stick(face_index = 4, angle = angle)
tree.grow_stick(face_index = 4, angle = angle)
tree.grow_stick(face_index = 4, angle = angle)
tree.grow_stick(face_index = 4, angle = angle)
tree.grow_stick(face_index = 4, angle = angle)
tree.grow_stick(face_index = 4, angle = angle)
tree.grow_stick(face_index = 4, angle = angle)
tree.grow_stick(face_index = 4, angle = angle)
tree.grow_stick(face_index = 4, angle = angle)
tree.grow_stick(face_index = 4, angle = angle)
tree.grow_stick(face_index = 4, angle = angle)
tree.grow_stick(face_index = 4, angle = angle)
tree.grow_stick(face_index = 4, angle = angle)
tree.grow_stick(face_index = 4, angle = angle)
tree.grow_stick(face_index = 4, angle = angle)
tree.grow_stick(face_index = 4, angle = angle)
tree.grow_stick(face_index = 4, angle = angle)
tree.grow_stick(face_index = 4, angle = angle)
tree.grow_stick(face_index = 4, angle = angle)
tree.grow_stick(face_index = 4, angle = angle)


# Visualize
geometries = tree.visualize()


frame = tree.sticks[0].frame
# ---------- end python_3_script ----------

python_3_script_2 = Python3Script()  # -> out, a
# ---------- python_3_script_2: Python ----------
def grow_module(self, from_module_index=-1, from_stick_index=-1, face_index=0, angle=0.0):
    """
    Grows a new module from an existing module's stick.
    """
    
    # Get position on original stick from specific module
    position = self.get_face_frame(from_module_index, from_stick_index, face_index).copy()
    position.point += position.yaxis * self.depth/2
    position.point += position.xaxis * -10.0

    # Rotate along face frame
    R = Rotation.from_axis_and_angle(position.yaxis, math.radians(angle), point=position.point)
    position.transform(R)

    # Offset along stick axis (x, length)
    position.point += position.xaxis * -10.0

    # Create new module at this position
    new_module = StickModuleC(position.point, self.width, self.depth, self.stick_length)
    new_module.create_module_b()  # ADD THIS LINE - Create the sticks!
    self.modules.append(new_module)
# ---------- end python_3_script_2 ----------

# ----
# Tree
python_3_script_3 = Python3Script(
    root=xy_plane_3,
    stick_length=Slider(155.1, range=0..1000),
    angle=Slider(90, range=0..100),
    x_count=Slider(10, range=0..100),
    y_count=Slider(10, range=0..100))  # -> out, geometries, frames; inputs stick_length: Double, angle: Int32, x_count: Int32, y_count: Int32; disabled
# ---------- python_3_script_3: Python ----------
# r: compas>=2.14.1
# venv: sticks

import sys
import os
import math

#get current file path
path = ghenv.Component.OnPingDocument().FilePath
print (path)
#get parent directory of the parent directory
parentdir = os.path.dirname(path)
print (parentdir)
#get src folder which contains classes
dire = os.path.join(parentdir,'scripts')
print (dire)

sys.path.append(dire)

from compas_rhino import unload_modules

unload_modules("Sticks")
unload_modules("stick_module")

import Sticks
from Sticks import Stick 
from stick_module import BranchingModule
from compas.geometry import Line, Point, Vector, Frame

stick_width = 13.0
stick_depth = 13.0

from compas_rhino.conversions import plane_to_compas_frame, frame_to_rhino_plane

# Convert input to compas
root = plane_to_compas_frame(root)

# Initialize tree
tree = BranchingModule(root, stick_length, width = stick_width, depth = stick_depth)

# Grow tree "def grow_stick(self, from_stick_index = -1, face_index = 0, angle = 0.0)""
for i in range(x_count):
    for j in range(y_count):
        tree.grow_stick(from_stick_index = i, face_index = 0, angle = 10)
        tree.grow_stick(from_stick_index = i, face_index = j%3, angle = 40)

# Visualize
geometries = tree.visualize()

 
#frames = tree.sticks[0].frame

frames = [stick.frame for stick in tree.sticks]
# ---------- end python_3_script_3 ----------

python_3_script_4 = Python3Script(
    root=xy_plane_4,
    stick_length=Slider(155.1, range=0..1000),
    rot_angle=rotation,
    x_count=stick_count,
    y_count=Slider(0, range=0..100),
    factor=Slider(0.2, range=0..1))  # -> out, geometries, frame; inputs stick_length: Double, rot_angle: Int32, x_count: Int32, y_count: Int32, factor: Double; disabled
# ---------- python_3_script_4: Python ----------
# r: compas>=2.14.1
# venv: sticks

import sys
import os
import math

#get current file path
path = ghenv.Component.OnPingDocument().FilePath
print (path)
#get parent directory of the parent directory
parentdir = os.path.dirname(path)
print (parentdir)
#get src folder which contains classes
dire = os.path.join(parentdir,'scripts')
print (dire)

sys.path.append(dire)

from compas_rhino import unload_modules

unload_modules("Sticks")
unload_modules("stick_module")

import Sticks
from Sticks import Stick 
from stick_module import BranchingModule
from compas.geometry import Line, Point, Vector, Frame

stick_width = 13.0 
stick_depth = 13.0

from compas_rhino.conversions import plane_to_compas_frame, frame_to_rhino_plane

# Convert input to compas
root = plane_to_compas_frame(root)

# Initialize tree
tree = BranchingModule(root, stick_length, width = stick_width, depth = stick_depth)

# Grow tree "def grow_stick(self, from_stick_index = -1, face_index = 0, angle = 0.0)""
for i in range(x_count):
    # tree.grow_stick(from_stick_index = i, face_index = 2, angle = rot_angle)
    if i %2:
        tree.grow_stick(from_stick_index = i, face_index = 2, angle = rot_angle)
    else:
        tree.grow_stick(from_stick_index = i, face_index = 2, angle = -rot_angle*i*factor)

# Visualize
geometries = tree.visualize()

 
frame = tree.sticks[0].frame

frames = [stick.frame for stick in tree.sticks]
# ---------- end python_3_script_4 ----------

# ----
# moduleC in Grid
py3 = Python3Script(x_range=x_range, y_range=y_range, z_range=z_range)  # -> out, points, assembly, sticks, stick_box, frames; inputs x_range: Int32, y_range: Int32, z_range: Int32, line_0: Line, line_1: Line; disabled
# ---------- py3: Python ----------
#locate stick class file in the same folder
from compas_rhino import unload_modules
import sys
import os

#get current file path
path = ghenv.Component.OnPingDocument().FilePath
#get parent directory of the parent directory
parentdir = os.path.dirname(path)
#get src folder which contains classes
dire = os.path.join(parentdir,'scripts')

sys.path.append(dire)

unload_modules('Sticks')
unload_modules('stick_module')

import Sticks
from Sticks import Stick, stick_bridge
from compas.geometry import Line, Point, Vector
from compas_rhino.conversions import line_to_compas
from stick_module import OStickModule
from stick_module import StickModuleB
from stick_module import StickModuleC

stick_width = 13.0
stick_depth = 13.0
stick_length = 200

points = []
assembly = []
for x in range (x_range):
    for y in range(y_range):
        for z in range(z_range):
            grid_size = stick_length - 2*stick_depth
            pt = Point(x*grid_size, y*grid_size, z*grid_size)
            points.append(pt)
            # type = if even return 0, if odd return 1 if it's the last stick
            type_x = x%2 if x < x_range-1 else 2
            print("x", type_x)
            type_y = y%2 if y < y_range-1 else 2
            print("y", type_y)
            type_z = z%2 if z < z_range-1 else 2
            print("z", type_z)

            type = {"x": type_x, "y": type_y, "z": type_z}

            stick_module = StickModuleC(pt, stick_width, stick_depth, stick_length)
            stick_module.create_module_b()

            assembly.extend(stick_module.sticks)

sticks = [s.geometry for s in assembly]

frames = [stick.frame for stick in stick_module.sticks]
# ---------- end py3 ----------

python_3_script_5 = Python3Script(
    root=xy_plane_2,
    stick_length=stick_length,
    rot_angle=rotation_2,
    module_count=module_count,
    y_count=Slider(7, range=0..100),
    factor=factor,
    s_index=stick_index,
    f_index=face_index,
    offset_axis=offset_axis)  # -> out, geometries, frame; inputs root: Plane, stick_length: Double, rot_angle: Int32, module_count: Int32, y_count: Int32, factor: Double, s_index: Int32, f_index: Int32, offset_axis: Int32
# ---------- python_3_script_5: Python ----------
# r: compas>=2.14.1
# venv: sticks

import sys
import os
import math

#get current file path
path = ghenv.Component.OnPingDocument().FilePath
print (path)
#get parent directory of the parent directory
parentdir = os.path.dirname(path)
print (parentdir)
#get src folder which contains classes
dire = os.path.join(parentdir,'scripts')
print (dire)

sys.path.append(dire)

from compas_rhino import unload_modules

unload_modules("Sticks")
unload_modules("stick_module")

import Sticks
from Sticks import Stick 
from stick_module_modified import BranchingModule, BranchStickModules
from compas.geometry import Line, Point, Vector, Frame

stick_width = 13.0 
stick_depth = 13.0

from compas_rhino.conversions import plane_to_compas_frame, frame_to_rhino_plane

# Convert input to compas
root = plane_to_compas_frame(root)

# Initialize tree
tree = BranchStickModules(root, stick_length, width=stick_width, depth=stick_depth)
# Grow tree "def grow_stick(self, from_stick_index = -1, face_index = 0, angle = 0.0)""
# for i in range(x_count):
#     if i %2:
#         tree.grow_stick(from_stick_index = i, face_index = 2, angle = rot_angle)
#     else:
#         tree.grow_stick(from_stick_index = i, face_index = 2, angle = -rot_angle*i*factor)

for i in range(module_count):
    tree.grow_module( offset_axis, from_module_index=i, from_stick_index=s_index, face_index=f_index, angle =i*rot_angle)
print(tree)
# Visualize
geometries = tree.visualize()

 
#frame = tree.sticks[0].frame
frame = tree.modules[0].sticks[4].frame

frames = [stick.frame for module in tree.modules for stick in module.sticks]
# ---------- end python_3_script_5 ----------
draw = COMPASDraw(cg=python_3_script.frame)  # -> rg
#   port cg: The COMPAS geometry or datastructure to be drawn.
#   port rg: The Rhino geometry object.
# ---------- draw: Python ----------
# r: compas>=2.14.1
"""
Draws COMPAS geometry in Grasshopper.
"""

from typing import Any

import Grasshopper

from compas.scene import SceneObject


class CompasToRhinoGeometry(Grasshopper.Kernel.GH_ScriptInstance):
    def RunScript(self, cg):
        if not cg:
            return None

        return SceneObject(item=cg).draw()
# ---------- end draw ----------
draw_2 = COMPASDraw(cg=python_3_script.geometries)  # -> a; same code as draw
draw_3 = COMPASDraw(cg=python_3_script_3.geometries)  # -> a; same code as draw
draw_4 = COMPASDraw(cg=python_3_script_3.frames)  # -> rg; same code as draw
draw_5 = COMPASDraw(cg=python_3_script_4.geometries)  # -> rg; same code as draw
draw_6 = COMPASDraw(cg=python_3_script_5.geometries)  # -> rg; same code as draw
compas_draw = COMPASDraw(cg=py3.sticks)  # -> rg; same code as draw
compas_draw_2 = COMPASDraw(cg=py3.points)  # -> rg; same code as draw
panel = Panel(python_3_script_5.frame)
custom_preview = CustomPreview(Geometry=[draw_2, draw_3], Material=ColourSwatch(SwatchColor=RGB(184, 139, 103)))
python_3_script_6 = Python3Script(frames=[py3.frames, python_3_script_4.frame], factor=Slider(100, range=10..100))  # -> out, points, x_vectors, y_vectors, normal; inputs frames: list
# ---------- python_3_script_6: Python ----------
from compas.geometry import Vector
from compas.geometry import cross_vectors
from compas_rhino.conversions import vector_to_rhino
from compas_rhino.conversions import point_to_rhino

points = []
x_vectors = []
y_vectors = []
normal = []



for frame in frames:
    points.append(point_to_rhino(frame.point))
    x_vectors.append(vector_to_rhino(frame.xaxis * factor))
    y_vectors.append(vector_to_rhino(frame.yaxis * factor))
    normal.append(vector_to_rhino(frame.normal * factor))

#frames = [stick.frame for stick in tree.sticks]
# ---------- end python_3_script_6 ----------
vector_display_ex = VectorDisplayEx(
    Point=python_3_script_6.points,
    Vector=python_3_script_6.x_vectors,
    Colour=ColourSwatch(SwatchColor=RGB(191, 82, 82)),
    Width=2)
vector_display_ex_2 = VectorDisplayEx(
    Point=python_3_script_6.points,
    Vector=python_3_script_6.y_vectors,
    Colour=ColourSwatch(SwatchColor=RGB(62, 80, 138)),
    Width=2)
vector_display_ex_3 = VectorDisplayEx(Vector=python_3_script_6.normal, Colour=ColourSwatch(SwatchColor=RGB(110, 145, 70)), Width=2)
