# Grasshopper definition 251208_module_C_connecting_FJ_Ruth_edit.ghx (Grasshopper 1.0.8)

x_dist = Slider(100, range=0..500)  # disabled
x = Slider(3, range=0..10)  # disabled
y = Slider(3, range=0..10)  # disabled
y_dist = Slider(100, range=0..500)  # disabled
rotation = Slider(0, range=0..2000)  # disabled
module_count = Slider(3, range=0..100)  # disabled
face_index = Slider(3, range=0..30)  # disabled
offset_axis = Slider(-74, range=-100..100)  # disabled
offset_axis_b = Slider(-6, range=-100..100)  # disabled
stick_index = Slider(4, range=0..30)  # disabled
python_3_script = Python3Script(x=x, y=y, x_dist=x_dist, y_dist=y_dist)  # -> out, points; inputs x: Int32, y: Int32, x_dist: Int32, y_dist: Int32; disabled
# ---------- python_3_script: Python ----------
import Rhino.Geometry as rg

points = []

for ix in range(x):
    for iy in range(y):
        pt = rg.Point3d(ix * x_dist, iy * y_dist, 0)
        points.append(pt)
# ---------- end python_3_script ----------
xy_plane = XYPlane(Origin=Point(0, 0, 0))  # disabled
panel = Panel("200")  # disabled
offset_axis_x_z = Slider(0, range=-100..100)  # disabled
offset_axis_b_y = Slider(0, range=-100..100)  # disabled
module_count_2 = Slider(4, range=0..100)  # disabled
stick_index_2 = Slider(4, range=0..4)  # disabled
face_index_2 = Slider(1, range=0..3)  # disabled
rotation_2 = Slider(0, range=0..360)  # disabled
panel_2 = Panel(python_3_script.points)  # disabled
xy_plane_2 = XYPlane(Origin=python_3_script.points)  # disabled
xy_plane_3 = XYPlane(Origin=Point(0, 0, 0))  # disabled
panel_3 = Panel("200")  # disabled

# ----
# base code:
# stick_module_modified_frame
python_3_script_2 = Python3Script(
    root=xy_plane,
    stick_length=panel,
    rot_angle=rotation,
    module_count=module_count,
    s_index=stick_index,
    f_index=face_index,
    offset_axis=offset_axis,
    offset_axis_b=offset_axis_b)  # -> out, geometries, frames; inputs root: Plane, stick_length: Double, rot_angle: Int32, module_count: Int32, s_index: Int32, f_index: Int32, offset_axis: Int32, offset_axis_b: Double; disabled
# ---------- python_3_script_2: Python ----------
# r: compas>=2.14.1
# venv: sticks

import sys
import os
import math

#get current file path
path = ghenv.Component.OnPingDocument().FilePath
print (path)
#get parent directory of the parent directory
parentdir = os.path.dirname(path)
print (parentdir)
#get src folder which contains classes
dire = os.path.join(parentdir,'group_one_scripts')
print (dire)

sys.path.append(dire)

from compas_rhino import unload_modules

unload_modules("group_one_sticks")
unload_modules("group_one_stick_module")
unload_modules("stick_module_modified_frame") 

import group_one_sticks
from group_one_sticks import Stick 
from stick_module_modified_frame import BranchingModule, BranchStickModules
from compas.geometry import Line, Point, Vector, Frame

stick_width = 10
stick_depth = 10    

from compas_rhino.conversions import plane_to_compas_frame, frame_to_rhino_plane

# Convert input to compas
root = plane_to_compas_frame(root)

# Initialize tree
tree = BranchStickModules(root, stick_length, width=stick_width, depth=stick_depth)
# Grow tree "def grow_stick(self, from_stick_index = -1, face_index = 0, angle = 0.0)""
# for i in range(x_count):
#     if i %2:
#         tree.grow_stick(from_stick_index = i, face_index = 2, angle = rot_angle)
#     else:
#         tree.grow_stick(from_stick_index = i, face_index = 2, angle = -rot_angle*i*factor)

for i in range(module_count):
    tree.grow_module( offset_axis, offset_axis_b, from_module_index=i, from_stick_index=s_index, face_index=f_index, angle = rot_angle)
print(tree)
# Visualize
geometries = tree.visualize()

 
#frame = tree.sticks[0].frame
frame = tree.modules[0].sticks[0].frame

frames = [stick.frame for module in tree.modules for stick in module.sticks]
# ---------- end python_3_script_2 ----------

# ----
# base code:
# stick_module_modified_frame
python_3_script_3 = Python3Script(
    root=xy_plane_2,
    stick_length=panel_3,
    rot_angle=rotation_2,
    module_count=module_count_2,
    s_index=stick_index_2,
    f_index=face_index_2,
    offset_axis=offset_axis_x_z,
    offset_axis_b=offset_axis_b_y)  # -> out, colors, geometries, frames; inputs root: Plane, stick_length: Double, rot_angle: Int32, module_count: Int32, s_index: Int32, f_index: Int32, offset_axis: Int32, offset_axis_b: Double; disabled
# ---------- python_3_script_3: Python ----------
# r: compas>=2.14.1
# venv: sticks

import sys
import os
import math

#get current file path
path = ghenv.Component.OnPingDocument().FilePath
#get parent directory of the parent directory
parentdir = os.path.dirname(path)
#get src folder which contains classes
dire = os.path.join(parentdir,'group_one_scripts')

sys.path.append(dire)

from compas_rhino import unload_modules

unload_modules("group_one_sticks")
unload_modules("group_one_stick_module")
unload_modules("stick_module_modified_frame_Ruth_edit") 

import group_one_sticks
from group_one_sticks import Stick 
from stick_module_modified_frame_Ruth_edit import BranchStickModules, BranchStickModulesUpdates
from compas.geometry import Line, Point, Vector, Frame

stick_width = 10
stick_depth = 10    

from compas_rhino.conversions import plane_to_compas_frame, frame_to_rhino_plane

# Convert input to compas
root = plane_to_compas_frame(root)

# Initialize tree
tree = BranchStickModulesUpdates(root, stick_length, stick_width, stick_depth)


stick_pattern = [4,2,0]
face_pattern  = [2,0,2]

for i in range(module_count):
    from_module_index = i         
    from_stick_index  = stick_pattern[i % len(stick_pattern)]
    face_index        = face_pattern[i % len(face_pattern)]
    
    angle_for_this_module = i * rot_angle  # 0, 10, 20, 30,... if rot_angle=10

    tree.grow_module(
        offset_axis,
        offset_axis_b,
        from_module_index=from_module_index,
        from_stick_index=from_stick_index,
        face_index=face_index,
        angle=angle_for_this_module
    )
    print(i, "stick_index :", from_stick_index, "// face_index :", face_index, "// angle :", angle_for_this_module)

### skipping root sticks ###
frames = [stick.frame
          for module in tree.modules[1:]    # skip root
          for stick in module.sticks]

# Visualize
geometries = [stick.geometry
              for module in tree.modules[1:]    # skip root module
              for stick in module.sticks]





####   Color with 4 different color to understand the branching method   ####
from System.Drawing import Color

color_1 = Color.FromArgb(255, 100, 0)     # orange
color_2 = Color.FromArgb(0, 150, 255)     # blue
color_3 = Color.FromArgb(0, 200, 80)      # green
color_4 = Color.FromArgb(200, 0, 200)     # magenta

color_list = [color_1, color_2, color_3, color_4]

colors = []

# start from module_index = 1 so we skip the root
for module_index, module in enumerate(tree.modules[1:], start=1):
    col = color_list[module_index % 4]
    for stick in module.sticks:
        colors.append(col)
# ---------- end python_3_script_3 ----------

draw = COMPASDraw(cg=python_3_script_3.geometries)  # -> rg; disabled
#   port cg: The COMPAS geometry or datastructure to be drawn.
#   port rg: The Rhino geometry object.
# ---------- draw: Python ----------
# r: compas>=2.14.1
"""
Draws COMPAS geometry in Grasshopper.
"""

from typing import Any

import Grasshopper

from compas.scene import SceneObject


class CompasToRhinoGeometry(Grasshopper.Kernel.GH_ScriptInstance):
    def RunScript(self, cg):
        if not cg:
            return None

        return SceneObject(item=cg).draw()
# ---------- end draw ----------
draw_2 = COMPASDraw(cg=python_3_script_3.frames)  # -> rg; disabled; same code as draw
draw_3 = COMPASDraw(cg=python_3_script_2.geometries)  # -> rg; disabled; same code as draw
panel_4 = Panel(python_3_script_3.frames)  # disabled
colour_swatch = ColourSwatch(SwatchColor=RGB(201, 154, 83))  # disabled
colour_swatch_2 = ColourSwatch(SwatchColor=RGB(201, 154, 83))  # disabled
custom_preview = CustomPreview(Geometry=draw, Material=python_3_script_3.colors)  # disabled
custom_preview_2 = CustomPreview(Geometry=draw_3, Material=colour_swatch)  # disabled

x_distance = Slider(155, range=0..500)  # disabled
y_distance = Slider(70, range=0..500)  # disabled
point_index = Slider(8, range=0..100)  # disabled
x_2 = Slider(10, range=0..10)  # disabled
y_2 = Slider(10, range=0..10)  # disabled
rotation_degree = Slider(5, range=0..360)  # disabled
python_3_script_4 = Python3Script(x=point_index)  # -> out, module_counts; inputs x: Int32; disabled
# ---------- python_3_script_4: Python ----------
min_count = 1
max_count = 3

module_counts = []

span = max_count - min_count      # 2
period = 2 * span                 # 4

for i in range(x):
    k = i % period
    if k < span:
        c = min_count + k         # going up
    else:
        c = max_count - (k - span)  # coming down
    module_counts.append(c)
# ---------- end python_3_script_4 ----------
panel_5 = Panel(python_3_script_4.module_counts)  # disabled
python_3_script_5 = Python3Script(x_dist=x_distance, y_dist=y_distance, loop_length=point_index, x=x_2, y=y_2, rot=rotation_degree)  # -> out, points, planes; inputs x_dist: Int32, y_dist: Int32, loop_length: Int32, x: Int32, y: Int32, rot: Int32; disabled
# ---------- python_3_script_5: Python ----------
# import Rhino.Geometry as rg
# from math import sin, cos, tan

# points = []

# for i in range (loop_length):
#     pt = rg.Point3d(sin(i)*x_dist, i*y_dist, 0)
#     points.append(pt)


# for i in range (x):
#     for i in range (y):
#         pt = rg.Point3d(sin(i)*x_dist, i*y_dist, 0)
#         points.append(pt)



import Rhino.Geometry as rg
from math import cos, radians

points = []
planes = []   

for i in range (loop_length):
    pt = rg.Point3d(cos(i) * x_dist, i * y_dist, 0)
    points.append(pt)

    pl = rg.Plane(pt, rg.Vector3d.XAxis, rg.Vector3d.YAxis)
    angle = radians(i * rot)
    pl.Rotate(angle, pl.ZAxis, pl.Origin)

    planes.append(pl)
    print(i, '// point:', pt, '// angle:', i * rot)
# ---------- end python_3_script_5 ----------
offset_axis_x_z_2 = Slider(0, range=-100..100)  # disabled
offset_axis_b_y_2 = Slider(0, range=-100..100)  # disabled
module_count_3 = Slider(1, range=0..100)  # disabled
stick_index_3 = Slider(4, range=0..4)  # disabled
face_index_3 = Slider(1, range=0..3)  # disabled
rotation_3 = Slider(0, range=0..360)  # disabled
number_slider = Slider(50, range=0..100)  # disabled
xy_plane_4 = XYPlane(Origin=Point(0, 0, 0))  # disabled
xy_plane_5 = XYPlane(Origin=Point(0, 0, 0))  # disabled
panel_6 = Panel("200")  # disabled
panel_7 = Panel("cos curve")
point_list = PointList(Points=python_3_script_5.points, Size=number_slider)  # disabled
colour_swatch_3 = ColourSwatch(SwatchColor=RGB(201, 154, 83))  # disabled

# ----
# base code:
# stick_module_modified_frame
python_3_script_6 = Python3Script(
    root=python_3_script_5.planes,
    stick_length=panel_6,
    rot_angle=rotation_3,
    module_count=python_3_script_4.module_counts,
    s_index=stick_index_3,
    f_index=face_index_3,
    offset_axis=offset_axis_x_z_2,
    offset_axis_b=offset_axis_b_y_2)  # -> out, colors, geometries, frames; inputs root: Plane, stick_length: Double, rot_angle: Int32, module_count: Int32, s_index: Int32, f_index: Int32, offset_axis: Int32, offset_axis_b: Double; disabled
# ---------- python_3_script_6: Python ----------
# r: compas>=2.14.1
# venv: sticks

import sys
import os
import math

#get current file path
path = ghenv.Component.OnPingDocument().FilePath
#get parent directory of the parent directory
parentdir = os.path.dirname(path)
#get src folder which contains classes
dire = os.path.join(parentdir,'group_one_scripts')

sys.path.append(dire)

from compas_rhino import unload_modules

unload_modules("group_one_sticks")
unload_modules("group_one_stick_module")
unload_modules("stick_module_modified_frame_Ruth_edit") 

import group_one_sticks
from group_one_sticks import Stick 
from stick_module_modified_frame_Ruth_edit import BranchStickModules, BranchStickModulesUpdates
from compas.geometry import Line, Point, Vector, Frame

stick_width = 10
stick_depth = 10    

from compas_rhino.conversions import plane_to_compas_frame, frame_to_rhino_plane

# Convert input to compas
root = plane_to_compas_frame(root)

# Initialize tree
tree = BranchStickModulesUpdates(root, stick_length, stick_width, stick_depth)


stick_pattern = [0,2,3]
face_pattern  = [0,2,2]

for i in range(module_count):
    from_module_index = i         
    from_stick_index  = stick_pattern[i % len(stick_pattern)]
    face_index        = face_pattern[i % len(face_pattern)]
    
    angle_for_this_module = i * rot_angle  # 0, 10, 20, 30,... if rot_angle=10

    tree.grow_module(
        offset_axis,
        offset_axis_b,
        from_module_index=from_module_index,
        from_stick_index=from_stick_index,
        face_index=face_index,
        angle=angle_for_this_module
    )
    print(i, "stick_index :", from_stick_index, "// face_index :", face_index, "// angle :", angle_for_this_module)

### skipping root sticks ###
frames = [stick.frame
          for module in tree.modules[1:]    # skip root
          for stick in module.sticks]

# Visualize
geometries = [stick.geometry
              for module in tree.modules[1:]    # skip root module
              for stick in module.sticks]





####   Color with 4 different color to understand the branching method   ####
from System.Drawing import Color

color_1 = Color.FromArgb(255, 100, 0)     # orange
color_2 = Color.FromArgb(0, 150, 255)     # blue
color_3 = Color.FromArgb(0, 200, 80)      # green
color_4 = Color.FromArgb(200, 0, 200)     # magenta

color_list = [color_1, color_2, color_3, color_4]

colors = []

# start from module_index = 1 so we skip the root
for module_index, module in enumerate(tree.modules[1:], start=1):
    col = color_list[module_index % 4]
    for stick in module.sticks:
        colors.append(col)
# ---------- end python_3_script_6 ----------

draw_4 = COMPASDraw(cg=python_3_script_6.geometries)  # -> rg; disabled; same code as draw
draw_5 = COMPASDraw(cg=python_3_script_6.frames)  # -> rg; disabled; same code as draw
panel_8 = Panel(python_3_script_6.frames)  # disabled
custom_preview_3 = CustomPreview(Geometry=draw_4, Material=python_3_script_6.colors)  # disabled

x_3 = Slider(2, range=0..10)  # disabled
y_3 = Slider(2, range=0..10)  # disabled
x_dist_2 = Slider(50, range=0..500)  # disabled
y_dist_2 = Slider(50, range=0..500)  # disabled
rotation_degree_2 = Slider(90, range=0..360)  # disabled
multiplication = Multiplication(A=x_3, B=y_3)  # disabled
python_3_script_7 = Python3Script(x=multiplication)  # -> out, module_counts; inputs x: Int32; disabled; same code as python_3_script_4
panel_9 = Panel(python_3_script_7.module_counts)  # disabled
python_3_script_8 = Python3Script(x=x_3, y=y_3, x_dist=x_dist_2, y_dist=y_dist_2, rot=rotation_degree_2)  # -> out, points, planes; inputs x: Int32, y: Int32, x_dist: Int32, y_dist: Int32, rot: Int32; disabled
# ---------- python_3_script_8: Python ----------
#### NORMAL GRID 0-1-3-2 ####
# import Rhino.Geometry as rg
# from math import sin, radians

# points = []
# planes = []

# counter = 0

# for ix in range(x):
#     for iy in range(y):

#         pt = rg.Point3d(ix * x_dist, iy * y_dist, 0)
#         points.append(pt)

#         pl = rg.Plane(pt, rg.Vector3d.XAxis, rg.Vector3d.YAxis)

#         angle = radians(counter * rot)   

#         pl.Rotate(angle, pl.ZAxis, pl.Origin)
#         planes.append(pl)

        
#         print(counter, '// point:', pt, '// angle:', counter * rot)

#         counter += 1  






#### SNAKE STYLE 0-1-2-3 ####
import Rhino.Geometry as rg
from math import radians

points = []
planes = []

counter = 0

for ix in range(x):

    # Compute index range depending on row number
    if ix % 2 == 0:
        iy_range = range(y)          # normal direction
    else:
        iy_range = range(y-1, -1, -1)  # reverse direction

    for iy in iy_range:

        pt = rg.Point3d(ix * x_dist, iy * y_dist, 0)
        points.append(pt)

        pl = rg.Plane(pt, rg.Vector3d.XAxis, rg.Vector3d.YAxis)

        angle = -radians(counter * rot)
        pl.Rotate(angle, pl.ZAxis, pl.Origin)
        planes.append(pl)

        print(counter, '// point:', pt, '// angle:', counter * rot)

        counter += 1
# ---------- end python_3_script_8 ----------
offset_axis_x_z_3 = Slider(0, range=-100..100)  # disabled
offset_axis_b_y_3 = Slider(0, range=-100..100)  # disabled
module_count_4 = Slider(4, range=0..100)  # disabled
stick_index_4 = Slider(4, range=0..4)  # disabled
face_index_4 = Slider(1, range=0..3)  # disabled
rotation_4 = Slider(10, range=0..360)  # disabled
number_slider_2 = Slider(50, range=0..100)  # disabled
xy_plane_6 = XYPlane(Origin=Point(0, 0, 0))  # disabled
xy_plane_7 = XYPlane(Origin=Point(0, 0, 0))  # disabled
panel_10 = Panel("200")  # disabled
panel_11 = Panel("""2x2 grid
rotated clockwise""")
point_list_2 = PointList(Points=python_3_script_8.points, Size=number_slider_2)  # disabled
colour_swatch_4 = ColourSwatch(SwatchColor=RGB(201, 154, 83))  # disabled

# ----
# base code:
# stick_module_modified_frame
python_3_script_9 = Python3Script(
    root=python_3_script_8.planes,
    stick_length=panel_10,
    rot_angle=rotation_4,
    module_count=module_count_4,
    s_index=stick_index_4,
    f_index=face_index_4,
    offset_axis=offset_axis_x_z_3,
    offset_axis_b=offset_axis_b_y_3)  # -> out, colors, geometries, frames; inputs root: Plane, stick_length: Double, rot_angle: Int32, module_count: Int32, s_index: Int32, f_index: Int32, offset_axis: Int32, offset_axis_b: Double; disabled
# ---------- python_3_script_9: Python ----------
# r: compas>=2.14.1
# venv: sticks

import sys
import os
import math

#get current file path
path = ghenv.Component.OnPingDocument().FilePath
#get parent directory of the parent directory
parentdir = os.path.dirname(path)
#get src folder which contains classes
dire = os.path.join(parentdir,'group_one_scripts')

sys.path.append(dire)

from compas_rhino import unload_modules

unload_modules("group_one_sticks")
unload_modules("group_one_stick_module")
unload_modules("stick_module_modified_frame_Ruth_edit") 

import group_one_sticks
from group_one_sticks import Stick 
from stick_module_modified_frame_Ruth_edit import BranchStickModules, BranchStickModulesUpdates
from compas.geometry import Line, Point, Vector, Frame

stick_width = 10
stick_depth = 10    

from compas_rhino.conversions import plane_to_compas_frame, frame_to_rhino_plane

# Convert input to compas
root = plane_to_compas_frame(root)

# Initialize tree
tree = BranchStickModulesUpdates(root, stick_length, stick_width, stick_depth)


stick_pattern = [0,2,1,4]
face_pattern  = [0,2,0,0]

for i in range(module_count):
    from_module_index = i         
    from_stick_index  = stick_pattern[i % len(stick_pattern)]
    face_index        = face_pattern[i % len(face_pattern)]
    
    angle_for_this_module = i * rot_angle  # 0, 10, 20, 30,... if rot_angle=10

    tree.grow_module(
        offset_axis,
        offset_axis_b,
        from_module_index=from_module_index,
        from_stick_index=from_stick_index,
        face_index=face_index,
        angle=angle_for_this_module
    )
    print(i, "stick_index :", from_stick_index, "// face_index :", face_index, "// angle :", angle_for_this_module)

### skipping root sticks ###
frames = [stick.frame
          for module in tree.modules[1:]    # skip root
          for stick in module.sticks]

# Visualize
geometries = [stick.geometry
              for module in tree.modules[1:]    # skip root module
              for stick in module.sticks]





####   Color with 4 different color to understand the branching method   ####
from System.Drawing import Color

color_1 = Color.FromArgb(255, 100, 0)     # orange
color_2 = Color.FromArgb(0, 150, 255)     # blue
color_3 = Color.FromArgb(0, 200, 80)      # green
color_4 = Color.FromArgb(200, 0, 200)     # magenta

color_list = [color_1, color_2, color_3, color_4]

colors = []

# start from module_index = 1 so we skip the root
for module_index, module in enumerate(tree.modules[1:], start=1):
    col = color_list[module_index % 4]
    for stick in module.sticks:
        colors.append(col)
# ---------- end python_3_script_9 ----------

draw_6 = COMPASDraw(cg=python_3_script_9.geometries)  # -> rg; disabled; same code as draw
draw_7 = COMPASDraw(cg=python_3_script_9.frames)  # -> rg; disabled; same code as draw
panel_12 = Panel(python_3_script_9.frames)
custom_preview_4 = CustomPreview(Geometry=draw_6, Material=python_3_script_9.colors)  # disabled

# ----
# 2x2 grid (2 modules connected on 1st iteration, 4 modules connected on 3rd iteration)
x_4 = Slider(2, range=0..10)  # disabled
y_4 = Slider(2, range=0..10)  # disabled
x_dist_3 = Slider(400, range=0..500)  # disabled
y_dist_3 = Slider(150, range=0..500)  # disabled
rotation_degree_3 = Slider(90, range=0..360)  # disabled
multiplication_2 = Multiplication(A=x_4, B=y_4)  # disabled
python_3_script_10 = Python3Script(x=multiplication_2)  # -> out, module_counts; inputs x: Int32; disabled; same code as python_3_script_4
panel_13 = Panel(python_3_script_10.module_counts)  # disabled
python_3_script_11 = Python3Script(x=x_4, y=y_4, x_dist=x_dist_3, y_dist=y_dist_3, rot=rotation_degree_3)  # -> out, points, planes; inputs x: Int32, y: Int32, x_dist: Int32, y_dist: Int32, rot: Int32; disabled; same code as python_3_script_8
offset_axis_x_z_4 = Slider(0, range=-100..100)  # disabled
offset_axis_b_y_4 = Slider(0, range=-100..100)  # disabled
module_count_5 = Slider(4, range=0..100)  # disabled
stick_index_5 = Slider(0, range=0..4)  # disabled
face_index_5 = Slider(1, range=0..3)  # disabled
rotation_5 = Slider(8, range=0..360)  # disabled
number_slider_3 = Slider(50, range=0..100)  # disabled
xy_plane_8 = XYPlane(Origin=Point(0, 0, 0))  # disabled
xy_plane_9 = XYPlane(Origin=Point(0, 0, 0))  # disabled
panel_14 = Panel("200")  # disabled
point_list_3 = PointList(Points=python_3_script_11.points, Size=number_slider_3)  # disabled
colour_swatch_5 = ColourSwatch(SwatchColor=RGB(201, 154, 83))  # disabled

# ----
# base code:
# stick_module_modified_frame
python_3_script_12 = Python3Script(
    root=python_3_script_11.planes,
    stick_length=panel_14,
    rot_angle=rotation_5,
    module_count=module_count_5,
    s_index=stick_index_5,
    f_index=face_index_5,
    offset_axis=offset_axis_x_z_4,
    offset_axis_b=offset_axis_b_y_4)  # -> out, colors, geometries, frames; inputs root: Plane, stick_length: Double, rot_angle: Int32, module_count: Int32, s_index: Int32, f_index: Int32, offset_axis: Int32, offset_axis_b: Double; disabled
# ---------- python_3_script_12: Python ----------
# r: compas>=2.14.1
# venv: sticks

import sys
import os
import math

#get current file path
path = ghenv.Component.OnPingDocument().FilePath
#get parent directory of the parent directory
parentdir = os.path.dirname(path)
#get src folder which contains classes
dire = os.path.join(parentdir,'group_one_scripts')

sys.path.append(dire)

from compas_rhino import unload_modules

unload_modules("group_one_sticks")
unload_modules("group_one_stick_module")
unload_modules("stick_module_modified_frame_Ruth_edit") 

import group_one_sticks
from group_one_sticks import Stick 
from stick_module_modified_frame_Ruth_edit import BranchStickModules, BranchStickModulesUpdates
from compas.geometry import Line, Point, Vector, Frame

stick_width = 10
stick_depth = 10    

from compas_rhino.conversions import plane_to_compas_frame, frame_to_rhino_plane

# Convert input to compas
root = plane_to_compas_frame(root)

# Initialize tree
tree = BranchStickModulesUpdates(root, stick_length, stick_width, stick_depth)


stick_pattern = [0,1,3,4]
face_pattern  = [2,0,3,1]

for i in range(module_count):
    from_module_index = i         
    from_stick_index  = stick_pattern[i % len(stick_pattern)]
    face_index        = face_pattern[i % len(face_pattern)]
    
    angle_for_this_module = i * rot_angle  # 0, 10, 20, 30,... if rot_angle=10

    tree.grow_module(
        offset_axis,
        offset_axis_b,
        from_module_index=from_module_index,
        from_stick_index=from_stick_index,
        face_index=face_index,
        angle=angle_for_this_module
    )
    print(i, "stick_index :", from_stick_index, "// face_index :", face_index, "// angle :", angle_for_this_module)

### skipping root sticks ###
frames = [stick.frame
          for module in tree.modules[1:]    # skip root
          for stick in module.sticks]

# Visualize
geometries = [stick.geometry
              for module in tree.modules[1:]    # skip root module
              for stick in module.sticks]





####   Color with 4 different color to understand the branching method   ####
from System.Drawing import Color

color_1 = Color.FromArgb(255, 100, 0)     # orange
color_2 = Color.FromArgb(0, 150, 255)     # blue
color_3 = Color.FromArgb(0, 200, 80)      # green
color_4 = Color.FromArgb(200, 0, 200)     # magenta

color_list = [color_1, color_2, color_3, color_4]

colors = []

# start from module_index = 1 so we skip the root
for module_index, module in enumerate(tree.modules[1:], start=1):
    col = color_list[module_index % 4]
    for stick in module.sticks:
        colors.append(col)
# ---------- end python_3_script_12 ----------

draw_8 = COMPASDraw(cg=python_3_script_12.geometries)  # -> rg; disabled; same code as draw
draw_9 = COMPASDraw(cg=python_3_script_12.frames)  # -> rg; disabled; same code as draw
panel_15 = Panel(python_3_script_12.frames)  # disabled
custom_preview_5 = CustomPreview(Geometry=draw_8, Material=python_3_script_12.colors)  # disabled

# ----
# 3 points extracted from a circle
number_slider_4 = Slider(7, range=0..1000)  # disabled
rotation_degree_4 = Slider(9, range=0..360)  # disabled
number_slider_5 = Slider(3, range=0..10)  # disabled
circle = Circle(Plane=PlaneXY(0, 0, 0), Radius=number_slider_4)  # disabled
python_3_script_13 = Python3Script(curve=circle, num_points=number_slider_5, rot=rotation_degree_4)  # -> out, points, planes; inputs curve: Curve, num_points: Int32, rot: Int32; disabled
# ---------- python_3_script_13: Python ----------
import Rhino.Geometry as rg
from math import radians

points = []
planes = []

length = curve.GetLength()
length_segments = curve.DivideByCount(num_points, True)

for l in length_segments:
    pt = curve.PointAt(l)
    points.append(pt)

    pl = rg.Plane(pt, rg.Vector3d.XAxis, rg.Vector3d.YAxis)

    angle = radians(l * rot)

    pl.Rotate(angle, pl.ZAxis, pl.Origin)
    planes.append(pl)

    print(pt)
# ---------- end python_3_script_13 ----------
number_slider_6 = Slider(50, range=0..100)  # disabled
offset_axis_x_z_5 = Slider(0, range=-100..100)  # disabled
offset_axis_b_y_5 = Slider(0, range=-100..100)  # disabled
module_count_6 = Slider(3, range=0..100)  # disabled
stick_index_6 = Slider(0, range=0..4)  # disabled
face_index_6 = Slider(1, range=0..3)  # disabled
rotation_6 = Slider(15, range=0..360)  # disabled
point_list_4 = PointList(Points=python_3_script_13.points, Size=number_slider_6)  # disabled
xy_plane_10 = XYPlane(Origin=Point(0, 0, 0))  # disabled
panel_16 = Panel("200")  # disabled
colour_swatch_6 = ColourSwatch(SwatchColor=RGB(201, 154, 83))  # disabled

# ----
# base code:
# stick_module_modified_frame
python_3_script_14 = Python3Script(
    root=python_3_script_13.planes,
    stick_length=panel_16,
    rot_angle=rotation_6,
    module_count=module_count_6,
    s_index=stick_index_6,
    f_index=face_index_6,
    offset_axis=offset_axis_x_z_5,
    offset_axis_b=offset_axis_b_y_5)  # -> out, colors, geometries, frames; inputs root: Plane, stick_length: Double, rot_angle: Int32, module_count: Int32, s_index: Int32, f_index: Int32, offset_axis: Int32, offset_axis_b: Double; disabled
# ---------- python_3_script_14: Python ----------
# r: compas>=2.14.1
# venv: sticks

import sys
import os
import math

#get current file path
path = ghenv.Component.OnPingDocument().FilePath
#get parent directory of the parent directory
parentdir = os.path.dirname(path)
#get src folder which contains classes
dire = os.path.join(parentdir,'group_one_scripts')

sys.path.append(dire)

from compas_rhino import unload_modules

unload_modules("group_one_sticks")
unload_modules("group_one_stick_module")
unload_modules("stick_module_modified_frame_Ruth_edit") 

import group_one_sticks
from group_one_sticks import Stick 
from stick_module_modified_frame_Ruth_edit import BranchStickModules, BranchStickModulesUpdates
from compas.geometry import Line, Point, Vector, Frame

stick_width = 10
stick_depth = 10    

from compas_rhino.conversions import plane_to_compas_frame, frame_to_rhino_plane

# Convert input to compas
root = plane_to_compas_frame(root)

# Initialize tree
tree = BranchStickModulesUpdates(root, stick_length, stick_width, stick_depth)


stick_pattern = [2,2,0,4]
face_pattern  = [0,0,0,3]

for i in range(module_count):
    from_module_index = i         
    from_stick_index  = stick_pattern[i % len(stick_pattern)]
    face_index        = face_pattern[i % len(face_pattern)]
    
    angle_for_this_module = i * rot_angle  # 0, 10, 20, 30,... if rot_angle=10

    tree.grow_module(
        offset_axis,
        offset_axis_b,
        from_module_index=from_module_index,
        from_stick_index=from_stick_index,
        face_index=face_index,
        angle=angle_for_this_module
    )
    print(i, "stick_index :", from_stick_index, "// face_index :", face_index, "// angle :", angle_for_this_module)

### skipping root sticks ###
frames = [stick.frame
          for module in tree.modules[1:]    # skip root
          for stick in module.sticks]

# Visualize
geometries = [stick.geometry
              for module in tree.modules[1:]    # skip root module
              for stick in module.sticks]





####   Color with 4 different color to understand the branching method   ####
from System.Drawing import Color

color_1 = Color.FromArgb(255, 100, 0)     # orange
color_2 = Color.FromArgb(0, 150, 255)     # blue
color_3 = Color.FromArgb(0, 200, 80)      # green
color_4 = Color.FromArgb(200, 0, 200)     # magenta

color_list = [color_1, color_2, color_3, color_4]

colors = []

# start from module_index = 1 so we skip the root
for module_index, module in enumerate(tree.modules[1:], start=1):
    col = color_list[module_index % 4]
    for stick in module.sticks:
        colors.append(col)
# ---------- end python_3_script_14 ----------

draw_10 = COMPASDraw(cg=python_3_script_14.geometries)  # -> rg; disabled; same code as draw
draw_11 = COMPASDraw(cg=python_3_script_14.frames)  # -> rg; disabled; same code as draw
panel_17 = Panel(python_3_script_14.frames)  # disabled
custom_preview_6 = CustomPreview(Geometry=draw_10, Material=python_3_script_14.colors)  # disabled

# ----
# sin curve
# 
# cuman 4 biji ajaaaaaa
# 
# COBA YAK
x_distance_2 = Slider(155, range=0..500)  # disabled
y_distance_2 = Slider(70, range=0..500)  # disabled
point_index_2 = Slider(8, range=0..100)  # disabled
x_5 = Slider(10, range=0..10)  # disabled
y_5 = Slider(10, range=0..10)  # disabled
rotation_degree_5 = Slider(5, range=0..360)  # disabled
python_3_script_15 = Python3Script(x=point_index_2)  # -> out, module_counts; inputs x: Int32; disabled; same code as python_3_script_4
panel_18 = Panel(python_3_script_15.module_counts)  # disabled
python_3_script_16 = Python3Script(x_dist=x_distance_2, y_dist=y_distance_2, loop_length=point_index_2, x=x_5, y=y_5, rot=rotation_degree_5)  # -> out, points, planes; inputs x_dist: Int32, y_dist: Int32, loop_length: Int32, x: Int32, y: Int32, rot: Int32; disabled; same code as python_3_script_5
offset_axis_x_z_6 = Slider(0, range=-100..100)  # disabled
offset_axis_b_y_6 = Slider(0, range=-100..100)  # disabled
module_count_7 = Slider(1, range=0..100)  # disabled
stick_index_7 = Slider(4, range=0..4)  # disabled
face_index_7 = Slider(1, range=0..3)  # disabled
rotation_7 = Slider(0, range=0..360)  # disabled
number_slider_7 = Slider(50, range=0..100)  # disabled
xy_plane_11 = XYPlane(Origin=Point(0, 0, 0))  # disabled
xy_plane_12 = XYPlane(Origin=Point(0, 0, 0))  # disabled
panel_19 = Panel("200")  # disabled
point_list_5 = PointList(Points=python_3_script_16.points, Size=number_slider_7)  # disabled
colour_swatch_7 = ColourSwatch(SwatchColor=RGB(201, 154, 83))  # disabled

# ----
# base code:
# stick_module_modified_frame
python_3_script_17 = Python3Script(
    root=python_3_script_16.planes,
    stick_length=panel_19,
    rot_angle=rotation_7,
    module_count=python_3_script_15.module_counts,
    s_index=stick_index_7,
    f_index=face_index_7,
    offset_axis=offset_axis_x_z_6,
    offset_axis_b=offset_axis_b_y_6)  # -> out, colors, geometries, frames; inputs root: Plane, stick_length: Double, rot_angle: Int32, module_count: Int32, s_index: Int32, f_index: Int32, offset_axis: Int32, offset_axis_b: Double; disabled; same code as python_3_script_6

draw_12 = COMPASDraw(cg=python_3_script_17.geometries)  # -> rg; disabled; same code as draw
draw_13 = COMPASDraw(cg=python_3_script_17.frames)  # -> rg; disabled; same code as draw
panel_20 = Panel(python_3_script_17.frames)  # disabled
custom_preview_7 = CustomPreview(Geometry=draw_12, Material=python_3_script_17.colors)  # disabled
