# Grasshopper definition 251216_module_c_bridging.gh (Grasshopper 1.0.8)

# ----
# SIN curve
x_distance = Slider(260, range=0..500)
x_distance_2 = Slider(240, range=0..500)
sin_curve_length = Slider(17, range=0..100)
python_3_script = Python3Script(x_dist=x_distance, y_dist=x_distance_2, loop_length=sin_curve_length)  # -> out, points; inputs x_dist: Int32, y_dist: Int32, loop_length: Int32
# ---------- python_3_script: Python ----------
import Rhino.Geometry as rg
from math import sin

points = []

for i in range (loop_length):
    pt = rg.Point3d(sin(i)*x_dist, i*y_dist, 0)
    points.append(pt)
# ---------- end python_3_script ----------

# ----
# Point-Grid
# try %2 move Z by self.depth
number_slider = Slider(3, range=0..15)
py3 = Python3Script(
    x_count=number_slider,
    y_count=Slider(4, range=0..15),
    x_space=Slider(300, range=0..1000),
    y_space=Slider(284, range=0..1000))  # -> out, points; inputs x_count: Int32, y_count: Int32, x_space: Double, y_space: Double
# ---------- py3: Python ----------
import Rhino.Geometry as rg

points = []
for i in range (x_count):
    for j in range (y_count):
        pt = rg.Point3d(i*x_space, j*y_space, 0)
        rg.Point3d()
        points.append(pt)
# ---------- end py3 ----------

# ----
# move this point
# to move structure
# (x, y, z)
pt = Point(Point(-628.5137852, 826.9327382, 0))

# ----
# base code:
# stick_module_modified_frame
rotation = Slider(90, range=0..360)
module_count = Slider(8, range=0..100)
stick_index = Slider(4, range=0..4)
face_index = Slider(2, range=0..3)
offset_z_axis = Slider(-1, range=-100..100)
module_index = Slider(0, range=0..30)
offset_x_axis = Slider(-5, range=-100..100)
offset_y_axis = Slider(0, range=-100..100)
xy_plane = XYPlane(Origin=pt)
python_3_script_2 = Python3Script(
    root=xy_plane,
    stick_length="200",
    rot_angle=rotation,
    module_count=module_count,
    m_index=module_index,
    s_index=stick_index,
    f_index=face_index,
    offset_xxis=offset_x_axis,
    offset_yxis=offset_y_axis,
    offset_zxis=offset_z_axis,
    output_frame=Slider(0, range=-2..4),
    stick_indx=Slider(3, range=0..4),
    face_idx=Slider(1, range=0..3))  # -> out, geometries, colors, frames, frame, sticks, axis, modules_C, faces; inputs root: Plane, stick_length: Double, rot_angle: Int32, module_count: Int32, m_index: Int32, s_index: Int32, f_index: Int32, offset_xxis: Int32, offset_yxis: Double, offset_zxis: Double, stick_indx: Int32, face_idx: Int32
# ---------- python_3_script_2: Python ----------
# r: compas>=2.14.1
# venv: sticks

import sys
import os
import math

#get current file path
path = ghenv.Component.OnPingDocument().FilePath
print (path)
#get parent directory of the parent directory
parentdir = os.path.dirname(path)
print (parentdir)
#get src folder which contains classes
dire = os.path.join(parentdir,'group_one_scripts')
print (dire)

sys.path.append(dire)

from compas_rhino import unload_modules
frames 
# unload_modules("group_one_sticks")
unload_modules("scripts")
unload_modules("group_one_scripts")
unload_modules("stick_module_modified_frame")


import Sticks
import stick_module_modified_frame
from Sticks import Stick 
from stick_module_modified_frame import BranchingModule, BranchStickModules
from compas.geometry import Line, Point, Vector, Frame, Rotation

stick_width = 13
stick_depth = 13    

from compas_rhino.conversions import plane_to_compas_frame, frame_to_rhino_plane

# Convert input to compas
root = plane_to_compas_frame(root)
# print(root)
# Initialize tree
tree = BranchStickModules(root, stick_length, width=stick_width, depth=stick_depth)
# Grow tree "def grow_stick(self, from_stick_index = -1, face_index = 0, angle = 0.0)""
# for i in range(x_count):
#     if i %2:
#         tree.grow_stick(from_stick_index = i, face_index = 2, angle = rot_angle)
#     else:
#         tree.grow_stick(from_stick_index = i, face_index = 2, angle = -rot_angle*i*factor)
modules_C = []

for i in range(module_count):
    mod = tree.grow_module( offset_xxis, offset_yxis, offset_zxis, from_module_index=i, from_stick_index=s_index, face_index=f_index, angle = rot_angle, move=output_frame)
    modules_C.append(mod)

    # k = tree.modules[i].sticks[s_index].frame
    # kframe.append(k)


# # Visualize
geometries = tree.visualize()
modules_C = tree.visualize()

 

####   Color with 4 different color to understand the branching method   ####
from System.Drawing import Color

color_1 = Color.FromArgb(255, 100, 0)     # orange
color_2 = Color.FromArgb(0, 150, 255)     # blue
color_3 = Color.FromArgb(0, 200, 80)      # green
color_4 = Color.FromArgb(200, 0, 200)     # magenta

color_list = [color_1, color_2, color_3, color_4]

colors = []

for module_index, module in enumerate(tree.modules):
    col = color_list[module_index % 4]

    for stick in module.sticks:
        colors.append(col)

faces = []
for i, module in enumerate (tree.modules):
    if stick_indx < len(module.sticks):
        stick = module.sticks[stick_indx]
        angle = face_idx * math.pi / 2
        R = Rotation.from_axis_and_angle(stick.frame.xaxis, angle=angle, point=stick.frame.point)
        face_frame = stick.frame.transformed(R)
        face_frame.point = stick.axis.midpoint
        # face_frame.point += face_frame.yaxis * stick.depth / 2
        if i % 2 == 0:
            faces.append(face_frame)

#frame = tree.sticks[0].frame
frame = tree.modules[0].sticks[0].frame

frames = [stick.frame for module in tree.modules for stick in module.sticks]
axis = [stick.axis for module in tree.modules for stick in module.sticks]
sticks = [stick for module in tree.modules for stick in module.sticks]
# ---------- end python_3_script_2 ----------
draw = COMPASDraw(cg=python_3_script_2.geometries)  # -> rg
#   port cg: The COMPAS geometry or datastructure to be drawn.
#   port rg: The Rhino geometry object.
# ---------- draw: Python ----------
# r: compas>=2.14.1
"""
Draws COMPAS geometry in Grasshopper.
"""

from typing import Any

import Grasshopper

from compas.scene import SceneObject


class CompasToRhinoGeometry(Grasshopper.Kernel.GH_ScriptInstance):
    def RunScript(self, cg):
        if not cg:
            return None

        return SceneObject(item=cg).draw()
# ---------- end draw ----------
draw_2 = COMPASDraw(cg=python_3_script_2.axis)  # -> rg; same code as draw
draw_3 = COMPASDraw(cg=python_3_script_2.modules_C)  # -> rg; same code as draw
colour_swatch = ColourSwatch(SwatchColor=RGBA(227, 173, 93, 212))
number_slider_2 = Slider(10, range=0..10)
custom_preview = CustomPreview(Geometry=draw, Material=python_3_script_2.colors)
midpt = CurveMiddle(Curve=draw_2)

# ----
# move this point
# to move structure
# (x, y, z)
pt_2 = Point(Point(-477.4590842, 1269.297927, 0))

# ----
# position of attractor: 2 = center
number_slider_3 = Slider(2, range=0..10)

# ----
# size rectangle
number_slider_4 = Slider(1000, range=0..1000)

# ----
# base code:
# stick_module_modified_frame
# json file
rotation_2 = Slider(90, range=0..360)
module_count_2 = Slider(8, range=0..100)
stick_index_2 = Slider(4, range=0..4)
face_index_2 = Slider(2, range=0..3)
module_index_2 = Slider(0, range=0..30)
offset_x_axis_2 = Slider(-5, range=-100..100)
offset_y_axis_2 = Slider(0, range=-100..100)
offset_z_axis_2 = Slider(-1, range=-100..100)
xy_plane_2 = XYPlane(Origin=pt_2)
prot = RotatePlane(Plane=xy_plane_2, Angle=Slider(2.2881, range=0..6.2831))
python_3_script_3 = Python3Script(
    root=prot,
    stick_length="200",
    rot_angle=rotation_2,
    module_count=module_count_2,
    m_index=module_index_2,
    s_index=stick_index_2,
    f_index=face_index_2,
    offset_xxis=offset_x_axis_2,
    offset_yxis=offset_y_axis_2,
    offset_zxis=offset_z_axis_2,
    output_frame=Slider(0, range=-2..4),
    stick_indx=Slider(4, range=0..4),
    face_idx=Slider(0, range=0..3))  # -> out, geometries, colors, frames, frame, sticks, axis, modules_C, faces; inputs root: Plane, stick_length: Double, rot_angle: Int32, module_count: Int32, m_index: Int32, s_index: Int32, f_index: Int32, offset_xxis: Int32, offset_yxis: Double, offset_zxis: Double, stick_indx: Int32, face_idx: Int32; same code as python_3_script_2
draw_4 = COMPASDraw(cg=python_3_script_3.geometries)  # -> rg; same code as draw
draw_5 = COMPASDraw(cg=python_3_script_3.modules_C)  # -> rg; same code as draw
colour_swatch_2 = ColourSwatch(SwatchColor=RGBA(227, 173, 93, 212))
draw_6 = COMPASDraw(cg=python_3_script_3.axis)  # -> rg; same code as draw
custom_preview_2 = CustomPreview(Geometry=draw_4, Material=python_3_script_3.colors)
midpt_2 = CurveMiddle(Curve=draw_6)
points = PointList(Points=midpt_2, Size=Slider(10, range=0..10))
py3_2 = Python3Script(sticks=python_3_script_3.sticks, save=Button())  # -> out, frames, assembly; inputs sticks: list, save: Boolean
# ---------- py3_2: Python ----------
from compas import json_dump
import os, sys
from itertools import combinations
from compas_rhino import unload_modules
from compas.geometry import Line, Plane, Vector, Point

#get current file path
path = ghenv.Component.OnPingDocument().FilePath
#get parent directory of the parent directory
parentdir = os.path.dirname(path)
#get src folder which contains classes
dire = os.path.join(parentdir,'group_one_scripts_send_to_robot')

sys.path.append(dire)
unload_modules("group_one_scripts_send_to_robot")
unload_modules("helpers")

from group_one_sticks import Stick 

from compas.datastructures import Assembly, Part

json_path = os.path.join(parentdir, 'data', 'stick_FJmod5_assembly.json') # file is safed where gh file is stored, from there it puts it in data folder

stick_width = 13.0
stick_depth = 13.0
stick_length = 200

sticks_data = []

###########################################################################
# Make frames point in best direction
###########################################################################
import math
import copy

from compas.geometry import dot_vectors, Rotation
from compas.geometry import centroid_points

def is_parallel(v1, v2):
    if math.isclose(dot_vectors(v1, v2), 1, abs_tol = 0.001) or math.isclose(dot_vectors(v1, v2), -1 ,abs_tol = 0.001):
        # Means it is parallel
        print("parallel")
        return True
    else:
        # Means it is not parallel
        print("not parallel")
        return False

def get_frame_closest_to_target(target_vector, stick):
    best_dot = -1000.0
    for i in range(4):
        angle = math.pi/2 * i
        R = Rotation.from_axis_and_angle(stick.frame.xaxis, angle, stick.frame.point)
        frame = stick.frame.transformed(R)
        dot = dot_vectors(frame.zaxis, target_vector.unitized())
        if dot>best_dot:
            best_dot = dot
            best_frame = frame
            print(i)
    return best_frame

def get_center(sticks_list):
    all_points = [stick.frame.point for stick in sticks_list]
    center = centroid_points(all_points)
    print(center)
    return center

# Copy sticks

sticks_copy = copy.deepcopy(sticks)
center_pt = get_center(sticks_copy)


for stick in sticks_copy:
    if is_parallel(stick.axis.direction.unitized(), Vector(0,0,1)):
        # Target frame is frame pointing into center of structure
        center_vector = Vector.from_start_end(stick.frame.point, center_pt)
        best_frame = get_frame_closest_to_target(center_vector, stick=stick)
        stick.frame = best_frame

    else:
        # Make sure z axis is pointing down
        R = Rotation.from_axis_and_angle(stick.frame.xaxis, math.pi/2, stick.frame.point)
        stick.frame.transform(R)


from helpers import sort_sticks_by_z

sticks_copy = sort_sticks_by_z(sticks_copy)
from compas_rhino.conversions import frame_to_rhino_plane

###########################################################################
# Make frames point in best direction
###########################################################################

assembly = Assembly()
for i, s in enumerate(sticks_copy):
    part_name = "stick"+ str(i)
    part = Part(name = part_name, frame = s.frame)
    part.key = i
    part.attributes["shape"] = s.geometry
    assembly.add_part(part)
    

frames = [frame_to_rhino_plane(p.frame) for p in assembly.parts()]

if save:
    json_dump(assembly, fp=json_path, pretty=True)
# ---------- end py3_2 ----------

# ----
# move this point
# to move structure
# (x, y, z)
# base code:
# stick_module_modified_frame
# json file
rotation_3 = Slider(120, range=0..360)  # disabled
stick_index_3 = Slider(4, range=0..4)  # disabled
module_count_3 = Slider(11, range=0..100)  # disabled
face_index_3 = Slider(1, range=0..3)  # disabled
pt_3 = Point(Point(-477.4590842, 1186.329238, 0))  # disabled
number_slider_5 = Slider(0, range=-2..4)  # disabled
number_slider_6 = Slider(4, range=0..4)  # disabled
module_index_3 = Slider(0, range=0..30)  # disabled
offset_x_axis_3 = Slider(0, range=-100..100)  # disabled
offset_z_axis_3 = Slider(3, range=-100..100)  # disabled
number_slider_7 = Slider(0, range=0..3)  # disabled
offset_y_axis_3 = Slider(0, range=-100..100)  # disabled
number_slider_8 = Slider(2.2881, range=0..6.2831)  # disabled
xz = XZPlane(Origin=pt_3)  # disabled
xy_plane_3 = XYPlane(Origin=pt_3)  # disabled
panel = Panel("200")  # disabled
prot_2 = RotatePlane(Plane=xy_plane_3, Angle=number_slider_8)  # disabled
python_3_script_4 = Python3Script(
    root=xz,
    stick_length=panel,
    rot_angle=rotation_3,
    module_count=module_count_3,
    m_index=module_index_3,
    s_index=stick_index_3,
    f_index=face_index_3,
    offset_xxis=offset_x_axis_3,
    offset_yxis=offset_y_axis_3,
    offset_zxis=offset_z_axis_3,
    output_frame=number_slider_5,
    stick_indx=number_slider_6,
    face_idx=number_slider_7)  # -> out, geometries, colors, frames, frame, sticks, axis, modules_C, faces; inputs root: Plane, stick_length: Double, rot_angle: Int32, module_count: Int32, m_index: Int32, s_index: Int32, f_index: Int32, offset_xxis: Int32, offset_yxis: Double, offset_zxis: Double, stick_indx: Int32, face_idx: Int32; disabled
# ---------- python_3_script_4: Python ----------
# r: compas>=2.14.1
# venv: sticks

import sys
import os
import math

#get current file path
path = ghenv.Component.OnPingDocument().FilePath
print (path)
#get parent directory of the parent directory
parentdir = os.path.dirname(path)
print (parentdir)
#get src folder which contains classes
dire = os.path.join(parentdir,'group_one_scripts')
print (dire)

sys.path.append(dire)

from compas_rhino import unload_modules
frames 
# unload_modules("group_one_sticks")
unload_modules("scripts")
unload_modules("group_one_scripts")
unload_modules("stick_module_modified_frame")


import Sticks
import stick_module_modified_frame
from Sticks import Stick 
from stick_module_modified_frame import BranchingModule, BranchStickModules
from compas.geometry import Line, Point, Vector, Frame, Rotation

stick_width = 13
stick_depth = 13    

from compas_rhino.conversions import plane_to_compas_frame, frame_to_rhino_plane

# Convert input to compas
root = plane_to_compas_frame(root)
# print(root)
# Initialize tree
tree = BranchStickModules(root, stick_length, width=stick_width, depth=stick_depth)
# Grow tree "def grow_stick(self, from_stick_index = -1, face_index = 0, angle = 0.0)""
# for i in range(x_count):
#     if i %2:
#         tree.grow_stick(from_stick_index = i, face_index = 2, angle = rot_angle)
#     else:
#         tree.grow_stick(from_stick_index = i, face_index = 2, angle = -rot_angle*i*factor)

modules_C = []

for i in range(module_count):
    mod = tree.grow_module( offset_xxis, offset_yxis, offset_zxis, from_module_index=i, from_stick_index=s_index, face_index=f_index, angle = rot_angle, move=output_frame)
    modules_C.append(mod)


for i in range(module_count+1):
    mod = tree.grow_module(-5, offset_yxis, offset_zxis, from_module_index=i, from_stick_index=3, face_index=2, angle = rot_angle, move=output_frame)
    modules_C.append(mod)

# for j in range (4):
#     for i in range(module_count*j):
#         if i > 12:
#             k = 4
#         else:
#             k = 3
#         mod = tree.grow_module(-5, offset_yxis, offset_zxis, from_module_index=i, from_stick_index=k, face_index=2, angle = rot_angle, move=output_frame)
#         modules_C.append(mod)



# # Visualize
geometries = tree.visualize()
modules_C = tree.visualize()

 

####   Color with 4 different color to understand the branching method   ####
from System.Drawing import Color

color_1 = Color.FromArgb(255, 100, 0)     # orange
color_2 = Color.FromArgb(0, 150, 255)     # blue
color_3 = Color.FromArgb(0, 200, 80)      # green
color_4 = Color.FromArgb(200, 0, 200)     # magenta

color_list = [color_1, color_2, color_3, color_4]

colors = []

for module_index, module in enumerate(tree.modules):
    col = color_list[module_index % 4]

    for stick in module.sticks:
        colors.append(col)

faces = []
for i, module in enumerate (tree.modules):
    if stick_indx < len(module.sticks):
        stick = module.sticks[stick_indx]
        angle = face_idx * math.pi / 2
        R = Rotation.from_axis_and_angle(stick.frame.xaxis, angle=angle, point=stick.frame.point)
        face_frame = stick.frame.transformed(R)
        face_frame.point = stick.axis.midpoint
        # face_frame.point += face_frame.yaxis * stick.depth / 2
        if i % 2 == 0:
            faces.append(face_frame)

#frame = tree.sticks[0].frame
frame = tree.modules[0].sticks[0].frame

frames = [stick.frame for module in tree.modules for stick in module.sticks]
axis = [stick.axis for module in tree.modules for stick in module.sticks]
sticks = [stick for module in tree.modules for stick in module.sticks]
# ---------- end python_3_script_4 ----------
draw_7 = COMPASDraw(cg=python_3_script_4.geometries)  # -> rg; disabled; same code as draw
draw_8 = COMPASDraw(cg=python_3_script_4.axis)  # -> rg; disabled; same code as draw
draw_9 = COMPASDraw(cg=python_3_script_4.modules_C)  # -> rg; disabled; same code as draw
colour_swatch_3 = ColourSwatch(SwatchColor=RGBA(227, 173, 93, 212))  # disabled
number_slider_9 = Slider(10, range=0..10)  # disabled
midpt_3 = CurveMiddle(Curve=draw_8)  # disabled
custom_preview_3 = CustomPreview(Geometry=draw_7, Material=python_3_script_4.colors)  # disabled
points_2 = PointList(Points=midpt_3, Size=number_slider_9)  # disabled
button = Button()  # disabled
py3_3 = Python3Script(sticks=python_3_script_4.sticks, save=button)  # -> out, frames, assembly; inputs sticks: list, save: Boolean; disabled; same code as py3_2

prot_3 = RotatePlane(Plane=xy_plane, Angle=Slider(0, range=0..6.2831))

# ----
# seed of population
number_slider_10 = Slider(21, range=0..100)

# ----
# point count
number_slider_11 = Slider(28, range=0..500)

# ----
# json file creator inkl HELPERS
button_2 = Button()
py3_4 = Python3Script(save=button_2)  # -> out, frames, assembly; inputs sticks: list, save: Boolean
# ---------- py3_4: Python ----------
from compas import json_dump
import os, sys
from itertools import combinations
from compas_rhino import unload_modules
from compas.geometry import Line, Plane, Vector, Point

#get current file path
path = ghenv.Component.OnPingDocument().FilePath
#get parent directory of the parent directory
parentdir = os.path.dirname(path)
#get src folder which contains classes
dire = os.path.join(parentdir,'group_one_scripts_send_to_robot')

sys.path.append(dire)
unload_modules("group_one_scripts_send_to_robot")
unload_modules("helpers")

from group_one_sticks import Stick 

from compas.datastructures import Assembly, Part

json_path = os.path.join(parentdir, 'data', 'stick_tilted_V2_assembly.json') # file is safed where gh file is stored, from there it puts it in data folder

stick_width = 13.0
stick_depth = 13.0
stick_length = 200

sticks_data = []

###########################################################################
# Make frames point in best direction
###########################################################################
import math
import copy

from compas.geometry import dot_vectors, Rotation
from compas.geometry import centroid_points

def is_parallel(v1, v2):
    if math.isclose(dot_vectors(v1, v2), 1, abs_tol = 0.001) or math.isclose(dot_vectors(v1, v2), -1 ,abs_tol = 0.001):
        # Means it is parallel
        #print("parallel")
        return True
    else:
        # Means it is not parallel
        #print("not parallel")
        return False

def get_frame_closest_to_target(target_vector, stick):
    best_dot = -1000.0
    for i in range(4):
        angle = math.pi/2 * i
        R = Rotation.from_axis_and_angle(stick.frame.xaxis, angle, stick.frame.point)
        frame = stick.frame.transformed(R)
        dot = dot_vectors(frame.zaxis, target_vector.unitized())
        if dot>best_dot:
            best_dot = dot
            best_frame = frame
            print(i)
    return best_frame

def get_center(sticks_list):
    all_points = [stick.frame.point for stick in sticks_list]
    center = centroid_points(all_points)
    # center_all = [c.translate(Vector(0,0,1)*-1) for c in center]
    # center.translate(Vector(0,0,1)*-1)
    #print(center)
    return center

# Copy sticks

sticks_copy = copy.deepcopy(sticks)
center_pt = get_center(sticks_copy)
print(center_pt)
center_point = Point[center_pt[0], center_pt[1], center_pt[2]]
center_point.translate(Vector(0,0,1)*-1)


for i,stick in enumerate(sticks_copy):
    if is_parallel(stick.axis.direction.unitized(), Vector(0,0,1)):
        # Target frame is frame pointing into center of structure
        center_vector = Vector.from_start_end(stick.frame.point, center_pt)
        best_frame = get_frame_closest_to_target(center_vector, stick=stick)
        stick.frame = best_frame

    else:
        # Make sure z axis is pointing down
        R = Rotation.from_axis_and_angle(stick.frame.xaxis, math.pi/2, stick.frame.point) #or erase /2
        stick.frame.transform(R)


from helpers import sort_sticks_by_z

sticks_copy = sort_sticks_by_z(sticks_copy)
from compas_rhino.conversions import frame_to_rhino_plane

###########################################################################
# Make frames point in best direction
###########################################################################

assembly = Assembly()
for i, s in enumerate(sticks_copy):
    part_name = "stick"+ str(i)
    part = Part(name = part_name, frame = s.frame)
    part.key = i
    part.attributes["shape"] = s.geometry
    assembly.add_part(part)
    

# frames = [frame_to_rhino_plane(p.frame) for p in assembly.parts()]
frames = [p.frame for p in assembly.parts()]



if save:
    json_dump(assembly, fp=json_path, pretty=True)
# ---------- end py3_4 ----------

# ----
# Pointcloud with Attractor
# attractor value
number_slider_12 = Slider(-0.44, range=-1..1)

division = Division(A=number_slider_4, B=number_slider_3)
rectangle = Rectangle(Plane=PlaneXY(0, 0, 0), XSize=number_slider_4, YSize=number_slider_4, Radius=0)  # -> Rectangle, Length
pt_4 = ConstructPoint(XCoordinate=division, YCoordinate=division, ZCoordinate=0)
pop2d = Populate2D(Region=rectangle.Rectangle, Count=number_slider_11, Seed=number_slider_10)
dist = Distance(PointA=pop2d, PointB=pt_4)
vec2pt = Vector2Pt(PointA=pt_4, PointB=pop2d, Unitize=False)  # -> Vector, Length
bnd = Bounds(Numbers=dist)
remap = RemapNumbers(Value=dist, Source=bnd, Target=number_slider_12)  # -> Mapped, Clipped
multiplication = Multiplication(A=vec2pt.Vector, B=remap.Mapped)
panel_2 = Panel(remap.Mapped)
move = Move(Geometry=pop2d, Motion=multiplication)  # -> Geometry, Transform

# ----
# Stick
# Numbers
points_3 = PointList(Points=midpt, Size=number_slider_2)

# ----
# json file
button_3 = Button()
py3_5 = Python3Script(sticks=python_3_script_2.sticks, save=button_3)  # -> out, frames, assembly; inputs sticks: list, save: Boolean; same code as py3_2

points_4 = PointList(Points=py3_5.frames, Size=number_slider_2)
py3_6 = Python3Script(frame=python_3_script_2.faces)  # -> out, planes
# ---------- py3_6: Python ----------
from compas.geometry import Frame

from compas_rhino.conversions import frame_to_rhino_plane

planes = frame_to_rhino_plane(frame)
# ---------- end py3_6 ----------
py3_7 = Python3Script(frame=python_3_script_3.faces)  # -> out, planes; same code as py3_6
pln = Plane(py3_6.planes)
pln_2 = Plane(py3_7.planes)
list = ValueList({"start": 0.1, "middle": 0.5, "end": 0.9}, selected="end")
py3_8 = Python3Script(
    frames_0=pln,
    frames_1=pln_2,
    bridge_length=Slider(634, range=0..1000),
    auto_best=Slider(1, range=1..64),
    bridge_A_start=list)  # -> all_frames, geometries, bridge_geoms, info_text, roll_plane, original_frame_0, original_frame_1, rotated_frame_0, rotated_frame_1; inputs frames_0: list, frames_1: list
# ---------- py3_8: Python ----------
# GH_Bridge_List.py - Grasshopper 64-config bridge component (List Input)
# r: compas>=2.14.1
# venv: sticks

import sys
import math
import Rhino.Geometry as rg

# Add your scripts folder (MUST BE THE SAME PATH AS YOUR OTHER SCRIPT)
scripts_path = r'C:\Users\frido\OneDrive\Dokumente\ETH_MAS_Architecture_Digital_Fabrication\Visual_Studio_Code\MAS-2526\08_SpatialAssemblies\StudentProjects\group_one\Scrypts_Shrey'
if scripts_path not in sys.path:
    sys.path.append(scripts_path)

from compas_rhino import unload_modules
unload_modules("Sticks_s")

# Import the necessary functions
from Sticks_s import stick_from_frame, bridge_sticks_euler_config, find_best_configuration
from compas_rhino.conversions import plane_to_compas_frame

# ============================================================================
# INPUTS (Grasshopper provides these)
# frames_0 - List of Planes (reference sticks)
# frames_1 - List of Planes (target sticks)
# length_0, length_1, bridge_length, config_id, auto_best (standard inputs)
# ============================================================================

# --- Initialize Output Lists ---
geometries = []
bridge_geoms = []
info_text = []

# --- Defaults and Type Conversions ---
if frames_0 is None or frames_1 is None:
    # Exit if lists are not provided
    print("Error: Two lists of frames are required.")
    geometries = []
    bridge_geoms = []
    info_text = ["Error: Missing input frames."]
    
# Defaults
if length_0 is None:
    length_0 = 100.0
if length_1 is None:
    length_1 = 100.0
if bridge_length is None:
    bridge_length = 100.0
if config_id is None:
    config_id = 1
if auto_best is None:
    auto_best = False
if width is None:
    width = 13.0
if depth is None:
    depth = 13.0
if bridge_A_start is None:
    bridge_A_start = 0.5
    
# Convert config_id to integer (Grasshopper sliders give floats)
config_id = int(config_id)

# --- Check list lengths ---
num_frames_0 = len(frames_0) if frames_0 else 0
num_frames_1 = len(frames_1) if frames_1 else 0

if num_frames_0 != num_frames_1:
    print(f"Warning: Frame lists have different lengths ({num_frames_0} vs {num_frames_1}). Bridging only up to the shortest list length.")

# Determine the number of pairs to process
num_pairs = min(num_frames_0, num_frames_1)

# --- Loop Through Frame Pairs ---
for i in range(num_pairs):
    center_frame_0 = frames_0[i]
    center_frame_1 = frames_1[i]
    
    # Convert Rhino Planes to Compas Frames
    frame_0 = plane_to_compas_frame(center_frame_0)
    frame_1 = plane_to_compas_frame(center_frame_1)
    
    # Create sticks
    stick_0 = stick_from_frame(frame_0, length_0, width, depth)
    stick_1 = stick_from_frame(frame_1, length_1, width, depth)
    
    # Select or auto-find configuration ID for this pair
    current_config_id = config_id
    if auto_best:
        current_config_id = find_best_configuration(stick_0, stick_1, criterion='min_angles')

    # Create bridges using the configuration
    bridges, info = bridge_sticks_euler_config(
        stick_0, stick_1, bridge_length, current_config_id, 
        width=width, depth=depth, 
        bridge_A_start=bridge_A_start,
        print_info=False # Set to False inside loop for clean output
    )

    # --- Append results for the current pair ---
    
    # Geometries (Original sticks + Bridges)
    geometries.append(stick_0.geometry)
    geometries.append(stick_1.geometry)
    current_bridge_geoms = [b.geometry for b in bridges]
    geometries.extend(current_bridge_geoms)
    bridge_geoms.extend(current_bridge_geoms)

    # Info Text
    info_line = f"""PAIR {i+1}: CONFIG {current_config_id}/{info.get('total_configs', 64)}
    Stick 0 Origin: ({frame_0.point.x:.1f}, {frame_0.point.y:.1f}, {frame_0.point.z:.1f})
    Stick 1 Origin: ({frame_1.point.x:.1f}, {frame_1.point.y:.1f}, {frame_1.point.z:.1f})
    Num Bridges: {info['num_bridges']} | ZYX Angles: Z={info['z_angle_deg']:.1f}°, Y={info['y_angle_deg']:.1f}°, X={info['x_angle_deg']:.1f}°
    """
    info_text.append(info_line)

# Clean up output lists if needed (for GH tree structure)
if num_pairs == 0:
    geometries = []
    bridge_geoms = []
    info_text = ["No bridge connections created (empty input list)."]
# ---------- end py3_8 ----------
draw_10 = COMPASDraw(cg=py3_8.geometries)  # -> rg; same code as draw
draw_11 = COMPASDraw(cg=py3_8.bridge_geoms)  # -> rg; same code as draw
