# Grasshopper definition 103_aggregation_sharon_2.gh (Grasshopper 1.0.8)

# ---- group: stick_branch_module
xy_plane = XYPlane(Origin=Point(0, 0, 0))
stick_branch_module = Python3Script(base_plane=xy_plane)  # -> out, module_out, module_frame_out
# ---------- stick_branch_module: Python ----------
# r: compas>=2.14.1
# venv: sticks

import sys
import os
import math

#get current file path
path = ghenv.Component.OnPingDocument().FilePath
print (path)
#get parent directory of the parent directory
parentdir = os.path.dirname(path)
print (parentdir)
#get src folder which contains classes
dire = os.path.join(parentdir,'scripts')
print (dire)

sys.path.append(dire)

from compas_rhino import unload_modules

unload_modules("Sticks_Single_1")
unload_modules("Sticks_Multiple_1")

from Sticks_Single_1 import Stick  
from Sticks_Multiple_1 import TiltedModule
from compas.geometry import Line, Point, Vector, Frame
from compas_rhino.conversions import plane_to_compas_frame, frame_to_rhino_plane

stick_width = 13.0
stick_depth = 13.0

# Convert input to compas
base_frame = plane_to_compas_frame(base_plane)

# Initialize tree
module = TiltedModule(base_frame = base_frame, root_angle = -25, stick_d_length = 235, stick_u_length = 263, width = stick_width, depth = stick_depth)

# Grow tree
module.grow_stick(face_index = 2, angle = 27)

# mirror sticks
module.mirror_stick(113)

# Visualize
module_out = module.visualize()
module_frame_out = [stick.frame for stick in module.sticks]
# ---------- end stick_branch_module ----------
draw = COMPASDraw(cg=stick_branch_module.module_frame_out)  # -> rg
#   port cg: The COMPAS geometry or datastructure to be drawn.
#   port rg: The Rhino geometry object.
# ---------- draw: Python ----------
# r: compas>=2.14.1
"""
Draws COMPAS geometry in Grasshopper.
"""

from typing import Any

import Grasshopper

from compas.scene import SceneObject


class CompasToRhinoGeometry(Grasshopper.Kernel.GH_ScriptInstance):
    def RunScript(self, cg):
        if not cg:
            return None

        return SceneObject(item=cg).draw()
# ---------- end draw ----------
draw_2 = COMPASDraw(cg=stick_branch_module.module_out)  # -> rg; same code as draw
vec_display = Cluster(pln=draw, num=30)

# ----
# Frame-based Class: Stick
pt = Point(Point(131.4515182, -575.0679293, 0))
xy = XYPlane(Origin=pt)
yz = YZPlane(Origin=pt)
xz = XZPlane(Origin=pt)
rotate = Rotate(Geometry=xy, Angle=degrees(Slider(37, range=0..180)), Plane=xz)  # -> Geometry, Transform
pln = Plane(rotate.Geometry)
cluster = Cluster(pln=pln, num=30)
py3 = Python3Script(first_pln=pln, length=Slider(230, range=0..1000), face_index=Slider(0, range=0..10), t=Slider(0.477, range=0..1))  # -> out, axis_out, stick_out, midframe_out, evalframe_out, corner_out; inputs first_pln: Plane, length: Double, face_index: Int32, t: Double
# ---------- py3: Python ----------
#locate stick class file in the same folder
from compas_rhino import unload_modules
import sys
import os

#get current file path
path = ghenv.Component.OnPingDocument().FilePath
#get parent directory of the parent directory
parentdir = os.path.dirname(path)
#get src folder which contains classes
dire = os.path.join(parentdir,'scripts')

sys.path.append(dire)


unload_modules('Sticks_Jerry_v1')
unload_modules('Sticks_Jerry_v2')

from Sticks_Jerry_v1 import Stick
from Sticks_Jerry_v2 import SingleStickAggregation
from compas.geometry import Line, Point, Vector
from compas.geometry import Transformation
from compas_rhino.conversions import plane_to_compas_frame, frame_to_rhino_plane
import random

"""Main Code"""
first_pln = plane_to_compas_frame(first_pln)
stick = Stick(first_pln, length)

axis = stick.axis
geo = stick.geometry
midframe = stick.midframe
evalframe = stick.eval_frame(face_index, t)
# corners = stick.corners
# Output
axis_out = axis
stick_out = geo
midframe_out = frame_to_rhino_plane(midframe)
evalframe_out = frame_to_rhino_plane(evalframe)
# corner_out = corners
# ---------- end py3 ----------
draw_3 = COMPASDraw(cg=py3.axis_out)  # -> rg; same code as draw
draw_4 = COMPASDraw(cg=py3.stick_out)  # -> rg; same code as draw
draw_5 = COMPASDraw(cg=py3.corner_out)  # -> rg; same code as draw
pln_2 = Plane(py3.evalframe_out)
pln_3 = Plane(py3.midframe_out)
cluster_2 = Cluster(pln=pln_3, num=30)
cluster_3 = Cluster(pln=pln_2, num=30)

# ----
# Frame-based Aggregation by Random Value
pt_2 = Point(Point(-186.0594048, -107.2522057, 0))  # disabled
number_slider = Slider(90, range=0..180)  # disabled
xy_2 = XYPlane(Origin=pt_2)  # disabled
yz_2 = YZPlane(Origin=pt_2)  # disabled
xz_2 = XZPlane(Origin=pt_2)  # disabled
rotate_2 = Rotate(Geometry=xy_2, Angle=degrees(number_slider), Plane=xz_2)  # -> Geometry, Transform; disabled
number_slider_2 = Slider(23, range=0..100)  # disabled
number_slider_3 = Slider(1, range=0..10)  # disabled
number_slider_4 = Slider(34, range=0..100)  # disabled
number_slider_5 = Slider(216, range=0..1000)  # disabled
number_slider_6 = Slider(0, range=0..180)  # disabled
list = ValueList({"Regular": 0, "Random": 1}, selected="Random")  # disabled
pln_4 = Plane(rotate_2.Geometry)  # disabled
cluster_4 = Cluster(pln=pln_4, num=30)  # disabled
py3_2 = Python3Script(
    first_pln=pln_4,
    length=number_slider_5,
    seed=number_slider_4,
    agg_type=list,
    agg_count=number_slider_2,
    angle=number_slider_6)  # -> out, stick_out, axis_out, plane_out, from_pln_out, to_pln_out; inputs first_pln: Plane, length: Double, seed: Int32, agg_type: Int32, agg_count: Int32, angle: Double; disabled
# ---------- py3_2: Python ----------
#locate stick class file in the same folder
from compas_rhino import unload_modules
import sys
import os

#get current file path
path = ghenv.Component.OnPingDocument().FilePath
#get parent directory of the parent directory
parentdir = os.path.dirname(path)
#get src folder which contains classes
dire = os.path.join(parentdir,'scripts')

sys.path.append(dire)


unload_modules('J3RRY_Stick_v2')
unload_modules('Sticks')

from Sticks import Stick
from J3RRY_Stick_v2 import JStickAggregation
from compas.geometry import Line, Point, Vector
from compas.geometry import Transformation
from compas_rhino.conversions import plane_to_compas_frame, frame_to_rhino_plane

import random


"""Main Code"""
# Convert rhino plane to compas frame
first_pln = plane_to_compas_frame(first_pln)
agg = JStickAggregation(first_pln, length, agg_type, seed)


# Aggregation
for i in range(agg_count):
    # angle = random.uniform(0, 180)
    agg.spawn_next_stick_random(angle, seed)


# Output
stick_out = agg.visualize()
axis_out = agg.axes
plane_out = [frame_to_rhino_plane(f) for f in agg.frames]
from_pln_out = [frame_to_rhino_plane(f) for f in agg.from_frames]
to_pln_out = [frame_to_rhino_plane(f) for f in agg.to_frames]
# ---------- end py3_2 ----------
draw_6 = COMPASDraw(cg=py3_2.stick_out)  # -> rg; disabled; same code as draw
draw_7 = COMPASDraw(cg=py3_2.axis_out)  # -> rg; disabled; same code as draw
pln_5 = Plane(py3_2.plane_out)  # disabled
pln_6 = Plane(py3_2.from_pln_out)  # disabled
pln_7 = Plane(py3_2.to_pln_out)  # disabled
number_slider_7 = Slider(10, range=0..10)  # disabled
lng = ListLength(List=draw_6)  # disabled
cluster_5 = Cluster(pln=pln_5, num=30)  # disabled
cluster_6 = Cluster(pln=pln_6, num=30)  # disabled
cluster_7 = Cluster(pln=pln_7, num=30)  # disabled
midpt = CurveMiddle(Curve=draw_7)  # disabled
series = Series(Start=0, Step=1, Count=lng)  # disabled
points = PointList(Points=midpt, Size=number_slider_7)  # disabled
gradient = Gradient(
    LowerLimit=0,
    UpperLimit=expr("x-1", lng),
    Parameter=series,
    stops=[0: RGB(80, 55, 25), 0.5: RGB(159, 65, 29), 1: RGB(174, 166, 129)])  # disabled
preview = CustomPreview(Geometry=draw_6, Material=gradient)  # disabled

# ----
# Frame-based Aggregation by Face Index and T Value
pt_3 = Point(Point(131.4515182, -575.0679293, 0))  # disabled
number_slider_8 = Slider(70, range=0..180)  # disabled
xy_3 = XYPlane(Origin=pt_3)  # disabled
yz_3 = YZPlane(Origin=pt_3)  # disabled
xz_3 = XZPlane(Origin=pt_3)  # disabled
rotate_3 = Rotate(Geometry=xy_3, Angle=degrees(number_slider_8), Plane=xz_3)  # -> Geometry, Transform; disabled
number_slider_9 = Slider(0, range=0..10)  # disabled
number_slider_10 = Slider(3, range=0..10)  # disabled
number_slider_11 = Slider(4, range=0..100)  # disabled
number_slider_12 = Slider(0.142, range=0..1)  # disabled
number_slider_13 = Slider(0.374, range=0..1)  # disabled
number_slider_14 = Slider(230, range=0..1000)  # disabled
number_slider_15 = Slider(120, range=0..180)  # disabled
pln_8 = Plane(rotate_3.Geometry)  # disabled
cluster_8 = Cluster(pln=pln_8, num=30)  # disabled
py3_3 = Python3Script(
    first_pln=pln_8,
    length=number_slider_14,
    agg_count=number_slider_11,
    angle=number_slider_15,
    from_face_index=number_slider_9,
    to_face_index=number_slider_10,
    from_t=number_slider_12,
    to_t=number_slider_13)  # -> out, stick_out, axis_out, plane_out, from_pln_out, to_pln_out; inputs first_pln: Plane, length: Double, agg_count: Int32, angle: Double, from_face_index: Int32, to_face_index: Int32, from_t: Double, to_t: Double; disabled
# ---------- py3_3: Python ----------
#locate stick class file in the same folder
from compas_rhino import unload_modules
import sys
import os

#get current file path
path = ghenv.Component.OnPingDocument().FilePath
#get parent directory of the parent directory
parentdir = os.path.dirname(path)
#get src folder which contains classes
dire = os.path.join(parentdir,'scripts')

sys.path.append(dire)

unload_modules('Sticks_Jerry_v1')
unload_modules('Sticks_Jerry_v2')

from Sticks_Jerry_v1 import Stick
from Sticks_Jerry_v2 import SingleStickAggregation
from compas.geometry import Line, Point, Vector
from compas.geometry import Transformation
from compas_rhino.conversions import plane_to_compas_frame, frame_to_rhino_plane
import random


"""Main Code"""
# Convert rhino plane to compas frame
first_pln = plane_to_compas_frame(first_pln)

# Aggregation
agg = SingleStickAggregation(first_pln, length)
for i in range(agg_count):
    # angle = random.uniform(0, 180)
    agg.spawn_next_stick(angle, from_face_index, from_t, to_face_index, to_t)


# Output
stick_out = agg.visualize()
axis_out = agg.axes
plane_out = [frame_to_rhino_plane(f) for f in agg.new_frames]
from_pln_out = [frame_to_rhino_plane(f) for f in agg.from_frames]
to_pln_out = [frame_to_rhino_plane(f) for f in agg.to_frames]
# ---------- end py3_3 ----------
draw_8 = COMPASDraw(cg=py3_3.stick_out)  # -> rg; disabled; same code as draw
draw_9 = COMPASDraw(cg=py3_3.axis_out)  # -> rg; disabled; same code as draw
pln_9 = Plane(py3_3.plane_out)  # disabled
pln_10 = Plane(py3_3.from_pln_out)  # disabled
pln_11 = Plane(py3_3.to_pln_out)  # disabled
number_slider_16 = Slider(10, range=0..10)  # disabled
midpt_2 = CurveMiddle(Curve=draw_9)  # disabled
cluster_9 = Cluster(pln=pln_9, num=30)  # disabled
cluster_10 = Cluster(pln=pln_10, num=30)  # disabled
cluster_11 = Cluster(pln=pln_11, num=30)  # disabled
preview_2 = CustomPreview(
    Geometry=draw_8,
    Material={diffuse=RGB(221, 160, 221), emission=RGB(66, 48, 66), shine=0.5, specular=RGB(255, 255, 255), transparency=0})  # disabled
points_2 = PointList(Points=midpt_2, Size=number_slider_16)  # disabled

# ---- group: stick_branch_module
xy_plane_2 = XYPlane(Origin=Point(0, 0, 0))  # disabled
stick_branch_module_2 = Python3Script(base_plane=xy_plane_2)  # -> out, module_out, module_frame_out; disabled; same code as stick_branch_module
draw_10 = COMPASDraw(cg=stick_branch_module_2.module_out)  # -> rg; disabled; same code as draw
draw_11 = COMPASDraw(cg=stick_branch_module_2.module_frame_out)  # -> rg; disabled; same code as draw
vec_display_2 = Cluster(pln=draw_11, num=30)  # disabled

# ----
# Frame-based Aggregation by Face Index and T Value
pt_4 = ConstructPoint(XCoordinate=0, YCoordinate=0, ZCoordinate=0)
pt_5 = Point(pt_4)
xy_4 = XYPlane(Origin=pt_5)
xz_4 = XZPlane(Origin=pt_5)
rotate_4 = Rotate(Geometry=xy_4, Angle=degrees(Slider(30, range=0..180)), Plane=xz_4)  # -> Geometry, Transform
pln_12 = Plane(rotate_4.Geometry)
vec_display_3 = Cluster(pln=pln_12, num=30)
py3_4 = Python3Script(
    first_pln=pln_12,
    length=Slider(230, range=0..1000),
    agg_times=Slider(4, range=0..10),
    angle=Slider(120, range=0..180),
    from_face_index=Slider(0, range=0..100),
    to_face_index=Slider(3, range=0..10),
    from_t=Slider(0.125, range=0..1),
    to_t=Slider(0.275, range=0..1))  # -> out, sticks_out, axes_out, new_primitive_plns_out, from_plns_out, to_plns_out; inputs first_pln: Plane, length: Int32, agg_times: Int32, angle: Double, from_face_index: Int32, to_face_index: Int32, from_t: Double, to_t: Double
# ---------- py3_4: Python ----------
#locate stick class file in the same folder
from compas_rhino import unload_modules
import sys
import os

#get current file path
path = ghenv.Component.OnPingDocument().FilePath
#get parent directory of the parent directory
parentdir = os.path.dirname(path)
#get src folder which contains classes
dire = os.path.join(parentdir,'scripts')

sys.path.append(dire)

unload_modules('Sticks_Jerry_v1')
unload_modules('Sticks_Jerry_v2_3')

from Sticks_Jerry_v1 import Stick
from Sticks_Jerry_v2_3 import SingleStickAggregation
from compas_rhino.conversions import plane_to_compas_frame, frame_to_rhino_plane

"""Main Code"""
# Convert rhino frame to compas frame
first_pln = plane_to_compas_frame(first_pln)

# Aggregation
agg_stick = SingleStickAggregation(first_frame=first_pln, length=length, aggregation_type=0)
for i in range(agg_times):
    agg_stick.compute_next_stick_regular(angle=angle, from_index=from_face_index, from_t=from_t, to_index=to_face_index, to_t=to_t)

# Output
sticks_out = agg_stick.visualize()
axes_out = agg_stick.axes
new_primitive_plns_out = [frame_to_rhino_plane(f) for f in agg_stick.new_frames]
from_plns_out = [frame_to_rhino_plane(f) for f in agg_stick.from_frames]
to_plns_out = [frame_to_rhino_plane(f) for f in agg_stick.to_frames]
# ---------- end py3_4 ----------
draw_12 = COMPASDraw(cg=py3_4.sticks_out)  # -> rg; same code as draw
draw_13 = COMPASDraw(cg=py3_4.axes_out)  # -> rg; same code as draw
pln_13 = Plane(py3_4.from_plns_out)
pln_14 = Plane(py3_4.new_primitive_plns_out)
pln_15 = Plane(py3_4.to_plns_out)
vec_display_4 = Cluster(pln=pln_14, num=30)
vec_display_5 = Cluster(pln=pln_13, num=30)
vec_display_6 = Cluster(pln=pln_15, num=30)
preview_3 = CustomPreview(
    Geometry=draw_12,
    Material={diffuse=RGB(221, 160, 221), emission=RGB(66, 48, 66), shine=0.5, specular=RGB(255, 255, 255), transparency=0})
midpt_3 = CurveMiddle(Curve=draw_13)
points_3 = PointList(Points=midpt_3, Size=Slider(10, range=0..10))

# ---- group: stick_module_aggregation
pt_6 = ConstructPoint(XCoordinate=0, YCoordinate=0, ZCoordinate=0)  # disabled
number_slider_17 = Slider(90, range=0..100)  # disabled
xy_5 = XYPlane(Origin=pt_6)  # disabled
xz_5 = XZPlane(Origin=Point(0, 0, 0))  # disabled
rot3d = Rotate3D(Geometry=xy_5, Angle=degrees(number_slider_17), Center=Point(0, 0, 0), Axis=xz_5)  # -> Geometry, Transform; disabled

pt_7 = ConstructPoint(XCoordinate=0, YCoordinate=0, ZCoordinate=0)
xy_6 = XYPlane(Origin=pt_7)
xz_6 = XZPlane(Origin=Point(0, 0, 0))
rot3d_2 = Rotate3D(Geometry=xy_6, Angle=degrees(Slider(90, range=0..100)), Center=Point(0, 0, 0), Axis=xz_6)  # -> Geometry, Transform

number_slider_18 = Slider(2, range=0..10)  # disabled
number_slider_19 = Slider(0, range=0..10)  # disabled
number_slider_20 = Slider(3, range=0..10)  # disabled
number_slider_21 = Slider(1, range=0..10)  # disabled
number_slider_22 = Slider(0.125, range=0..1)  # disabled
number_slider_23 = Slider(27, range=0..180)  # disabled
number_slider_24 = Slider(0.275, range=0..1)  # disabled
stick_module_aggregation = Python3Script(
    base_plane=rot3d.Geometry,
    agg_times=number_slider_21,
    angle=number_slider_23,
    ref_stick_index=number_slider_18,
    from_face_index=number_slider_19,
    to_face_index=number_slider_20,
    from_t=number_slider_22,
    to_t=number_slider_24)  # -> out, module_out, geo, module_frame_out; inputs agg_times: Int32, angle: Double, ref_stick_index: Int32, from_face_index: Int32, to_face_index: Int32, from_t: Double, to_t: Double; disabled
# ---------- stick_module_aggregation: Python ----------
# r: compas>=2.14.1
# venv: sticks

import sys
import os
import math

#get current file path
path = ghenv.Component.OnPingDocument().FilePath
print (path)
#get parent directory of the parent directory
parentdir = os.path.dirname(path)
print (parentdir)
#get src folder which contains classes
dire = os.path.join(parentdir,'scripts')
print (dire)

sys.path.append(dire)

from compas_rhino import unload_modules

unload_modules("Sticks_Single_1")
unload_modules("Sticks_Multiple_1")
unload_modules("Sticks_Aggregation_1")

from Sticks_Single_1 import Stick  
from Sticks_Multiple_1 import TiltedModule
from Sticks_Aggregation_1 import ModuleAggregation
from compas.geometry import Line, Point, Vector, Frame
from compas_rhino.conversions import plane_to_compas_frame, frame_to_rhino_plane

stick_width = 13.0
stick_depth = 13.0
stick_d_length = 235
stick_u_length = 263

# Convert input to compas
base_frame = plane_to_compas_frame(base_plane)

# Initialize tree
# module_unit = TiltedModule(base_frame = base_frame, root_angle = -25, stick_d_length = 235, stick_u_length = 263, width = stick_width, depth = stick_depth)
module_unit = TiltedModule(base_frame = base_frame, root_angle = 25, stick_d_length = 235, stick_u_length = 263, width = stick_width, depth = stick_depth)

# Grow tree
module_unit.grow_stick(length = stick_u_length, from_stick_index = -1, face_index = 2, angle = 27)
module_unit.grow_shorter_stick(length = stick_d_length, from_stick_index = 0, face_index = 3, angle = 50)
module_unit.grow_longer_stick(length = stick_u_length, from_stick_index = 2, face_index = 1, angle = 27)

# Visualize
module_out = module_unit.visualize()
module_frame_out = [stick.frame for stick in module_unit.sticks]

# Aggregation
# 1. build first module
module_agg = module_unit
# print("first module stick count =", len(module_agg.sticks))

# 2. build ModuleAggregation
agg = ModuleAggregation(first_module=module_agg)
for i in range(agg_times):



# 3. generate the next module（用上一組第2根，取面1的 t=0.5、面2 的 t=0.75）
    # agg.compute_next_module(ref_stick_index=2,
    #                         from_face_index=1, from_t=0.5,
    #                         to_face_index=2,   to_t=0.75,
    #                         angle=35,
    #                         stick_length=235)
    agg.compute_next_module(ref_stick_index=ref_stick_index,
                            from_face_index=from_face_index, from_t=from_t,
                            to_face_index=to_face_index,   to_t=to_t,
                            angle=angle,
                            stick_length=235)

# 4. output geometry
geo = agg.visualize()
# ---------- end stick_module_aggregation ----------
draw_14 = COMPASDraw(cg=stick_module_aggregation.module_frame_out)  # -> rg; disabled; same code as draw
draw_15 = COMPASDraw(cg=stick_module_aggregation.geo)  # -> rg; disabled; same code as draw
draw_16 = COMPASDraw(cg=stick_module_aggregation.module_out)  # -> rg; disabled; same code as draw
preview_4 = CustomPreview(
    Geometry=draw_15,
    Material={diffuse=RGB(221, 160, 221), emission=RGB(66, 48, 66), shine=0.5, specular=RGB(255, 255, 255), transparency=0})  # disabled
vec_display_7 = Cluster(pln=draw_14, num=30)  # disabled

stick_module_aggregation_2 = Python3Script(
    base_plane=rot3d_2.Geometry,
    agg_times=Slider(0, range=0..10),
    angle=Slider(76, range=0..180),
    ref_stick_index=Slider(1, range=0..10),
    from_face_index=Slider(2, range=0..10),
    to_face_index=Slider(0, range=0..10),
    from_t=Slider(0.2, range=0..1),
    to_t=Slider(0.45, range=0..1))  # -> out, module_out, geo, module_frame_out; inputs agg_times: Int32, angle: Double, ref_stick_index: Int32, from_face_index: Int32, to_face_index: Int32, from_t: Double, to_t: Double
# ---------- stick_module_aggregation_2: Python ----------
# r: compas>=2.14.1
# venv: sticks

import sys
import os
import math

#get current file path
path = ghenv.Component.OnPingDocument().FilePath
print (path)
#get parent directory of the parent directory
parentdir = os.path.dirname(path)
print (parentdir)
#get src folder which contains classes
dire = os.path.join(parentdir,'scripts')
print (dire)

sys.path.append(dire)

from compas_rhino import unload_modules

unload_modules("Sticks_Single_1")
unload_modules("Sticks_Multiple_1")
unload_modules("Sticks_Aggregation_1")

from Sticks_Single_1 import Stick  
from Sticks_Multiple_1 import TiltedModule
from Sticks_Aggregation_1 import ModuleAggregation
from compas.geometry import Line, Point, Vector, Frame
from compas_rhino.conversions import plane_to_compas_frame, frame_to_rhino_plane

stick_width = 13.0
stick_depth = 13.0
stick_d_length = 235
stick_u_length = 263

# Convert input to compas
base_frame = plane_to_compas_frame(base_plane)

# Initialize tree
# module_unit = TiltedModule(base_frame = base_frame, root_angle = -25, stick_d_length = 235, stick_u_length = 263, width = stick_width, depth = stick_depth)
module_unit = TiltedModule(base_frame = base_frame, root_angle = 25, stick_d_length = 235, stick_u_length = 263, width = stick_width, depth = stick_depth)

# Grow tree
module_unit.grow_stick(length = stick_u_length, from_stick_index = -1, face_index = 2, angle = 27)
module_unit.grow_shorter_stick(length = stick_d_length, from_stick_index = 0, face_index = 3, angle = 50)
module_unit.grow_longer_stick(length = stick_u_length, from_stick_index = 2, face_index = 1, angle = 27)

# Visualize
module_out = module_unit.visualize()
module_frame_out = [stick.frame for stick in module_unit.sticks]

# Aggregation
# 1. build first module
module_agg = module_unit
# print("first module stick count =", len(module_agg.sticks))

# 2. build ModuleAggregation
agg = ModuleAggregation(first_module=module_agg)
for i in range(agg_times):



# 3. generate the next module（用上一組第2根，取面1的 t=0.5、面2 的 t=0.75）
    agg.compute_next_module(ref_stick_index=ref_stick_index,
                            from_face_index=from_face_index, from_t=from_t,
                            to_face_index=to_face_index,   to_t=to_t,
                            angle=angle)

# 4. output geometry
geo = agg.visualize()
# ---------- end stick_module_aggregation_2 ----------
draw_17 = COMPASDraw(cg=stick_module_aggregation_2.module_frame_out)  # -> rg; same code as draw
draw_18 = COMPASDraw(cg=stick_module_aggregation_2.geo)  # -> rg; same code as draw
draw_19 = COMPASDraw(cg=stick_module_aggregation_2.module_out)  # -> rg; same code as draw
preview_5 = CustomPreview(
    Geometry=draw_18,
    Material={diffuse=RGB(221, 160, 221), emission=RGB(66, 48, 66), shine=0.5, specular=RGB(255, 255, 255), transparency=0})
vec_display_8 = Cluster(pln=draw_17, num=30)

# ----
debrep = DeconstructBrep(Brep=draw_15)  # -> Faces, Edges, Vertices; disabled
debrep_2 = DeconstructBrep(Brep=draw_18)  # -> Faces, Edges, Vertices
item = ListItem(List=debrep.Edges, Index=0, Wrap=True)  # disabled
item_2 = ListItem(List=debrep_2.Edges, Index=0, Wrap=True)
item_3 = ListItem(List=draw_18, Index=Slider(3, range=0..3), Wrap=True)
len = Length(Curve=item)  # -> flatten(Length); disabled
len_2 = Length(Curve=item_2)  # -> flatten(Length)
debrep_3 = DeconstructBrep(Brep=item_3)  # -> Faces, Edges, Vertices
panel = Panel(len)  # disabled
panel_2 = Panel(len_2)
area = Area(Geometry=debrep_3.Faces)  # -> Area, Centroid
points_4 = PointList(Points=area.Centroid, Size=Slider(10, range=0..10))

# ---- group: stick_module_aggregation
pt_8 = ConstructPoint(XCoordinate=0, YCoordinate=0, ZCoordinate=0)
xy_7 = XYPlane(Origin=pt_8)
xz_7 = XZPlane(Origin=Point(0, 0, 0))
rot3d_3 = Rotate3D(Geometry=xy_7, Angle=degrees(Slider(90, range=0..100)), Center=Point(0, 0, 0), Axis=xz_7)  # -> Geometry, Transform

stick_module_aggregation_3 = Python3Script(
    base_plane=rot3d_3.Geometry,
    agg_times=Slider(1, range=0..10),
    from_stick_index=Slider(1, range=0..3),
    from_face_index=Slider(1, range=0..3),
    from_t=Slider(0, range=0..1),
    to_stick_index=Slider(1, range=0..3),
    to_face_index=Slider(1, range=0..3),
    to_t=Slider(0, range=0..1),
    angle=Slider(0, range=0..180))  # -> out, module_out, geo, module_frame_out; inputs agg_times: Int32, from_stick_index: Int32, from_face_index: Int32, from_t: Double, to_stick_index: Int32, to_face_index: Int32, to_t: Double, angle: Double
# ---------- stick_module_aggregation_3: Python ----------
# r: compas>=2.14.1
# venv: sticks

import sys
import os
import math

#get current file path
path = ghenv.Component.OnPingDocument().FilePath
print (path)
#get parent directory of the parent directory
parentdir = os.path.dirname(path)
print (parentdir)
#get src folder which contains classes
dire = os.path.join(parentdir,'scripts')
print (dire)

sys.path.append(dire)

from compas_rhino import unload_modules

unload_modules("Sticks_Single_1")
unload_modules("Sticks_Multiple_1")
unload_modules("Sticks_Aggregation_2")

from Sticks_Single_1 import Stick  
from Sticks_Multiple_1 import TiltedModule
from Sticks_Aggregation_2 import ModuleAggregation
from compas.geometry import Line, Point, Vector, Frame
from compas_rhino.conversions import plane_to_compas_frame, frame_to_rhino_plane

module_agg = []
stick_width = 13.0
stick_depth = 13.0
stick_d_length = 235
stick_u_length = 263

# Convert input to compas
base_frame = plane_to_compas_frame(base_plane)

# Initialize tree
module_unit = TiltedModule(base_frame = base_frame, root_angle = 25, stick_d_length = 235, stick_u_length = 263, width = stick_width, depth = stick_depth)

# Grow tree
module_unit.grow_stick(length = stick_u_length, from_stick_index = -1, face_index = 2, angle = 27)
module_unit.grow_shorter_stick(length = stick_d_length, from_stick_index = 0, face_index = 3, angle = 50)
module_unit.grow_longer_stick(length = stick_u_length, from_stick_index = 2, face_index = 1, angle = 27)

# Visualize
module_out = module_unit.visualize()
module_frame_out = [stick.frame for stick in module_unit.sticks]

# Aggregation
# 1. build first module
module_agg = module_unit
# module_agg = [s for s in module_unit.sticks]

# print(module_agg)
# module_agg = []
# for s in module_unit.stick:
#     module_agg.extend(s)

# print("first module stick count =", len(module_agg.sticks))

# 2. build ModuleAggregation
agg = ModuleAggregation(first_module=module_agg)
for i in range(agg_times):

# 3. generate the next module
    agg.compute_next_module(from_stick_index=from_stick_index,
                            from_face_index=from_face_index,
                            from_t=from_t,
                            to_stick_index=to_stick_index,
                            to_face_index=to_face_index,
                            to_t=to_t,
                            angle=angle)

# 4. output geometry
geo = agg.visualize()
# ---------- end stick_module_aggregation_3 ----------
draw_20 = COMPASDraw(cg=stick_module_aggregation_3.module_frame_out)  # -> rg; same code as draw
draw_21 = COMPASDraw(cg=stick_module_aggregation_3.geo)  # -> rg; same code as draw
draw_22 = COMPASDraw(cg=stick_module_aggregation_3.module_out)  # -> rg; same code as draw
preview_6 = CustomPreview(
    Geometry=draw_21,
    Material={diffuse=RGB(221, 160, 221), emission=RGB(66, 48, 66), shine=0.5, specular=RGB(255, 255, 255), transparency=0})
vec_display_9 = Cluster(pln=draw_20, num=30)

pt_9 = ConstructPoint(XCoordinate=0, YCoordinate=0, ZCoordinate=0)  # disabled
number_slider_25 = Slider(90, range=0..100)  # disabled
xy_8 = XYPlane(Origin=pt_9)  # disabled
xz_8 = XZPlane(Origin=Point(0, 0, 0))  # disabled
rot3d_4 = Rotate3D(Geometry=xy_8, Angle=degrees(number_slider_25), Center=Point(0, 0, 0), Axis=xz_8)  # -> Geometry, Transform; disabled

number_slider_26 = Slider(2, range=0..3)  # disabled
number_slider_27 = Slider(1, range=0..3)  # disabled
number_slider_28 = Slider(2, range=0..3)  # disabled
number_slider_29 = Slider(1, range=0..3)  # disabled
number_slider_30 = Slider(0, range=0..180)  # disabled
number_slider_31 = Slider(0.793, range=0..1)  # disabled
number_slider_32 = Slider(1, range=0..10)  # disabled
number_slider_33 = Slider(0, range=0..1)  # disabled
stick_module_aggregation_4 = Python3Script(
    base_plane=rot3d_4.Geometry,
    agg_times=number_slider_32,
    from_stick_index=number_slider_29,
    from_face_index=number_slider_28,
    from_t=number_slider_31,
    to_stick_index=number_slider_27,
    to_face_index=number_slider_26,
    to_t=number_slider_33,
    angle=number_slider_30)  # -> out, module_out, geo, module_frame_out, from_frame, to_frame; inputs agg_times: Int32, from_stick_index: Int32, from_face_index: Int32, from_t: Double, to_stick_index: Int32, to_face_index: Int32, to_t: Double, angle: Double; disabled
# ---------- stick_module_aggregation_4: Python ----------
# r: compas>=2.14.1
# venv: sticks

import sys
import os
import math

#get current file path
path = ghenv.Component.OnPingDocument().FilePath
print (path)
#get parent directory of the parent directory
parentdir = os.path.dirname(path)
print (parentdir)
#get src folder which contains classes
dire = os.path.join(parentdir,'scripts')
print (dire)

sys.path.append(dire)

from compas_rhino import unload_modules

unload_modules("Sticks_Single_1")
unload_modules("Sticks_Multiple_1")
unload_modules("Sticks_Aggregation_3")

from Sticks_Single_1 import Stick  
from Sticks_Multiple_1 import TiltedModule
from Sticks_Aggregation_3 import ModuleAggregation
from compas.geometry import Line, Point, Vector, Frame
from compas_rhino.conversions import plane_to_compas_frame, frame_to_rhino_plane

module_agg = []
stick_width = 13.0
stick_depth = 13.0
stick_d_length = 235
stick_u_length = 263

# Convert input to compas
base_frame = plane_to_compas_frame(base_plane)

# Initialize tree
module_unit = TiltedModule(base_frame = base_frame, root_angle = 25, stick_d_length = 235, stick_u_length = 263, width = stick_width, depth = stick_depth)

# Grow tree
module_unit.grow_stick(length = stick_u_length, from_stick_index = -1, face_index = 2, angle = 27)
module_unit.grow_shorter_stick(length = stick_d_length, from_stick_index = 0, face_index = 3, angle = 50)
module_unit.grow_longer_stick(length = stick_u_length, from_stick_index = 2, face_index = 1, angle = 27)

# Visualize
module_out = module_unit.visualize()
module_frame_out = [frame_to_rhino_plane(stick.frame) for stick in module_unit.sticks]
# print(module_unit.sticks)

# Aggregation
# 1. build first module
module_agg = ModuleAggregation(module_unit.sticks)
# print(module_agg.first_module)

# 2. build ModuleAggregation
module_agg.compute_next_module(from_stick_index=from_stick_index,
                            from_face_index=from_face_index,
                            from_t=from_t,
                            to_stick_index=to_stick_index,
                            to_face_index=to_face_index,
                            to_t=to_t,
                            angle=angle)

from_frame = frame_to_rhino_plane(module_agg.from_frame)
to_frame = frame_to_rhino_plane(module_agg.to_frame)

# 4. output geometry
geo = module_agg.visualize()
# ---------- end stick_module_aggregation_4 ----------
draw_23 = COMPASDraw(cg=stick_module_aggregation_4.geo)  # -> rg; disabled; same code as draw
draw_24 = COMPASDraw(cg=stick_module_aggregation_4.module_out)  # -> rg; disabled; same code as draw
pln_16 = Plane(stick_module_aggregation_4.module_frame_out)  # disabled
preview_7 = CustomPreview(
    Geometry=draw_24,
    Material={diffuse=RGB(221, 160, 221), emission=RGB(66, 48, 66), shine=0.5, specular=RGB(255, 255, 255), transparency=0})  # disabled
vec_display_10 = Cluster(num=30)  # disabled

pt_10 = ConstructPoint(XCoordinate=0, YCoordinate=0, ZCoordinate=0)
xy_9 = XYPlane(Origin=pt_10)
xz_9 = XZPlane(Origin=Point(0, 0, 0))
rot3d_5 = Rotate3D(Geometry=xy_9, Angle=degrees(Slider(90, range=0..100)), Center=Point(0, 0, 0), Axis=xz_9)  # -> Geometry, Transform

stick_module_aggregation_5 = Python3Script(
    base_plane=rot3d_5.Geometry,
    agg_times=Slider(1, range=0..10),
    to_stick_index=Slider(0, range=0..3),
    to_face_index=Slider(1, range=0..3),
    to_t=Slider(0, range=0..1),
    from_stick_index=Slider(1, range=0..3),
    from_face_index=Slider(3, range=0..3),
    from_t=Slider(0.745, range=0..1),
    angle=Slider(0, range=0..180))  # -> out, module_out, geo, module_frame_out, to_frame, from_frame; inputs agg_times: Int32, to_stick_index: Int32, to_face_index: Int32, to_t: Double, from_stick_index: Int32, from_face_index: Int32, from_t: Double, angle: Double; same code as stick_module_aggregation_4
draw_25 = COMPASDraw(cg=stick_module_aggregation_5.geo)  # -> rg; same code as draw
draw_26 = COMPASDraw(cg=stick_module_aggregation_5.module_out)  # -> rg; same code as draw
pln_17 = Plane(stick_module_aggregation_5.module_frame_out)
preview_8 = CustomPreview(
    Geometry=draw_26,
    Material={diffuse=RGB(221, 160, 221), emission=RGB(66, 48, 66), shine=0.5, specular=RGB(255, 255, 255), transparency=0})
vec_display_11 = Cluster(num=30)

# ----
pln_18 = Plane(stick_module_aggregation_4.from_frame)  # disabled
pln_19 = Plane(stick_module_aggregation_4.to_frame)  # disabled
pln_20 = Plane(stick_module_aggregation_5.from_frame)
pln_21 = Plane(stick_module_aggregation_5.to_frame)
number_slider_34 = Slider(1, range=0..3)  # disabled
number_slider_35 = Slider(1, range=0..3)  # disabled
number_slider_36 = Slider(0, range=0..3)
debrep_4 = DeconstructBrep(Brep=draw_21)  # -> Faces, Edges, Vertices
multiplication = Multiplication(A=Slider(1, range=0..10), B="4")
tstat = TreeStatistics(Tree=pln_19)  # -> simplify(Paths), Length, Count; disabled
multiplication_2 = Multiplication(A=Slider(0, range=0..10), B="4")
tstat_2 = TreeStatistics(Tree=pln_20)  # -> simplify(Paths), Length, Count
item_4 = ListItem(List=debrep_4.Edges, Index=0, Wrap=True)
series_2 = Series(Start=multiplication, Step=1, Count="4")
item_5 = ListItem(List=draw_24, Index=number_slider_34, Wrap=True)  # disabled
item_6 = ListItem(List=tstat.Paths, Index=number_slider_34, Wrap=True)  # disabled
series_3 = Series(Start=multiplication_2, Step=1, Count="4")
item_7 = ListItem(List=pln_16, Index=number_slider_35, Wrap=True)  # disabled
item_8 = ListItem(List=draw_21, Index=Slider(1, range=0..3), Wrap=True)
item_9 = ListItem(List=draw_26, Index=number_slider_36, Wrap=True)
item_10 = ListItem(List=tstat_2.Paths, Index=number_slider_36, Wrap=True)
item_11 = ListItem(List=pln_17, Index=Slider(1, range=0..3), Wrap=True)
len_3 = Length(Curve=item_4)  # -> flatten(Length)
item_12 = ListItem(List=draw_21, Index=series_2, Wrap=True)
branch = TreeBranch(Tree=pln_19, Path=item_6, MaintainPaths=True)  # disabled
debrep_5 = DeconstructBrep(Brep=item_8)  # -> Faces, Edges, Vertices
item_13 = ListItem(List=draw_21, Index=series_3, Wrap=True)
branch_2 = TreeBranch(Tree=pln_20, Path=item_10, MaintainPaths=True)
panel_3 = Panel(len_3)
vec_display_12 = Cluster(pln=branch, num=30)  # disabled
area_2 = Area(Geometry=debrep_5.Faces)  # -> Area, Centroid
preview_9 = CustomPreview(
    Geometry=item_13,
    Material={diffuse=RGB(221, 160, 221), emission=RGB(66, 48, 66), shine=0.5, specular=RGB(255, 255, 255), transparency=0})
vec_display_13 = Cluster(pln=branch_2, num=30)
item_14 = ListItem(List=item_13, Index=series_2, Wrap=True)
points_5 = PointList(Points=area_2.Centroid, Size=Slider(10, range=0..10))

# ==== cluster Cluster
pln = ClusterInput()
num = ClusterInput()
pln_2 = Plane(graft(pln))
num_2 = Number(num)
deplane = DeconstructPlane(Plane=pln_2)  # -> flatten(Origin), XAxis, YAxis, ZAxis
entwine = Entwine(Branch00=deplane.XAxis, Branch01=deplane.YAxis, Branch02=deplane.ZAxis, FlattenInputs=True)
merge = Merge(
    Data1=ColourSwatch(SwatchColor=RGB(255, 0, 0)),
    Data2=ColourSwatch(SwatchColor=RGB(0, 255, 0)),
    Data3=ColourSwatch(SwatchColor=RGB(0, 0, 255)))  # -> graft(Result)
multiplication = Multiplication(A=entwine, B=num_2)
vdisex = VectorDisplayEx(Point=deplane.Origin, Vector=multiplication, Colour=merge, Width=2)
