# Grasshopper definition 103_branching_out_sticks.ghx (Grasshopper 1.0.8)

xy_plane = XYPlane(Origin=Point(0, 0, 0))
python_3_script = Python3Script(root=xy_plane, stick_length=Slider(200, range=0..1000))  # -> out, geometries, frames
# ---------- python_3_script: Python ----------
# r: compas>=2.14.1
# venv: sticks

import sys
import os
import math

#get current file path
path = ghenv.Component.OnPingDocument().FilePath
print (path)
#get parent directory of the parent directory
parentdir = os.path.dirname(path)
print (parentdir)
#get src folder which contains classes
dire = os.path.join(parentdir,'scripts')
print (dire)

sys.path.append(dire)

from compas_rhino import unload_modules

unload_modules("Sticks")
unload_modules("stick_module")

import Sticks
from Sticks import Stick 
from stick_module import BranchingModule
from compas.geometry import Line, Point, Vector, Frame

stick_width = 13.0
stick_depth = 13.0

from compas_rhino.conversions import plane_to_compas_frame, frame_to_rhino_plane

# Convert input to compas
root = plane_to_compas_frame(root)

# Initialize tree
tree = BranchingModule(root, stick_length=200, width = stick_width, depth = stick_depth)

# Grow tree
tree.grow_stick(face_index = 3, angle = 30, offset = 25)
tree.grow_stick(face_index = 2, angle = 30, offset = 25)
tree.grow_stick(face_index = 1, angle = 30, offset = 25)
tree.grow_stick(from_stick_index = 1, face_index = 0, angle = 30, offset = 55)

# Visualize
geometries = tree.visualize()
frames = [stick.frame for stick in tree.sticks]
# ---------- end python_3_script ----------

# ---- group: Frame visualisation
python_3_script_2 = Python3Script(frames=python_3_script.frames, factor=Slider(25, range=0..25))  # -> points, x_axis, y_axis, normal; inputs frames: list
# ---------- python_3_script_2: Python ----------
from compas.geometry import Vector
from compas.geometry import cross_vectors
from compas_rhino.conversions import vector_to_rhino
from compas_rhino.conversions import point_to_rhino

points = []
x_axis = []
y_axis = []
normal = []

for frame in frames:
    points.append(point_to_rhino(frame.point))
    x_axis.append(vector_to_rhino(frame.xaxis * factor))
    y_axis.append(vector_to_rhino(frame.normal * factor))
    normal.append(vector_to_rhino(frame.yaxis * factor))
# ---------- end python_3_script_2 ----------
vector_display_ex = VectorDisplayEx(
    Point=python_3_script_2.points,
    Vector=python_3_script_2.x_axis,
    Colour=ColourSwatch(SwatchColor=RGB(255, 0, 0)),
    Width=2)
vector_display_ex_2 = VectorDisplayEx(
    Point=python_3_script_2.points,
    Vector=python_3_script_2.y_axis,
    Colour=ColourSwatch(SwatchColor=RGB(0, 0, 255)),
    Width=2)
vector_display_ex_3 = VectorDisplayEx(
    Point=python_3_script_2.points,
    Vector=python_3_script_2.normal,
    Colour=ColourSwatch(SwatchColor=RGB(0, 255, 0)),
    Width=2)

# ----
draw = COMPASDraw(cg=python_3_script.geometries)  # -> rg
#   port cg: The COMPAS geometry or datastructure to be drawn.
#   port rg: The Rhino geometry object.
# ---------- draw: Python ----------
# r: compas>=2.14.1
"""
Draws COMPAS geometry in Grasshopper.
"""

from typing import Any

import Grasshopper

from compas.scene import SceneObject


class CompasToRhinoGeometry(Grasshopper.Kernel.GH_ScriptInstance):
    def RunScript(self, cg):
        if not cg:
            return None

        return SceneObject(item=cg).draw()
# ---------- end draw ----------
