# Grasshopper definition Dec_02_Jerry_Sticks.gh (Grasshopper 1.0.8)

# ----
# Mid-phase AABB Collision + Infinate-axis Distance Check
pt = Point(Point(-186.0594048, -107.2522057, 0))  # disabled
number_slider = Slider(90, range=0..180)  # disabled
xy = XYPlane(Origin=pt)  # disabled
yz = YZPlane(Origin=pt)  # disabled
xz = XZPlane(Origin=pt)  # disabled
rotate = Rotate(Geometry=xy, Angle=degrees(number_slider), Plane=xz)  # -> Geometry, Transform; disabled
number_slider_2 = Slider(23, range=0..100)  # disabled
number_slider_3 = Slider(1, range=0..10)  # disabled
number_slider_4 = Slider(216, range=0..1000)  # disabled
number_slider_5 = Slider(34, range=0..100)  # disabled
number_slider_6 = Slider(133, range=0..180)  # disabled
list = ValueList({"Regular": 0, "Random": 1}, selected="Random")  # disabled
pln = Plane(rotate.Geometry)  # disabled
cluster = Cluster(pln=pln, num=30)  # disabled
py3 = Python3Script(
    first_pln=pln,
    length=number_slider_4,
    seed=number_slider_5,
    agg_type=list,
    agg_count=number_slider_2,
    angle=number_slider_6)  # -> out, stick_out, axis_out, aabb, index_overlap; inputs first_pln: Plane, length: Double, seed: Int32, agg_type: Int32, agg_count: Int32, angle: Double; disabled
# ---------- py3: Python ----------
#locate stick class file in the same folder
from compas_rhino import unload_modules
import sys
import os
"""
#get current file path
path = ghenv.Component.OnPingDocument().FilePath
#get parent directory of the parent directory
parentdir = os.path.dirname(path)
#get src folder which contains classes
dire = os.path.join(parentdir,'scripts')

sys.path.append(dire)"""

path = 'D:\\ETH\\Github\\MAS-2526\\08_SpatialAssemblies\\StudentProjects\\group_two\\J3RRY_Sticks_^o^\\scripts\\Package_v2'
sys.path.append(path)

unload_modules('J3RRY_SingleStick_v1')
unload_modules('J3RRY_Aggregation_v1')
unload_modules('J3RRY_Collision_v1')

from J3RRY_SingleStick_v1 import Stick
from J3RRY_Aggregation_v1 import Aggregation
from J3RRY_Collision_v1 import Collision

from compas.geometry import Line, Point, Vector
from compas.geometry import Transformation
from compas_rhino.conversions import plane_to_compas_frame, frame_to_rhino_plane

import random


"""Main Code"""
# Convert rhino plane to compas frame
first_pln = plane_to_compas_frame(first_pln)
agg = Aggregation(first_pln, length, agg_type, seed)


# Aggregation
for i in range(agg_count):
    # angle = random.uniform(0, 180)
    # angle = 45*i
    agg.spawn_next_stick_random(angle, seed)


# Output
stick_out = agg.visualize()
axis_out = agg.axes
plane_out = [frame_to_rhino_plane(f) for f in agg.frames]
from_pln_out = [frame_to_rhino_plane(f) for f in agg.from_frames]
to_pln_out = [frame_to_rhino_plane(f) for f in agg.to_frames]


# Collision Check
aabb = [Point(*pt) for pt in agg.sticks[-1].aabb]

index_overlap = []
for i, s in enumerate(agg.sticks[:-2]):
    col = Collision(agg.sticks[-1], s)
    is_overlap = col.check_collision()

    if is_overlap:
        index_overlap.append(i)
        dist = col.axis_distance
        print ('index:', i, ', dist:', dist)
# ---------- end py3 ----------
draw = COMPASDraw(cg=py3.stick_out)  # -> rg; disabled
#   port cg: The COMPAS geometry or datastructure to be drawn.
#   port rg: The Rhino geometry object.
# ---------- draw: Python ----------
# r: compas>=2.14.1
"""
Draws COMPAS geometry in Grasshopper.
"""

from typing import Any

import Grasshopper

from compas.scene import SceneObject


class CompasToRhinoGeometry(Grasshopper.Kernel.GH_ScriptInstance):
    def RunScript(self, cg):
        if not cg:
            return None

        return SceneObject(item=cg).draw()
# ---------- end draw ----------
draw_2 = COMPASDraw(cg=py3.axis_out)  # -> rg; disabled; same code as draw
number_slider_7 = Slider(0, range=0..10)  # disabled
lng = ListLength(List=draw)  # disabled
draw_3 = COMPASDraw(cg=py3.aabb)  # -> rg; disabled; same code as draw
midpt = CurveMiddle(Curve=draw_2)  # disabled
item = ListItem(List=draw_3, Index=0, Wrap=True)  # -> Item, Item1; disabled
series = Series(Start=0, Step=1, Count=lng)  # disabled
points = PointList(Points=midpt, Size=number_slider_7)  # disabled
box = Box2Pt(PointA=item.Item, PointB=item.Item1, Plane=PlaneXY(0, 0, 0))  # disabled
gradient = Gradient(
    LowerLimit=0,
    UpperLimit=expr("x-1", lng),
    Parameter=series,
    stops=[0: RGB(80, 55, 25), 0.5: RGB(159, 65, 29), 1: RGB(174, 166, 129)])  # disabled
swatch = ColourSwatch(SwatchColor=RGBA(255, 255, 255, 119))  # disabled
preview = CustomPreview(Geometry=box, Material=swatch)  # disabled
preview_2 = CustomPreview(Geometry=draw, Material=gradient)  # disabled

# ----
# Mid-phase AABB Collision + Segment Distance Check
pt_2 = Point(Point(-186.0594048, -107.2522057, 0))  # disabled
number_slider_8 = Slider(90, range=0..180)  # disabled
xy_2 = XYPlane(Origin=pt_2)  # disabled
yz_2 = YZPlane(Origin=pt_2)  # disabled
xz_2 = XZPlane(Origin=pt_2)  # disabled
rotate_2 = Rotate(Geometry=xy_2, Angle=degrees(number_slider_8), Plane=xz_2)  # -> Geometry, Transform; disabled
number_slider_9 = Slider(4, range=0..100)  # disabled
number_slider_10 = Slider(2, range=0..10)  # disabled
number_slider_11 = Slider(216, range=0..1000)  # disabled
number_slider_12 = Slider(37, range=0..100)  # disabled
number_slider_13 = Slider(0, range=0..180)  # disabled
list_2 = ValueList({"Regular": 0, "Random": 1}, selected="Random")  # disabled
pln_2 = Plane(rotate_2.Geometry)  # disabled
cluster_2 = Cluster(pln=pln_2, num=30)  # disabled
py3_2 = Python3Script(
    first_pln=pln_2,
    length=number_slider_11,
    seed=number_slider_12,
    agg_type=list_2,
    agg_count=number_slider_10,
    angle=number_slider_13)  # -> out, stick_out, axis_out, aabb, index_overlap; inputs first_pln: Plane, length: Double, seed: Int32, agg_type: Int32, agg_count: Int32, angle: Double; disabled
# ---------- py3_2: Python ----------
#locate stick class file in the same folder
from compas_rhino import unload_modules
import sys
import os
"""
#get current file path
path = ghenv.Component.OnPingDocument().FilePath
#get parent directory of the parent directory
parentdir = os.path.dirname(path)
#get src folder which contains classes
dire = os.path.join(parentdir,'scripts')

sys.path.append(dire)"""

path = 'D:\\ETH\\Github\\MAS-2526\\08_SpatialAssemblies\\StudentProjects\\group_two\\J3RRY_Sticks_^o^\\scripts\\Package_v2'
sys.path.append(path)

unload_modules('J3RRY_SingleStick_v1')
unload_modules('J3RRY_Aggregation_v1')
unload_modules('J3RRY_Collision_v1')

from J3RRY_SingleStick_v1 import Stick
from J3RRY_Aggregation_v1 import Aggregation
from J3RRY_Collision_v1 import Collision

from compas.geometry import Line, Point, Vector
from compas.geometry import Transformation
from compas_rhino.conversions import plane_to_compas_frame, frame_to_rhino_plane

import random


"""Main Code"""
# Convert rhino plane to compas frame
first_pln = plane_to_compas_frame(first_pln)
agg = Aggregation(first_pln, length, agg_type, seed)


# Aggregation
for i in range(agg_count):
    # angle = random.uniform(0, 180)
    # angle = 45*i
    agg.spawn_next_stick_random(angle, seed)


# Output
stick_out = agg.visualize()
axis_out = agg.axes
plane_out = [frame_to_rhino_plane(f) for f in agg.frames]
from_pln_out = [frame_to_rhino_plane(f) for f in agg.from_frames]
to_pln_out = [frame_to_rhino_plane(f) for f in agg.to_frames]


# Collision Check
aabb = [Point(*pt) for pt in agg.sticks[-1].aabb]

index_overlap = []
for i, s in enumerate(agg.sticks[:-2]):
    col = Collision(agg.sticks[-1], s)
    is_overlap = col.check_collision()

    if is_overlap:
        index_overlap.append(i)
        dist = col.segment_distance
        print ('index:', i, ', dist:', dist)
# ---------- end py3_2 ----------
draw_4 = COMPASDraw(cg=py3_2.stick_out)  # -> rg; disabled; same code as draw
draw_5 = COMPASDraw(cg=py3_2.axis_out)  # -> rg; disabled; same code as draw
number_slider_14 = Slider(0, range=0..10)  # disabled
lng_2 = ListLength(List=draw_4)  # disabled
draw_6 = COMPASDraw(cg=py3_2.aabb)  # -> rg; disabled; same code as draw
midpt_2 = CurveMiddle(Curve=draw_5)  # disabled
item_2 = ListItem(List=draw_6, Index=0, Wrap=True)  # -> Item, Item1; disabled
series_2 = Series(Start=0, Step=1, Count=lng_2)  # disabled
points_2 = PointList(Points=midpt_2, Size=number_slider_14)  # disabled
box_2 = Box2Pt(PointA=item_2.Item, PointB=item_2.Item1, Plane=PlaneXY(0, 0, 0))  # disabled
gradient_2 = Gradient(
    LowerLimit=0,
    UpperLimit=expr("x-1", lng_2),
    Parameter=series_2,
    stops=[0: RGB(80, 55, 25), 0.5: RGB(159, 65, 29), 1: RGB(174, 166, 129)])  # disabled
swatch_2 = ColourSwatch(SwatchColor=RGBA(255, 255, 255, 119))  # disabled
preview_3 = CustomPreview(Geometry=box_2, Material=swatch_2)  # disabled
preview_4 = CustomPreview(Geometry=draw_4, Material=gradient_2)  # disabled

panel = Panel(py3.index_overlap)  # disabled

panel_2 = Panel("-1")  # disabled
line = Line(draw_2)  # disabled
number_slider_15 = Slider(1000, range=0..1000)  # disabled
item_3 = ListItem(List=line, Index=panel_2, Wrap=True)  # disabled
item_4 = ListItem(List=line, Index=panel, Wrap=True)  # disabled
ext = ExtendCurve(Curve=item_3, Type=0, Start=number_slider_15, End=number_slider_15)  # disabled
ext_2 = ExtendCurve(Curve=item_4, Type=0, Start=number_slider_15, End=number_slider_15)  # disabled
crvprox = CurveProximity(CurveA=ext, CurveB=ext_2)  # -> PointA, PointB, Distance; disabled
panel_3 = Panel(crvprox.Distance)  # disabled

panel_4 = Panel(py3_2.index_overlap)  # disabled

panel_5 = Panel("-1")  # disabled
line_2 = Line(draw_5)  # disabled
item_5 = ListItem(List=line_2, Index=panel_5, Wrap=True)  # disabled
item_6 = ListItem(List=line_2, Index=panel_4, Wrap=True)  # disabled
crvprox_2 = CurveProximity(CurveA=item_5, CurveB=item_6)  # -> PointA, PointB, Distance; disabled
panel_6 = Panel(crvprox_2.Distance)  # disabled

brep = Brep(draw)  # disabled
panel_7 = Panel("-1")  # disabled
brep_2 = Brep(draw_4)  # disabled
panel_8 = Panel("-1")  # disabled
item_7 = ListItem(List=brep, Index=panel, Wrap=True)  # disabled
item_8 = ListItem(List=brep, Index=panel_7, Wrap=True)  # disabled
item_9 = ListItem(List=brep_2, Index=panel_4, Wrap=True)  # disabled
item_10 = ListItem(List=brep_2, Index=panel_8, Wrap=True)  # disabled
bbox = BoundingBox(Content=item_7, Plane=PlaneXY(0, 0, 0))  # -> Box, Box_2; disabled
panel_9 = Panel(py3.out)  # disabled
bbox_2 = BoundingBox(Content=item_9, Plane=PlaneXY(0, 0, 0))  # -> Box, Box_2; disabled
swatch_3 = ColourSwatch(SwatchColor=RGBA(255, 255, 255, 119))  # disabled
panel_10 = Panel(py3_2.out)  # disabled
preview_5 = CustomPreview(Geometry=item_10, Material=swatch_3)  # disabled

# ----
# Aggregation with Rejection Sampling
pt_3 = Point(Point(-186.0594048, -107.2522057, 0))
xy_3 = XYPlane(Origin=pt_3)
yz_3 = YZPlane(Origin=pt_3)
xz_3 = XZPlane(Origin=pt_3)
rotate_3 = Rotate(Geometry=xy_3, Angle=degrees(Slider(90, range=0..180)), Plane=xz_3)  # -> Geometry, Transform
number_slider_16 = Slider(15, range=0..100)
pln_3 = Plane(rotate_3.Geometry)
list_3 = ValueList({"Regular": 0, "Random": 1}, selected="Random")
cluster_3 = Cluster(pln=pln_3, num=30)
py3_3 = Python3Script(
    first_pln=pln_3,
    length=Slider(216, range=0..1000),
    seed=Slider(43, range=0..100),
    agg_type=list_3,
    agg_count=Slider(15, range=0..20),
    max_attempts=Slider(5, range=0..20),
    angle=Slider(171, range=0..180))  # -> out, stick_out, axis_out, failed_sticks, failed_axes, collision_log; inputs first_pln: Plane, length: Double, seed: Int32, agg_type: Int32, agg_count: Int32, max_attempts: Int32, angle: Double
# ---------- py3_3: Python ----------
#locate stick class file in the same folder
from compas_rhino import unload_modules
import sys
import os
"""
#get current file path
path = ghenv.Component.OnPingDocument().FilePath
#get parent directory of the parent directory
parentdir = os.path.dirname(path)
#get src folder which contains classes
dire = os.path.join(parentdir,'scripts')

sys.path.append(dire)"""

path = 'D:\\ETH\\Github\\MAS-2526\\08_SpatialAssemblies\\StudentProjects\\group_two\\J3RRY_Sticks_^o^\\scripts\\Package_v2'
sys.path.append(path)

unload_modules('J3RRY_SingleStick_v1')
unload_modules('J3RRY_Aggregation_v1')
unload_modules('J3RRY_Collision_v1')

from J3RRY_SingleStick_v1 import Stick
from J3RRY_Aggregation_v1 import Aggregation
from J3RRY_Collision_v1 import Collision

from compas.geometry import Line, Point, Vector
from compas.geometry import Transformation
from compas_rhino.conversions import plane_to_compas_frame, frame_to_rhino_plane

import random


"""Main Code"""
# Convert rhino plane to compas frame
first_pln = plane_to_compas_frame(first_pln)
agg = Aggregation(first_pln, length, agg_type, seed)


# Aggregation with Collision Check
index_overlap = []
for i in range(agg_count):
    new_stick = agg.spawn_next_stick_random_with_rejection(angle, max_attempts, seed)

    if new_stick is None:
        # print (f"Spawn failed at iteration {i}.")
        break
    else:
        # print ("Success. No Collision.")
        pass


# Output
stick_out = agg.visualize()
axis_out = agg.axes

from Grasshopper import DataTree
from Grasshopper.Kernel.Data import GH_Path

failed_sticks = DataTree[object]()
failed_axes = DataTree[object]()
print (agg.failed_sticks)
print (len(agg.failed_sticks))

for i, branch in enumerate(agg.failed_sticks):
    sub_path = GH_Path(i + 1)
    for s in branch:
        failed_sticks.Add(s.geometry, sub_path)
        failed_axes.Add(s.axis, sub_path)

collision_log = DataTree[object]()
for i, log in enumerate(agg.collision_log):
    path = GH_Path(i + 1)

    # 1. primitive values first
    collision_log.Add(f"attempts = {log['attempts']}", path)
    collision_log.Add(f"fail_count = {log['fail_count']}", path)
    collision_log.Add(f"success = {log['success']}", path)
    collision_log.Add(f"reason = {log['reason']}", path)
    collision_log.Add(f"angle = {log['params']['angle']}", path)

    # 2. list values (expand as multiple items)
    for fi in log["params"]["from_index"]:
        collision_log.Add(f"from_index = {fi}", path)

    for ft in log["params"]["from_t"]:
        collision_log.Add(f"from_t = {ft}", path)

    for ti in log["params"]["to_index"]:
        collision_log.Add(f"to_index = {ti}", path)

    for tt in log["params"]["to_t"]:
        collision_log.Add(f"to_t = {tt}", path)
# ---------- end py3_3 ----------
draw_7 = COMPASDraw(cg=py3_3.failed_sticks)  # -> rg; same code as draw
draw_8 = COMPASDraw(cg=py3_3.failed_axes)  # -> rg; same code as draw
draw_9 = COMPASDraw(cg=py3_3.stick_out)  # -> rg; same code as draw
draw_10 = COMPASDraw(cg=py3_3.axis_out)  # -> rg; same code as draw
lng_3 = ListLength(List=draw_9)
midpt_3 = CurveMiddle(Curve=draw_10)
series_3 = Series(Start=0, Step=1, Count=lng_3)
points_3 = PointList(Points=midpt_3, Size=Slider(9, range=0..10))
gradient_3 = Gradient(
    LowerLimit=0,
    UpperLimit=expr("x-1", lng_3),
    Parameter=series_3,
    stops=[0: RGB(80, 55, 25), 0.5: RGB(159, 65, 29), 1: RGB(174, 166, 129)])

panel_11 = Panel(py3_3.collision_log)
panel_12 = Panel(draw_7)
panel_13 = Panel(py3_3.out)
dmaterial = DeconstructMaterial(Material=gradient_3)  # -> Diffuse, Specular, Emission, Transparency, Shine
material = CreateMaterial(
    Diffuse=dmaterial.Diffuse,
    Specular=dmaterial.Specular,
    Emission=dmaterial.Emission,
    Transparency=Slider(0.515, range=0..1),
    Shine=dmaterial.Shine)

preview_6 = CustomPreview(Geometry=draw_9, Material=material)

# ==== cluster Cluster
pln = ClusterInput()
num = ClusterInput()
pln_2 = Plane(graft(pln))
num_2 = Number(num)
deplane = DeconstructPlane(Plane=pln_2)  # -> flatten(Origin), XAxis, YAxis, ZAxis
entwine = Entwine(Branch00=deplane.XAxis, Branch01=deplane.YAxis, Branch02=deplane.ZAxis, FlattenInputs=True)
merge = Merge(
    Data1=ColourSwatch(SwatchColor=RGB(255, 0, 0)),
    Data2=ColourSwatch(SwatchColor=RGB(0, 255, 0)),
    Data3=ColourSwatch(SwatchColor=RGB(0, 0, 255)))  # -> graft(Result)
multiplication = Multiplication(A=entwine, B=num_2)
vdisex = VectorDisplayEx(Point=deplane.Origin, Vector=multiplication, Colour=merge, Width=2)
