# Grasshopper definition Dec_05_Jerry_Sticks.gh (Grasshopper 1.0.8)
# plug-ins: Weaverbird

# ----
# Aggregation with Multiple Lengths and Angles
pt = Point(Point(-186.0594048, -107.2522057, 0))  # disabled
number_slider = Slider(29, range=0..180)  # disabled
xy = XYPlane(Origin=pt)  # disabled
yz = YZPlane(Origin=pt)  # disabled
xz = XZPlane(Origin=pt)  # disabled
rotate = Rotate(Geometry=xy, Angle=degrees(number_slider), Plane=xz)  # -> Geometry, Transform; disabled
number_slider_2 = Slider(0, range=0..180)  # disabled
pln = Plane(rotate.Geometry)  # disabled
number_slider_3 = Slider(0, range=0..10)  # disabled
number_slider_4 = Slider(0, range=0..10)  # disabled
number_slider_5 = Slider(0, range=0..1)  # disabled
cluster = Cluster(pln=pln, num=30)  # disabled
number_slider_6 = Slider(1, range=0..1)  # disabled
number_slider_7 = Slider(39, range=0..100)  # disabled
list = ValueList({"Regular": 0, "Random": 1}, selected="Random")  # disabled
panel = Panel("""200
500""")  # disabled
py3 = Python3Script(
    first_pln=pln,
    length_pattern=panel,
    seed=number_slider_7,
    agg_type=list,
    from_index=number_slider_3,
    from_t=number_slider_5,
    to_index=number_slider_4,
    to_t=number_slider_6,
    angle_pattern=number_slider_2)  # -> out, stick_out, axis_out, frame_out; inputs first_pln: Plane, length_pattern: list of Double, seed: Int32, agg_type: Int32, from_index: Int32, from_t: Double, to_index: Int32, to_t: Double, angle_pattern: list of Double; disabled
# ---------- py3: Python ----------
#locate stick class file in the same folder
from compas_rhino import unload_modules
import sys
import os
"""
#get current file path
path = ghenv.Component.OnPingDocument().FilePath
#get parent directory of the parent directory
parentdir = os.path.dirname(path)
#get src folder which contains classes
dire = os.path.join(parentdir,'scripts')

sys.path.append(dire)
"""

path = 'D:\\ETH\\Github\\MAS-2526\\08_SpatialAssemblies\\StudentProjects\\group_two\\J3RRY_Sticks_^o^\\scripts\\Package_v2'
sys.path.append(path)

unload_modules('J3RRY_SingleStick_v1')
unload_modules('J3RRY_Aggregation_v2')
unload_modules('J3RRY_Collision_v1')

from J3RRY_SingleStick_v1 import Stick
from J3RRY_Aggregation_v2 import Aggregation
from J3RRY_Collision_v1 import Collision

from compas.geometry import Line, Point, Vector
from compas.geometry import Transformation
from compas_rhino.conversions import plane_to_compas_frame, frame_to_rhino_plane

import random


"""Main Code"""
# Convert rhino plane to compas frame
first_pln = plane_to_compas_frame(first_pln)
# random pick length
agg = Aggregation(first_pln, length_pattern, angle_pattern, agg_type, seed)

agg.spawn_next_stick(from_index, from_t, to_index, to_t)
# Output
stick_out = agg.visualize()
axis_out = agg.axes

frame_out = [frame_to_rhino_plane(f) for f in agg.frames]
print (agg.sticks[0].corners)
# ---------- end py3 ----------
draw = COMPASDraw(cg=py3.stick_out)  # -> rg; disabled
#   port cg: The COMPAS geometry or datastructure to be drawn.
#   port rg: The Rhino geometry object.
# ---------- draw: Python ----------
# r: compas>=2.14.1
"""
Draws COMPAS geometry in Grasshopper.
"""

from typing import Any

import Grasshopper

from compas.scene import SceneObject


class CompasToRhinoGeometry(Grasshopper.Kernel.GH_ScriptInstance):
    def RunScript(self, cg):
        if not cg:
            return None

        return SceneObject(item=cg).draw()
# ---------- end draw ----------
pln_2 = Plane(py3.frame_out)  # disabled
draw_2 = COMPASDraw(cg=py3.axis_out)  # -> rg; disabled; same code as draw
number_slider_8 = Slider(9, range=0..10)  # disabled
cluster_2 = Cluster(pln=pln_2, num=30)  # disabled
lng = ListLength(List=draw)  # disabled
midpt = CurveMiddle(Curve=draw_2)  # disabled
series = Series(Start=0, Step=1, Count=lng)  # disabled
points = PointList(Points=midpt, Size=number_slider_8)  # disabled
gradient = Gradient(
    LowerLimit=0,
    UpperLimit=expr("x-1", lng),
    Parameter=series,
    stops=[0: RGB(80, 55, 25), 0.5: RGB(159, 65, 29), 1: RGB(174, 166, 129)])  # disabled
number_slider_9 = Slider(0.515, range=0..1)  # disabled
dmaterial = DeconstructMaterial(Material=gradient)  # -> Diffuse, Specular, Emission, Transparency, Shine; disabled
material = CreateMaterial(
    Diffuse=dmaterial.Diffuse,
    Specular=dmaterial.Specular,
    Emission=dmaterial.Emission,
    Transparency=number_slider_9,
    Shine=dmaterial.Shine)  # disabled
preview = CustomPreview(Geometry=draw, Material=material)  # disabled

# ----
# Aggregation with Multiple Lengths and Angles
pt_2 = Point(Point(-186.0594048, -107.2522057, 0))  # disabled
number_slider_10 = Slider(33, range=0..180)  # disabled
xy_2 = XYPlane(Origin=pt_2)  # disabled
yz_2 = YZPlane(Origin=pt_2)  # disabled
xz_2 = XZPlane(Origin=pt_2)  # disabled
rotate_2 = Rotate(Geometry=xy_2, Angle=degrees(number_slider_10), Plane=xz_2)  # -> Geometry, Transform; disabled
pln_3 = Plane(rotate_2.Geometry)  # disabled
number_slider_11 = Slider(1, range=0..100)  # disabled
cluster_3 = Cluster(pln=pln_3, num=30)  # disabled
number_slider_12 = Slider(30, range=0..100)  # disabled
list_2 = ValueList({"Regular": 0, "Random": 1}, selected="Regular")  # disabled
panel_2 = Panel("""0
30""")  # disabled
panel_3 = Panel("""200
500""")  # disabled
py3_2 = Python3Script(
    first_pln=pln_3,
    length_pattern=panel_3,
    seed=number_slider_12,
    agg_type=list_2,
    agg_count=number_slider_11,
    angle_pattern=panel_2)  # -> out, stick_out, axis_out, frame_out; inputs first_pln: Plane, length_pattern: list of Double, seed: Int32, agg_type: Int32, agg_count: Int32, angle_pattern: list of Double; disabled
# ---------- py3_2: Python ----------
#locate stick class file in the same folder
from compas_rhino import unload_modules
import sys
import os
"""
#get current file path
path = ghenv.Component.OnPingDocument().FilePath
#get parent directory of the parent directory
parentdir = os.path.dirname(path)
#get src folder which contains classes
dire = os.path.join(parentdir,'scripts')

sys.path.append(dire)
"""

path = 'D:\\ETH\\Github\\MAS-2526\\08_SpatialAssemblies\\StudentProjects\\group_two\\J3RRY_Sticks_^o^\\scripts\\Package_v2'
sys.path.append(path)

unload_modules('J3RRY_SingleStick_v1')
unload_modules('J3RRY_Aggregation_v2')
unload_modules('J3RRY_Collision_v1')

from J3RRY_SingleStick_v1 import Stick
from J3RRY_Aggregation_v2 import Aggregation
from J3RRY_Collision_v1 import Collision

from compas.geometry import Line, Point, Vector
from compas.geometry import Transformation
from compas_rhino.conversions import plane_to_compas_frame, frame_to_rhino_plane

import random


"""Main Code"""
# Convert rhino plane to compas frame
first_pln = plane_to_compas_frame(first_pln)
# random pick length
agg = Aggregation(first_pln, length_pattern, angle_pattern, agg_type, seed)

for i in range(agg_count):
    agg.spawn_next_stick_random(seed)
# Output
stick_out = agg.visualize()
axis_out = agg.axes

frame_out = [frame_to_rhino_plane(f) for f in agg.frames]
# ---------- end py3_2 ----------
draw_3 = COMPASDraw(cg=py3_2.stick_out)  # -> rg; disabled; same code as draw
pln_4 = Plane(py3_2.frame_out)  # disabled
draw_4 = COMPASDraw(cg=py3_2.axis_out)  # -> rg; disabled; same code as draw
number_slider_13 = Slider(9, range=0..10)  # disabled
cluster_4 = Cluster(pln=pln_4, num=30)  # disabled
lng_2 = ListLength(List=draw_3)  # disabled
midpt_2 = CurveMiddle(Curve=draw_4)  # disabled
series_2 = Series(Start=0, Step=1, Count=lng_2)  # disabled
points_2 = PointList(Points=midpt_2, Size=number_slider_13)  # disabled
gradient_2 = Gradient(
    LowerLimit=0,
    UpperLimit=expr("x-1", lng_2),
    Parameter=series_2,
    stops=[0: RGB(80, 55, 25), 0.5: RGB(159, 65, 29), 1: RGB(174, 166, 129)])  # disabled
number_slider_14 = Slider(0.515, range=0..1)  # disabled
dmaterial_2 = DeconstructMaterial(Material=gradient_2)  # -> Diffuse, Specular, Emission, Transparency, Shine; disabled
material_2 = CreateMaterial(
    Diffuse=dmaterial_2.Diffuse,
    Specular=dmaterial_2.Specular,
    Emission=dmaterial_2.Emission,
    Transparency=number_slider_14,
    Shine=dmaterial_2.Shine)  # disabled
preview_2 = CustomPreview(Geometry=draw_3, Material=material_2)  # disabled

# ----
# Aggregation with Multiple Lengths and Angles
pt_3 = Point(Point(-186.0594048, -107.2522057, 0))  # disabled
number_slider_15 = Slider(0, range=0..180)  # disabled
xy_3 = XYPlane(Origin=pt_3)  # disabled
yz_3 = YZPlane(Origin=pt_3)  # disabled
xz_3 = XZPlane(Origin=pt_3)  # disabled
rotate_3 = Rotate(Geometry=xy_3, Angle=degrees(number_slider_15), Plane=xz_3)  # -> Geometry, Transform; disabled
number_slider_16 = Slider(20, range=0..20)  # disabled
pln_5 = Plane(rotate_3.Geometry)  # disabled
number_slider_17 = Slider(100, range=0..100)  # disabled
number_slider_18 = Slider(20, range=0..20)  # disabled
cluster_5 = Cluster(pln=pln_5, num=30)  # disabled
number_slider_19 = Slider(47, range=0..100)  # disabled
list_3 = ValueList({"Regular": 0, "Random": 1}, selected="Random")  # disabled
panel_4 = Panel("""100
300
600""")  # disabled
panel_5 = Panel("""0
30
120""")  # disabled
py3_3 = Python3Script(
    first_pln=pln_5,
    length_pattern=panel_4,
    seed=number_slider_19,
    agg_type=list_3,
    agg_count=number_slider_17,
    max_attempts=number_slider_16,
    angle_pattern=panel_5)  # -> out, stick_out, axis_out, failed_sticks, failed_axes, collision_log; inputs first_pln: Plane, length_pattern: list of Double, seed: Int32, agg_type: Int32, agg_count: Int32, max_attempts: Int32, angle_pattern: list of Double; disabled
# ---------- py3_3: Python ----------
#locate stick class file in the same folder
from compas_rhino import unload_modules
import sys
import os
"""
#get current file path
path = ghenv.Component.OnPingDocument().FilePath
#get parent directory of the parent directory
parentdir = os.path.dirname(path)
#get src folder which contains classes
dire = os.path.join(parentdir,'scripts')

sys.path.append(dire)"""

path = 'D:\\ETH\\Github\\MAS-2526\\08_SpatialAssemblies\\StudentProjects\\group_two\\J3RRY_Sticks_^o^\\scripts\\Package_v2'
sys.path.append(path)

unload_modules('J3RRY_SingleStick_v1')
unload_modules('J3RRY_Aggregation_v2')
unload_modules('J3RRY_Collision_v1')

from J3RRY_SingleStick_v1 import Stick
from J3RRY_Aggregation_v2 import Aggregation
from J3RRY_Collision_v1 import Collision

from compas.geometry import Line, Point, Vector
from compas.geometry import Transformation
from compas_rhino.conversions import plane_to_compas_frame, frame_to_rhino_plane

import random


"""Main Code"""
# Convert rhino plane to compas frame
first_pln = plane_to_compas_frame(first_pln)
# random pick length
agg = Aggregation(first_pln, length_pattern, angle_pattern, agg_type, seed)


# Aggregation with Collision Check
index_overlap = []
for i in range(agg_count):
    new_stick = agg.spawn_next_stick_random_with_rejection(max_attempts, seed)

    if new_stick is None:
        # print (f"Spawn failed at iteration {i}.")
        break
    else:
        # print ("Success. No Collision.")
        pass


# Output
stick_out = agg.visualize()
axis_out = agg.axes

from Grasshopper import DataTree
from Grasshopper.Kernel.Data import GH_Path

failed_sticks = DataTree[object]()
failed_axes = DataTree[object]()
# print (agg.failed_sticks)
# print (len(agg.failed_sticks))

for i, branch in enumerate(agg.failed_sticks):
    sub_path = GH_Path(i + 1)
    for s in branch:
        failed_sticks.Add(s.geometry, sub_path)
        failed_axes.Add(s.axis, sub_path)


collision_log = DataTree[object]()
for i, log in enumerate(agg.collision_log):
    path = GH_Path(i + 1)

    # 1. primitive values first
    collision_log.Add(f"attempts = {log['attempts']}", path)
    collision_log.Add(f"fail_count = {log['fail_count']}", path)
    collision_log.Add(f"success = {log['success']}", path)
    collision_log.Add(f"reason = {log['reason']}", path)
    collision_log.Add(f"length = {log['params']['length']}", path)    
    collision_log.Add(f"angle = {log['params']['angle']}", path)
    collision_log.Add(f"from_index = {log['params']['from_index']}", path)
    collision_log.Add(f"to_index = {log['params']['to_index']}", path)
    collision_log.Add(f"from_t = {log['params']['from_t']}", path)
    collision_log.Add(f"to_t = {log['params']['to_t']}", path)
# ---------- end py3_3 ----------
draw_5 = COMPASDraw(cg=py3_3.failed_sticks)  # -> rg; disabled; same code as draw
draw_6 = COMPASDraw(cg=py3_3.failed_axes)  # -> rg; disabled; same code as draw
draw_7 = COMPASDraw(cg=py3_3.stick_out)  # -> rg; disabled; same code as draw
draw_8 = COMPASDraw(cg=py3_3.axis_out)  # -> rg; disabled; same code as draw
number_slider_20 = Slider(9, range=0..10)  # disabled
lng_3 = ListLength(List=draw_7)  # disabled
midpt_3 = CurveMiddle(Curve=draw_8)  # disabled
series_3 = Series(Start=0, Step=1, Count=lng_3)  # disabled
points_3 = PointList(Points=midpt_3, Size=number_slider_20)  # disabled
gradient_3 = Gradient(
    LowerLimit=0,
    UpperLimit=expr("x-1", lng_3),
    Parameter=series_3,
    stops=[0: RGB(80, 55, 25), 0.5: RGB(159, 65, 29), 1: RGB(174, 166, 129)])  # disabled
number_slider_21 = Slider(0.515, range=0..1)  # disabled
dmaterial_3 = DeconstructMaterial(Material=gradient_3)  # -> Diffuse, Specular, Emission, Transparency, Shine; disabled
material_3 = CreateMaterial(
    Diffuse=dmaterial_3.Diffuse,
    Specular=dmaterial_3.Specular,
    Emission=dmaterial_3.Emission,
    Transparency=number_slider_21,
    Shine=dmaterial_3.Shine)  # disabled
preview_3 = CustomPreview(Geometry=draw_7, Material=material_3)  # disabled

panel_6 = Panel(py3_3.collision_log)  # disabled
panel_7 = Panel(draw_5)  # disabled
panel_8 = Panel(py3_3.out)  # disabled

# ----
# Demo of Compas Point in Polyhedron
P = Plane(PlaneXY(0, 0, 0))  # disabled
wbicosahedron = WeaverbirdsMeshMeshIcosahedron(Plane=P, Radius=5)  # disabled
pop3d = Populate3D(Region={Plane=PlaneXY(0, 0, 0), X=Domain(0, 10), Y=Domain(0, 10), Z=Domain(0, 2)}, Count=100, Seed=1)  # disabled
pt_4 = Point(Point(4.472136021, 0, 2.23606801))  # disabled
py3_4 = Python3Script(x=wbicosahedron, y=pop3d, z=pt_4)  # -> out, a, b; inputs x: Mesh, y: list of Point3d, z: Point3d; disabled
# ---------- py3_4: Python ----------
import compas.geometry as cg
import compas_rhino.conversions as crc

mesh = crc.mesh_to_compas(x)
pts = [crc.point_to_compas(pt) for pt in y]

vertices, faces = mesh.to_vertices_and_faces()

print (mesh)
# print (vertices)
# print (faces)
poly = cg.Polyhedron(vertices, faces)
print (poly)

inside = []
for pt in pts:
    is_inside = cg.is_point_in_polyhedron(pt, poly)
    inside.append(is_inside)
a = inside

p = crc.point_to_compas(z)
is_inside = cg.is_point_in_polyhedron(p, poly)
b = is_inside
# ---------- end py3_4 ----------
panel_9 = Panel(py3_4.b)  # disabled
cull = CullPattern(List=pop3d, CullPattern=py3_4.a)  # disabled
panel_10 = Panel(py3_4.a)  # disabled

# ----
# Aggregation within boundary
pt_5 = Point(Point(-186.0594048, -107.2522057, 0))  # disabled
number_slider_22 = Slider(90, range=0..180)  # disabled
xy_4 = XYPlane(Origin=pt_5)  # disabled
yz_4 = YZPlane(Origin=pt_5)  # disabled
xz_4 = XZPlane(Origin=pt_5)  # disabled
number_slider_23 = Slider(295, range=0..1000)  # disabled
rotate_4 = Rotate(Geometry=xy_4, Angle=degrees(number_slider_22), Plane=xz_4)  # -> Geometry, Transform; disabled
number_slider_24 = Slider(20, range=0..20)  # disabled
wbicosahedron_2 = WeaverbirdsMeshMeshIcosahedron(Plane=PlaneXY(0, 0, 0), Radius=number_slider_23)  # disabled
pln_6 = Plane(rotate_4.Geometry)  # disabled
number_slider_25 = Slider(93, range=0..100)  # disabled
number_slider_26 = Slider(10, range=0..20)  # disabled
cluster_6 = Cluster(pln=pln_6, num=30)  # disabled
number_slider_27 = Slider(39, range=0..100)  # disabled
list_4 = ValueList({"Regular": 0, "Random": 1}, selected="Regular")  # disabled
mesh = Mesh(wbicosahedron_2)  # disabled
wbedges = WeaverbirdsMeshEdges(MeshOrPolylines=mesh)  # disabled
panel_11 = Panel("""100
300""")  # disabled
panel_12 = Panel("""20
160""")  # disabled
py3_5 = Python3Script(
    first_pln=pln_6,
    length_pattern=panel_11,
    seed=number_slider_27,
    agg_type=list_4,
    agg_count=number_slider_25,
    max_attempts=number_slider_24,
    angle_pattern=panel_12,
    boundary_mesh=mesh)  # -> out, stick_out, axis_out, failed_sticks, failed_axes, collision_log, valid_sticks; inputs first_pln: Plane, length_pattern: list of Double, seed: Int32, agg_type: Int32, agg_count: Int32, max_attempts: Int32, angle_pattern: list of Double, boundary_mesh: Mesh; disabled
# ---------- py3_5: Python ----------
#locate stick class file in the same folder
from compas_rhino import unload_modules
import sys
import os
"""
#get current file path
path = ghenv.Component.OnPingDocument().FilePath
#get parent directory of the parent directory
parentdir = os.path.dirname(path)
#get src folder which contains classes
dire = os.path.join(parentdir,'scripts')

sys.path.append(dire)"""

path = 'D:\\ETH\\Github\\MAS-2526\\08_SpatialAssemblies\\StudentProjects\\group_two\\J3RRY_Sticks_^o^\\scripts\\Package_v2'
sys.path.append(path)

unload_modules('J3RRY_SingleStick_v1')
unload_modules('J3RRY_Aggregation_v2')
unload_modules('J3RRY_Collision_v1')

from J3RRY_SingleStick_v1 import Stick
from J3RRY_Aggregation_v2 import Aggregation
from J3RRY_Collision_v1 import Collision

from compas.geometry import Line, Point, Vector
from compas.geometry import Transformation
from compas_rhino.conversions import plane_to_compas_frame, frame_to_rhino_plane
import scriptcontext as sc
import random


"""Main Code"""

# Convert rhino plane to compas frame
first_pln = plane_to_compas_frame(first_pln)
# random pick length
agg = Aggregation(first_pln, length_pattern, angle_pattern, agg_type, seed)

# Aggregation with Collision Check
index_overlap = []
for i in range(agg_count):
    new_stick = agg.spawn_next_stick_random_in_boundary(
        boundary_mesh, max_attempts, seed)

    if new_stick is None:
        # print (f"Spawn failed at iteration {i}.")
        break
    else:
        # print ("Success. No Collision.")
        pass


# Output
stick_out = agg.visualize()
axis_out = agg.axes

from Grasshopper import DataTree
from Grasshopper.Kernel.Data import GH_Path

failed_sticks = DataTree[object]()
failed_axes = DataTree[object]()
valid_sticks = DataTree[object]()
valid_axes = DataTree[object]()

for i, branch in enumerate(agg.failed_sticks):
    sub_path = GH_Path(i + 1)
    for s in branch:
        failed_sticks.Add(s.geometry, sub_path)
        failed_axes.Add(s.axis, sub_path)

for i, branch in enumerate(agg.valid_sticks):
    sub_path = GH_Path(i + 1)
    for s in branch:
        valid_sticks.Add(s.geometry, sub_path)
        valid_axes.Add(s.axis, sub_path)



# collision_log = DataTree[object]()
# for i, log in enumerate(agg.collision_log):
#     path = GH_Path(i + 1)

#     # 1. primitive values first
#     collision_log.Add(f"attempts = {log['attempts']}", path)
#     collision_log.Add(f"fail_count = {log['fail_count']}", path)
#     collision_log.Add(f"success = {log['success']}", path)
#     collision_log.Add(f"reason = {log['reason']}", path)
#     collision_log.Add(f"length = {log['params']['length']}", path)    
#     collision_log.Add(f"angle = {log['params']['angle']}", path)
#     collision_log.Add(f"from_index = {log['params']['from_index']}", path)
#     collision_log.Add(f"to_index = {log['params']['to_index']}", path)
#     collision_log.Add(f"from_t = {log['params']['from_t']}", path)
#     collision_log.Add(f"to_t = {log['params']['to_t']}", path)
# ---------- end py3_5 ----------
panel_13 = Panel(py3_5.out)  # disabled
draw_9 = COMPASDraw(cg=py3_5.stick_out)  # -> rg; disabled; same code as draw
draw_10 = COMPASDraw(cg=py3_5.failed_axes)  # -> rg; disabled; same code as draw
draw_11 = COMPASDraw(cg=py3_5.axis_out)  # -> rg; disabled; same code as draw
number_slider_28 = Slider(9, range=0..100)  # disabled
draw_12 = COMPASDraw(cg=py3_5.failed_sticks)  # -> rg; disabled; same code as draw
draw_13 = COMPASDraw(cg=py3_5.valid_sticks)  # -> rg; disabled; same code as draw
geo = Geometry(draw_9)  # disabled
number_slider_29 = Slider(9, range=0..10)  # disabled
lng_4 = ListLength(List=geo)  # disabled
midpt_4 = CurveMiddle(Curve=draw_11)  # disabled
min = Minimum(A=number_slider_28, B=lng_4)  # disabled
points_4 = PointList(Points=midpt_4, Size=number_slider_29)  # disabled
series_4 = Series(Start=0, Step=1, Count=min)  # disabled
item = ListItem(List=geo, Index=series_4, Wrap=True)  # disabled
lng_5 = ListLength(List=item)  # disabled
series_5 = Series(Start=0, Step=1, Count=lng_5)  # disabled
gradient_4 = Gradient(
    LowerLimit=0,
    UpperLimit=expr("x-1", lng_5),
    Parameter=series_5,
    stops=[0: RGB(80, 55, 25), 0.5: RGB(159, 65, 29), 1: RGB(174, 166, 129)])  # disabled
number_slider_30 = Slider(0.515, range=0..1)  # disabled
dmaterial_4 = DeconstructMaterial(Material=gradient_4)  # -> Diffuse, Specular, Emission, Transparency, Shine; disabled
path = ConstructPath(Indices=min)  # disabled
geo_2 = Geometry(draw_13)  # disabled
material_4 = CreateMaterial(
    Diffuse=dmaterial_4.Diffuse,
    Specular=dmaterial_4.Specular,
    Emission=dmaterial_4.Emission,
    Transparency=number_slider_30,
    Shine=dmaterial_4.Shine)  # disabled
geo_3 = Geometry(draw_12)  # disabled
branch = TreeBranch(Tree=geo_3, Path=path, MaintainPaths=True)  # disabled
branch_2 = TreeBranch(Tree=geo_2, Path=path, MaintainPaths=True)  # disabled
preview_4 = CustomPreview(Geometry=item, Material=material_4)  # disabled

number_slider_31 = Slider(0, range=0..100)
pt_6 = ConstructPoint(XCoordinate=number_slider_31, YCoordinate=number_slider_31, ZCoordinate=0)
pt_7 = Point(pt_6)
Z = UnitZ(Factor="-10")
number_slider_32 = Slider(200, range=0..1000)
move = Move(Geometry=pt_7, Motion=Z)  # -> Geometry, Transform
addition = Addition(A=number_slider_32, B=Slider(28, range=0..100))
py3_6 = Python3Script(origin=pt_7, legs=Slider(5, range=0..10), r=number_slider_32, incline=Slider(-8, range=-90..90))  # -> out, plns_out; inputs origin: Point3d, legs: Int32, r: Double, incline: Double
# ---------- py3_6: Python ----------
import Rhino.Geometry as rg
import math


plns = []
for i in range(legs):
    theta = 2 * math.pi * (i / legs)
    x = origin.X + r * math.cos(theta)
    y = origin.Y + r * math.sin(theta)
    pt = rg.Point3d(x, y, 0)

    pln = rg.Plane(pt, rg.Vector3d.ZAxis)
    pln.Rotate(theta, rg.Vector3d.ZAxis)
    pln.Rotate(-math.pi / 2, pln.YAxis)
    pln.Rotate(math.radians(incline), pln.YAxis)
    plns.append(pln)

plns_out = plns
# ---------- end py3_6 ----------
polygon = Polygon(Plane=move.Geometry, Radius=addition, Segments=Slider(12, range=0..20), FilletRadius=0)  # -> Polygon, Length
offset = OffsetCurve(Curve=polygon.Polygon, Distance=Slider(262, range=0..1000), Corners=1)
Z_2 = UnitZ(Factor=Slider(1200, range=0..10000))
# Multiple Aggregations
cluster_7 = Cluster(pln=py3_6.plns_out, num=30)
disc = Discontinuity(Curve=polygon.Polygon, Level=1)  # -> Points, Parameters
move_2 = Move(Geometry=offset, Motion=Z_2)  # -> Geometry, Transform
shift = ShiftList(List=disc.Points, Shift="-1", Wrap=True)
disc_2 = Discontinuity(Curve=move_2.Geometry, Level=1)  # -> Points, Parameters
long = LongestList(ListA=shift, ListB=disc.Points, ListC=move.Geometry, PaddingMode=2)  # -> ListA, ListB, ListC
shift_2 = ShiftList(List=disc_2.Points, Shift="-1", Wrap=True)
long_2 = LongestList(ListA=shift, ListB=disc.Points, ListC=disc_2.Points, ListD=shift_2, PaddingMode=2)  # -> ListA, ListB, ListC, ListD
transform = Transform(Geometry=move.Geometry, Transform=move_2.Transform)
merge = Merge(Data1=graft(long.ListA), Data2=graft(long.ListB), Data3=graft(long.ListC))  # -> reverse(Result)
merge_2 = Merge(Data1=graft(long_2.ListA), Data2=graft(long_2.ListB), Data3=graft(long_2.ListC), Data4=graft(long_2.ListD))
long_3 = LongestList(ListA=shift_2, ListB=disc_2.Points, ListC=transform, PaddingMode=2)  # -> ListA, ListB, ListC
conmesh = ConstructMesh(Vertices=merge, Faces={A=0, B=1, C=2, D=2})
merge_3 = Merge(Data1=graft(long_3.ListA), Data2=graft(long_3.ListB), Data3=graft(long_3.ListC))
conmesh_2 = ConstructMesh(Vertices=merge_2, Faces={A=0, B=1, C=2, D=3})
conmesh_3 = ConstructMesh(Vertices=merge_3, Faces={A=0, B=1, C=2, D=2})
merge_4 = Merge(Data1=simplify(conmesh), Data2=simplify(conmesh_2), Data3=simplify(conmesh_3))  # -> flatten(Result)
mjoin = MeshJoin(Meshes=merge_4)
mesh_2 = Mesh(mjoin)
panel_15 = Panel("""200
400""")
list_5 = ValueList({"Regular": 0, "Random": 1}, selected="Random")
pln_7 = Plane(py3_6.plns_out)
wbedges_2 = WeaverbirdsMeshEdges(MeshOrPolylines=mesh_2)
panel_16 = Panel("""20
160""")
py3_7 = Python3Script(
    first_plns=pln_7,
    length_pattern=panel_15,
    angle_pattern=panel_16,
    agg_type=list_5,
    seed=Slider(29, range=0..100),
    agg_count=Slider(3, range=0..20),
    agg_round=Slider(10, range=0..20),
    max_attempts=Slider(10, range=0..20),
    boundary_mesh=mesh_2)  # -> out, stick_out, axis_out, failed_sticks, valid_sticks, collision_log; inputs first_plns: list of Plane, length_pattern: list of Double, angle_pattern: list of Double, agg_type: Int32, seed: Int32, agg_count: Int32, agg_round: Int32, max_attempts: Int32, boundary_mesh: Mesh
# ---------- py3_7: Python ----------
#locate stick class file in the same folder
from compas_rhino import unload_modules
import sys
import os
"""
#get current file path
path = ghenv.Component.OnPingDocument().FilePath
#get parent directory of the parent directory
parentdir = os.path.dirname(path)
#get src folder which contains classes
dire = os.path.join(parentdir,'scripts')

sys.path.append(dire)"""

path = 'D:\\ETH\\Github\\MAS-2526\\08_SpatialAssemblies\\StudentProjects\\group_two\\J3RRY_Sticks_^o^\\scripts\\Package_v2'
sys.path.append(path)

unload_modules('J3RRY_SingleStick_v1')
unload_modules('J3RRY_Aggregation_v3')
unload_modules('J3RRY_Collision_v1')

from J3RRY_SingleStick_v1 import Stick
from J3RRY_Aggregation_v3 import Aggregation
from J3RRY_Collision_v1 import Collision

from compas.geometry import Line, Point, Vector
from compas.geometry import Transformation
from compas_rhino.conversions import plane_to_compas_frame, frame_to_rhino_plane
import scriptcontext as sc
import random

from Grasshopper import DataTree
from Grasshopper.Kernel.Data import GH_Path

"""Main Code"""
# Convert rhino plane to compas frame
first_frames = [plane_to_compas_frame(p) for p in first_plns]

aggs = []
global_sticks = []
for i, frame in enumerate(first_frames):
    agg = Aggregation(frame, length_pattern, angle_pattern, agg_type, seed+i)
    aggs.append(agg)
    global_sticks.extend(agg.sticks)

for _ in range(agg_round):
    for i, agg in enumerate(aggs):
        for _ in range(agg_count):
            new_stick = agg.spawn_next_stick_random_in_boundary(
                boundary_mesh, max_attempts, seed, global_sticks)
            if new_stick is not None:
                global_sticks.append(new_stick)

# Visualization
stick_tree = DataTree[object]()
axis_tree = DataTree[object]()
for i, agg in enumerate(aggs):
    path = GH_Path(i)
    sticks = agg.sticks
    axes = agg.axes
    for s, axis in zip(sticks, axes):
        stick_tree.Add(s.geometry, path)
        axis_tree.Add(axis, path)
# Output
stick_out = stick_tree
axis_out = axis_tree

# Log
failed_sticks = DataTree[object]()
valid_sticks = DataTree[object]()
for i, agg in enumerate(aggs):
    for j, branch in enumerate(agg.failed_sticks):
        path = GH_Path(i, j + 1)
        for s in branch:
            failed_sticks.Add(s.geometry, path)

    for j, branch in enumerate(agg.valid_sticks):
        path = GH_Path(i, j + 1)
        for s in branch:
            valid_sticks.Add(s.geometry, path)



# collision_log = DataTree[object]()
# for i, log in enumerate(agg.collision_log):
#     path = GH_Path(i + 1)

#     # 1. primitive values first
#     collision_log.Add(f"attempts = {log['attempts']}", path)
#     collision_log.Add(f"fail_count = {log['fail_count']}", path)
#     collision_log.Add(f"success = {log['success']}", path)
#     collision_log.Add(f"reason = {log['reason']}", path)
#     collision_log.Add(f"length = {log['params']['length']}", path)    
#     collision_log.Add(f"angle = {log['params']['angle']}", path)
#     collision_log.Add(f"from_index = {log['params']['from_index']}", path)
#     collision_log.Add(f"to_index = {log['params']['to_index']}", path)
#     collision_log.Add(f"from_t = {log['params']['from_t']}", path)
#     collision_log.Add(f"to_t = {log['params']['to_t']}", path)
# ---------- end py3_7 ----------
panel_17 = Panel(py3_7.collision_log)
number_slider_33 = Slider(26, range=0..30)
draw_14 = COMPASDraw(cg=py3_7.stick_out)  # -> rg; same code as draw
draw_15 = COMPASDraw(cg=py3_7.axis_out)  # -> rg; same code as draw
draw_16 = COMPASDraw(cg=py3_7.failed_sticks)  # -> rg; same code as draw
draw_17 = COMPASDraw(cg=py3_7.valid_sticks)  # -> rg; same code as draw
geo_4 = Geometry(draw_14)
midpt_5 = CurveMiddle(Curve=draw_15)
addition_2 = Addition(A=number_slider_33, B=1)
lng_6 = ListLength(List=geo_4)
points_5 = PointList(Points=midpt_5, Size=Slider(10, range=0..10))
min_2 = Minimum(A=addition_2, B=lng_6)
series_6 = Series(Start=0, Step=1, Count=min_2)
panel_18 = Panel(min_2)
item_2 = ListItem(List=geo_4, Index=series_6, Wrap=True)
lng_7 = ListLength(List=item_2)
series_7 = Series(Start=0, Step=1, Count=lng_7)
gradient_5 = Gradient(
    LowerLimit=0,
    UpperLimit=expr("x-1", lng_7),
    Parameter=series_7,
    stops=[0: RGB(80, 55, 25), 0.5: RGB(159, 65, 29), 1: RGB(174, 166, 129)])
min_3 = Minimum(A=number_slider_33, B=lng_6)
dmaterial_5 = DeconstructMaterial(Material=gradient_5)  # -> Diffuse, Specular, Emission, Transparency, Shine
concat = Concatenate(FragmentA="{?;", FragmentB=min_3, FragmentC="}")
material_5 = CreateMaterial(
    Diffuse=dmaterial_5.Diffuse,
    Specular=dmaterial_5.Specular,
    Emission=dmaterial_5.Emission,
    Transparency=Slider(0.515, range=0..1),
    Shine=dmaterial_5.Shine)
split = SplitTree(Data=draw_16, Masks=flatten(concat))  # -> Positive, Negative
split_2 = SplitTree(Data=draw_17, Masks=flatten(concat))  # -> Positive, Negative
preview_5 = CustomPreview(Geometry=item_2, Material=material_5)

# ==== cluster Cluster
pln = ClusterInput()
num = ClusterInput()
pln_2 = Plane(graft(pln))
num_2 = Number(num)
deplane = DeconstructPlane(Plane=pln_2)  # -> flatten(Origin), XAxis, YAxis, ZAxis
entwine = Entwine(Branch00=deplane.XAxis, Branch01=deplane.YAxis, Branch02=deplane.ZAxis, FlattenInputs=True)
merge = Merge(
    Data1=ColourSwatch(SwatchColor=RGB(255, 0, 0)),
    Data2=ColourSwatch(SwatchColor=RGB(0, 255, 0)),
    Data3=ColourSwatch(SwatchColor=RGB(0, 0, 255)))  # -> graft(Result)
multiplication = Multiplication(A=entwine, B=num_2)
vdisex = VectorDisplayEx(Point=deplane.Origin, Vector=multiplication, Colour=merge, Width=2)
