# Grasshopper definition 103_loop_sticks_WN.gh (Grasshopper 1.0.8)

# ----
# CurveLoop
number_slider = Slider(8000, range=0..10000)
construct_point = ConstructPoint(XCoordinate=number_slider, YCoordinate=Slider(0, range=0..100), ZCoordinate=Slider(0, range=0..100))
xy_plane = XYPlane(Origin=construct_point)
curve = Curve(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)
python_3_script = Python3Script(root=xy_plane, curve=curve, stick_length=Slider(200, range=0..1000), offset=Slider(58, range=0..100))  # -> out, geometries; inputs curve: Curve, offset: Int32
# ---------- python_3_script: Python ----------
# r: compas>=2.14.1
# venv: sticks

import sys
import os
import math

# get current file path
path = ghenv.Component.OnPingDocument().FilePath
print(path)
# get parent directory of the parent directory
parentdir = os.path.dirname(path)
print(parentdir)
# get src folder which contains classes
project_root = os.path.join(parentdir, "StudentProjects", "group_two")
dire = os.path.join(project_root, "Wanchen")
print(dire)

sys.path.append(dire)

from compas_rhino import unload_modules

unload_modules("Sticks")
unload_modules("stick_module")

import Sticks
from Sticks import Stick
from stick_module_WN import CurveLoopModule
from compas.geometry import Line, Point, Vector, Frame
from compas_rhino.conversions import curve_to_compas

stick_width = 13.0
stick_depth = 13.0

from compas_rhino.conversions import plane_to_compas_frame, frame_to_rhino_plane

# Convert input to compas
root = plane_to_compas_frame(root)
my_curve = curve_to_compas(curve)
loop = CurveLoopModule(my_curve, stick_length, offset, stick_width, stick_depth)
geometries = loop.visualize()
# ---------- end python_3_script ----------
draw = COMPASDraw(cg=python_3_script.geometries)  # -> rg
#   port cg: The COMPAS geometry or datastructure to be drawn.
#   port rg: The Rhino geometry object.
# ---------- draw: Python ----------
# r: compas>=2.14.1
"""
Draws COMPAS geometry in Grasshopper.
"""

from typing import Any

import Grasshopper

from compas.scene import SceneObject


class CompasToRhinoGeometry(Grasshopper.Kernel.GH_ScriptInstance):
    def RunScript(self, cg):
        if not cg:
            return None

        return SceneObject(item=cg).draw()
# ---------- end draw ----------

# ----
# LoopBranchStable
number_slider_2 = Slider(0, range=0..100)
construct_point_2 = ConstructPoint(XCoordinate=Slider(5000, range=0..10000), YCoordinate=Slider(0, range=0..100), ZCoordinate=number_slider_2)
xy_plane_2 = XYPlane(Origin=construct_point_2)
python_3_script_2 = Python3Script(root=xy_plane_2, stick_length=Slider(200, range=0..1000), offset=Slider(34, range=0..100))  # -> out, geometries
# ---------- python_3_script_2: Python ----------
# r: compas>=2.14.1
# venv: sticks

import sys
import os
import math

#get current file path
path = ghenv.Component.OnPingDocument().FilePath
print (path)
#get parent directory of the parent directory
parentdir = os.path.dirname(path)
print (parentdir)
#get src folder which contains classes
project_root = os.path.join(parentdir, "StudentProjects", "group_two")
dire = os.path.join(project_root,'Wanchen')
print (dire)

sys.path.append(dire)

from compas_rhino import unload_modules

unload_modules("Sticks")
unload_modules("stick_module")

import Sticks
from Sticks import Stick 
from stick_module_WN import BranchingModule, LoopBranchModuleStable
from compas.geometry import Line, Point, Vector, Frame

stick_width = 13.0
stick_depth = 13.0

from compas_rhino.conversions import plane_to_compas_frame, frame_to_rhino_plane

# Convert input to compas
root = plane_to_compas_frame(root)
loop = LoopBranchModuleStable(
    root_frame = root,
    stick_length = 200,
    num_segments = 10,
    min_turn = math.radians(15),
    max_turn = math.radians(120),
    overlap_distance = 30,
    last_length_limit = 50,
    offset = offset,
    depth = 13,
    width = 13,
    min_distance = 30,
    closure_tol = 1.0,
    max_attempts = 200
)
geometries = loop.visualize()
# ---------- end python_3_script_2 ----------
draw_2 = COMPASDraw(cg=python_3_script_2.geometries)  # -> rg; same code as draw
