# Grasshopper definition 101_brep_slicer.ghx (Grasshopper 1.0.8)

brep = Brep(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)
brep_2 = Brep(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)
py3 = Python3Script(x=brep)  # -> out, planes; inputs x: Brep
# ---------- py3: Python ----------
# venv: compas_geo
# r: compas

from compas.geometry import Brep, Vector, Plane

brep = Brep.from_native(x)

layer_height = 18.0

planes = []

for level in range(50):
    z_value = level * layer_height
    plane = Plane([0,0, z_value], Vector(0,0,1))
    curve = brep.slice(plane)
    planes.extend(curve)
# ---------- end py3 ----------
draw = COMPASDraw(cg=py3.planes)  # -> rg
#   port cg: The COMPAS geometry or datastructure to be drawn.
#   port rg: The Rhino geometry object.
# ---------- draw: Python ----------
# r: compas>=2.14.1
"""
Draws COMPAS geometry in Grasshopper.
"""

from typing import Any

import Grasshopper

from compas.scene import SceneObject


class CompasToRhinoGeometry(Grasshopper.Kernel.GH_ScriptInstance):
    def RunScript(self, cg):
        if not cg:
            return None

        return SceneObject(item=cg).draw()
# ---------- end draw ----------
list = ValueList({"single_layer": 1, "continous": 2}, selected="continous")
pt = Point(<point referenced from the Rhino model>)
py3_2 = Python3Script(curves=py3.planes, divide_interval=Slider(50, range=0..100), seam_position=pt, print_type=list)  # -> out, points, line, print_time, print_weight, mypath, contours, print_angles, print_offset, spiral; inputs curves: list, divide_interval: Int32, seam_position: Point3d
# ---------- py3_2: Python ----------
from compas.geometry import Point, Translation, distance_point_point, Polyline, Frame, Vector, closest_point_in_cloud
from compas_rhino.conversions import point_to_compas

from compas_rhino import unload_modules
import sys
import os
import math
#get current file path
path = ghenv.Component.OnPingDocument().FilePath
#get parent directory of the parent directory
parentdir = os.path.dirname(path)
#get src folder which contains classes
dire = os.path.join(parentdir,'src')

sys.path.append(dire)
print(dire)

unload_modules('PrintClass')

from PrintClassEndSP import PrintPoint, PrintPath, Layer

def reorder_list(lst, first_index):
    return [lst[first_index]] + lst[first_index+1:] + lst[:first_index]


reference_pt = point_to_compas(seam_position)

amplitude = 2.0
frequency = 0.5

layers = []
contours = []
for i, curve in enumerate(curves):
    param = curve.divide_by_count(divide_interval, True)
    pts = param[1]
    start_pt, pt, idx = closest_point_in_cloud(reference_pt, pts)
    
    points = reorder_list(pts, idx)
    print_points = []
    poly = Polyline(points)
    contours.append(poly)
    for j, pt in enumerate(points):
 
        print_points.append(PrintPoint(pt,layer_idx= i))
    layers.append(Layer(print_points, layer_idx = i))



mypath = PrintPath(layers)
spiral = mypath.build_spiral_path()
mypath.add_safety_point(Vector(0,1,0), 500.0)
mypath.add_end_safety_point(Vector(0,0,1), 200.0)


points = [printpoint.point for printpoint in mypath.printpoints]
line = mypath.path
print_time = mypath.get_print_time()
print_weight = mypath.get_print_weight()
print_angles, print_offset = mypath.get_print_angles()
# ---------- end py3_2 ----------
draw_2 = COMPASDraw(cg=py3_2.points)  # -> rg; same code as draw
draw_3 = COMPASDraw(cg=py3_2.line)  # -> rg; same code as draw
draw_4 = COMPASDraw(cg=py3_2.spiral)  # -> rg; same code as draw
panel = Panel(py3_2.print_time)
panel_2 = Panel(py3_2.print_weight)

# ----
# Overhang
bnd = Bounds(Numbers=flatten(py3_2.print_angles))
dedomain = DeconstructDomain(Domain=bnd)  # -> Start, End
panel_3 = Panel(dedomain.End)
gradient = Gradient(
    LowerLimit=dedomain.Start,
    UpperLimit="35",
    Parameter=py3_2.print_angles,
    stops=[0: RGB(0, 142, 0), 0.824: RGB(254, 251, 0), 1: RGB(255, 38, 0)])
preview = CustomPreview(Geometry=draw_2, Material=gradient)

bnd_2 = Bounds(Numbers=flatten(py3_2.print_offset))
dedomain_2 = DeconstructDomain(Domain=bnd_2)  # -> Start, End
panel_4 = Panel(dedomain_2.End)
gradient_2 = Gradient(
    LowerLimit=dedomain_2.Start,
    UpperLimit="10",
    Parameter=py3_2.print_offset,
    stops=[0: RGB(0, 142, 0), 0.824: RGB(254, 251, 0), 1: RGB(255, 38, 0)])
preview_2 = CustomPreview(Geometry=draw_2, Material=gradient_2)

pline = PolyLine(Vertices=draw_2, Closed=False)
# Export JSON
py3_3 = Python3Script(mypath=py3_2.mypath, save=Button())  # -> out, a; inputs save: Boolean
# ---------- py3_3: Python ----------
import sys
import os

#get current file path
path = ghenv.Component.OnPingDocument().FilePath
#get parent directory of the parent directory
parentdir = os.path.dirname(path)
#get src folder which contains classes

folderpath = os.path.join(parentdir,'send_to_robot\data')
sys.path.append(folderpath)

name = 'sample.json'
file_path = os.path.join(folderpath, name)
print(file_path)

data = mypath.to_dict()


###########################exportJSON######################################
from compas import json_dump

if save:
    json_dump(data, file_path, pretty=True)
# ---------- end py3_3 ----------
